# Grasshopper definition UBC Orchard Commons.gh (Grasshopper 0.9.75)

calligraphy_vertical_shift = Panel("4")

# ----
# NUMBER OF COMBINATIONS WITH REPETITIONS
panel = Panel("18")
pow = Power(A=panel, B=panel)
cluster = Cluster_8(txt=pow)
panel_2 = Panel(cluster)

scale_x = Slider(0.75, range=0.75..4)
scale_x_2 = Slider(1.25, range=0.75..4)
scale_x_3 = Slider(2, range=0.75..4)
scale_x_4 = Slider(2.75, range=0.75..4)

# ---- group: 440 mm Amplitude
scale_x_5 = Slider(0.953, range=0.001..1.25)

# ---- group: 500 mm Amplitude
scale_x_6 = Slider(1.085, range=0.001..1.25)

# ---- group: Facade Points
Z = UnitZ(Factor="-1000")
Z_2 = UnitZ(Factor="3000")
pt = Point([<point referenced from the Rhino model> x2])
pt_2 = Point([<point referenced from the Rhino model> x2])
pt_3 = Point([<point referenced from the Rhino model> x2])
move = Move(Geometry=pt_2, Motion=Z)  # -> Geometry, Transform
move_2 = Move(Geometry=pt_3, Motion=Z)  # -> Geometry, Transform
move_3 = Move(Geometry=pt, Motion=Z_2)  # -> Geometry, Transform
merge = Merge(Data1=move.Geometry, Data2=move_2.Geometry, Data3=move_3.Geometry)

Z_3 = UnitZ(Factor="-1000")
Z_4 = UnitZ(Factor="2000")
pt_4 = Point([<point referenced from the Rhino model> x2])
pt_5 = Point([<point referenced from the Rhino model> x2])
pt_6 = Point([<point referenced from the Rhino model> x2])
move_4 = Move(Geometry=pt_5, Motion=Z_3)  # -> Geometry, Transform
move_5 = Move(Geometry=pt_6, Motion=Z_4)  # -> Geometry, Transform
move_6 = Move(Geometry=pt_4, Motion=Z_3)  # -> Geometry, Transform
merge_2 = Merge(Data1=move_4.Geometry, Data2=move_5.Geometry, Data3=move_6.Geometry)

# ----
panel_3 = Panel("CURVE AMPLITUDE")
panel_4 = Panel("OPACITY")

# ---- group: East A: Corner Point @ B.O. Slab
pt_7 = Point(<point referenced from the Rhino model>)

# ---- group: VARIABLES OPTION 2
h_shift = Slider(1800, range=1000..2000)
merge_3 = Merge(Data1=scale_x_6, Data2=calligraphy_vertical_shift, Data3=h_shift)

# ---- group: VARIABLES OPTION 1
scale_x_7 = Slider(1.25, range=0..2)
h_shift_2 = Slider(1650, range=1000..2000)
merge_4 = Merge(Data1=scale_x_7, Data2=calligraphy_vertical_shift, Data3=h_shift_2)

# ---- group: VARIABLES OPTION 4
scale_x_8 = Slider(1.25, range=0..2)
merge_5 = Merge(Data1=scale_x_8, Data2=calligraphy_vertical_shift, Data3="1700")

# ---- group: CONSTANT
pt_8 = ConstructPoint(XCoordinate=0, YCoordinate=0, ZCoordinate=0)
level_qty = Panel("18")
grid_x = Panel("3000")
floor_height = Panel("2650")
bay_qty = Panel("18")
xz = XZPlane(Origin=pt_8)

# ---- group: FLOOR HEIGHT
num = Number(floor_height)

# ----
Z_5 = UnitZ(Factor="2000")
Z_6 = UnitZ(Factor="2000")
pt_9 = Point([<point referenced from the Rhino model> x2])
Z_7 = UnitZ(Factor=num)
move_7 = Move(Geometry=pt_9, Motion=Z_6)  # -> Geometry, Transform
rev = Reverse(Vector=Z_7)
pt_10 = Point([<point referenced from the Rhino model> x2])
move_8 = Move(Geometry=pt_10, Motion=rev)  # -> Geometry, Transform
move_9 = Move(Geometry=move_8.Geometry, Motion=Z_5)  # -> Geometry, Transform
merge_6 = Merge(Data1=move_9.Geometry, Data2=move_7.Geometry)

# ---- group: FLOOR HEIGHT
num_2 = Number(floor_height)

# ----
Z_8 = UnitZ(Factor="2000")
Z_9 = UnitZ(Factor="2000")
Z_10 = UnitZ(Factor=num_2)
pt_11 = Point([<point referenced from the Rhino model> x2])
move_10 = Move(Geometry=pt_11, Motion=Z_9)  # -> Geometry, Transform
rev_2 = Reverse(Vector=Z_10)
pt_12 = Point([<point referenced from the Rhino model> x2])
move_11 = Move(Geometry=pt_12, Motion=rev_2)  # -> Geometry, Transform
move_12 = Move(Geometry=move_11.Geometry, Motion=Z_8)  # -> Geometry, Transform
merge_7 = Merge(Data1=move_12.Geometry, Data2=move_10.Geometry)

num_3 = Number(1.5)

# ---- group: VARIABLES OPTION 3
h_shift_3 = Slider(1800, range=1500..2100)
merge_8 = Merge(Data1=num_3, Data2=calligraphy_vertical_shift, Data3=h_shift_3)

# ---- group: Corner Point @ T.O. Slab
item = ListItem(List=move_11.Geometry, Index=0, Wrap=True)
pt_13 = Point(item)

item_2 = ListItem(List=move_8.Geometry, Index=0, Wrap=True)
pt_14 = Point(item_2)

item_3 = ListItem(List=pt_2, Index=0, Wrap=True)
pt_15 = Point(item_3)

# ---- group: LEVEL QTY
int = Integer(level_qty)

# ---- group: FLOOR HEIGHT
num_4 = Number(floor_height)

# ---- group: BAY QTY
int_2 = Integer(bay_qty)

# ---- group: Corner Point @ T.O. Slab
pt_16 = Point(<point referenced from the Rhino model>)

# ----
multiplication = Multiplication(A=int, B=num_4)
Z_11 = UnitZ(Factor=multiplication)

# ---- group: SHIFT in X
number_slider = Slider(2062, range=0..3001)

# ----
# GRID
num_5 = Number(grid_x)
num_6 = Number(floor_height)
int_3 = Integer(int_2)
pln = Plane(xz)
multiplication_2 = Multiplication(A=num_5, B=int_3)
multiplication_3 = Multiplication(A=num_6, B=int_3)
recgrid = Rectangular(Plane=pln, SizeX=num_5, SizeY=num_6, ExtentX=int_3, ExtentY=int_3)  # -> Cells, simplify(Points)
rectangle = Rectangle(Plane=pln, XSize=multiplication_2, YSize=multiplication_3, Radius=0)  # -> Rectangle, Length
cluster_2 = Cluster_7(grid_pts=recgrid.Points, F=number_slider)
swatch = ColourSwatch(SwatchColor=RGB(219, 219, 219))
swatch_2 = ColourSwatch(SwatchColor=RGB(0, 0, 0))
preview = CustomPreview(Geometry=rectangle.Rectangle, Shader=swatch)
preview_2 = CustomPreview(Geometry=cluster_2, Shader=swatch)

# ---- group: Panel Array: Shift from Grid
int_4 = Integer("4200")

# ----
# REFERENCED COLUMN
panel_5 = Panel("{34536.480746, -112189.868641, 164000.0}")
pt_17 = Point(panel_5)
pdecon = Deconstruct(Point=pt_17)  # -> XComponent, YComponent, ZComponent
subtraction = Subtraction(A=pdecon.YComponent, B=int_4)

# ----
# REFERENCED COLUMN
panel_6 = Panel("{26146.480746, -24299.868641, 161000.0}")
pt_18 = Point(panel_6)
pdecon_2 = Deconstruct(Point=pt_18)  # -> XComponent, YComponent, ZComponent
addition = Addition(A=pdecon_2.XComponent, B=int_4)

# ----
# REFERENCED COLUMN
panel_7 = Panel("{-15853.519254, -36579.868641, 161000.0}")
pt_19 = Point(panel_7)
pdecon_3 = Deconstruct(Point=pt_19)  # -> XComponent, YComponent, ZComponent
subtraction_2 = Subtraction(A=pdecon_3.XComponent, B=int_4)

# ----
# REFERENCED COLUMN
panel_8 = Panel("{22256.480746, -76189.868641, 164000.0}")
pt_20 = Point(panel_8)
pdecon_4 = Deconstruct(Point=pt_20)  # -> XComponent, YComponent, ZComponent
addition_2 = Addition(A=pdecon_4.YComponent, B=int_4)

# ---- group: Panel Elev. Drop from T.O. Slab
int_5 = Integer("300")

# ----
# REFERENCED FACADE POINTS
dist = Distance(PointA=pt_15, PointB=pt_7)
pdecon_5 = Deconstruct(Point=pt_15)  # -> XComponent, YComponent, ZComponent
pline = PolyLine(Vertices=merge, Closed=True)
subtraction_3 = Subtraction(A=pdecon_5.ZComponent, B=int_5)

# ---- group: OPTION SELECTOR
list = ValueList({"OPTION 1": 1, "OPTION 2": 2, "OPTION 3": 3, "OPTION 4": 4}, selected="OPTION 3")

# ----
# REFERENCED FACADE POINTS
pdecon_6 = Deconstruct(Point=pt_13)  # -> XComponent, YComponent, ZComponent
pline_2 = PolyLine(Vertices=merge_7, Closed=True)
subtraction_4 = Subtraction(A=pdecon_6.ZComponent, B=int_5)

# ----
# REFERENCED FACADE POINTS
pdecon_7 = Deconstruct(Point=pt_14)  # -> XComponent, YComponent, ZComponent
pline_3 = PolyLine(Vertices=merge_6, Closed=True)
subtraction_5 = Subtraction(A=pdecon_7.ZComponent, B=int_5)

# ----
# REFERENCED FACADE POINTS
pdecon_8 = Deconstruct(Point=pt_16)  # -> XComponent, YComponent, ZComponent
pline_4 = PolyLine(Vertices=merge_2, Closed=True)
subtraction_6 = Subtraction(A=pdecon_8.ZComponent, B=int_5)

# ---- group: OPTION ARGUMENTS
merge_9 = Merge(Data1=merge_4, Data2=merge_3, Data3=merge_8, Data4=merge_5)
lng = ListLength(List=merge_4)
cluster_3 = Cluster_4(variables=merge_9, qty=lng, option=list)  # -> scale_x_2, vertical_shift_2, horizontal_shift_2

# ---- group: TYP. Slab Thickness
int_6 = Integer(dist)

# ----
addition_3 = Addition(A=addition, B="3000")

# ----
# GEOMETRY IMPORTED FROM REVIT
# SHIFT FROM GRID = 1200 + 3000
# BECAUSE:  COLUMNS IMPORTED FROM REVIT
# ONLY OCCUR EVERY OTHER GRID
# 
# THE 1200 VALUE IS SO THAT INTERIOR WALLS
# LIE WITHIN (BEHIND) INNER WYTHE PERIMETERS
# REFERENCED GEOMETRY
# SOUTH BUILDING, WEST ELEV  (SW)
# REFERENCED GEOMETRY
# SOUTH BUILDING, EAST ELEV  (NE)
# REFERENCED GEOMETRY
# NORTH BUILDING, NORTH ELEV  (NW)
# REFERENCED GEOMETRY
# NORTH BUILDING, SOUTH ELEV  (SE)
pt_21 = ConstructPoint(XCoordinate=addition_3, YCoordinate=pdecon_6.YComponent, ZCoordinate=subtraction_4)
pt_22 = ConstructPoint(XCoordinate=subtraction_2, YCoordinate=pdecon_7.YComponent, ZCoordinate=subtraction_5)
pt_23 = ConstructPoint(XCoordinate=pdecon_5.XComponent, YCoordinate=addition_2, ZCoordinate=subtraction_3)
pt_24 = ConstructPoint(XCoordinate=pdecon_8.XComponent, YCoordinate=subtraction, ZCoordinate=subtraction_6)

# ---- group: Lift Above T.O. Slab
int_7 = Integer("25")

# ---- group: Drop Below B.O. Slab
int_8 = Integer("25")

# ---- group: HARMONIOUS MELODY CURVE
# CALLIGRAPHY
crv = Curve(<curve referenced from the Rhino model>)

# ---- group: ADJUSTMENT in 'X'
panel_9 = Panel("-150")

# ---- group: SCALE X
num_7 = Number(cluster_3.scale_x_2)

# ---- group: BASE PT
pt_25 = Point(pt_8)

# ---- group: BLDG HEIGHT
bldg_height = Vector(Z_11)

# ---- group: FLOOR HEIGHT
num_8 = Number(floor_height)

# ---- group: VERTICAL SHIFT
num_9 = Number(cluster_3.vertical_shift_2)

# ---- group: HORIZONTAL SHIFT
num_10 = Number(cluster_3.horizontal_shift_2)

# ---- group: GRID X
num_11 = Number(grid_x)

# ---- group: BAY QTY
int_9 = Integer(int_2)

# ---- group: BOTTOM REFERNCE POINTS
crv_2 = Curve(<curve referenced from the Rhino model>)

# ---- group: RELENTLESS MELODY CURVE
crv_3 = Curve(<curve referenced from the Rhino model>)

# ---- group: ORIGIN
pt_26 = Point(pt_8)

# ---- group: GRID X
num_12 = Number(grid_x)

# ---- group: LEVEL QTY
int_10 = Integer(int)

# ---- group: FLOOR HEIGHT
num_13 = Number(num_4)

# ---- group: PANEL ELEV. DROP FROM T.O. SLAB
num_14 = Number(int_5)

# ---- group: TYP. Slab Thickness
int_11 = Integer(int_6)

# ----
# MOVE + SCALE
# HM CURVE IN 'X'
cluster_4 = Cluster_17(G=crv, F=panel_9, X_2=num_7)

# ----
# SHIFT EACH BAY IN 'X+Z'
# (RELENTLESS MELODY CURVE)
series = Series(Start=0, Step=num_11, Count=int_9)
explode = Explode(Curve=crv_2, Recursive=True)  # -> Segments, Vertices
explode_2 = Explode(Curve=crv_3, Recursive=True)  # -> Segments, Vertices
dist_2 = Distance(PointA=explode.Vertices, PointB=explode_2.Vertices)
X = UnitX(Factor=series)
split = SplitList(List=dist_2, Index=int_9)  # -> ListA, ListB
Z_12 = UnitZ(Factor=split.ListA)
addition_4 = Addition(A=X, B=Z_12)

# ---- group: SELECT FACADE
list_2 = ValueList({"South Tower, West Facade": 0, "South Tower, East Facade": 1, "North Tower, North Facade": 2, "North Tower, South Facade": 3}, selected="North Tower, South Facade")

# ----
# SELECT FACADE
crv_4 = Curve(pline_4)
crv_5 = Curve(pline_3)
pt_27 = Point(pt_23)
pt_28 = Point(pt_24)
pt_29 = Point(pt_21)
pt_30 = Point(pt_22)
crv_6 = Curve(pline)
crv_7 = Curve(pline_2)
yz = YZPlane(Origin=pt_27)
xz_2 = XZPlane(Origin=pt_29)
pi = Pi(Factor=1)
pi_2 = Pi(Factor=1)
rot3d = Rotate3D(Geometry=yz, Angle=pi, Center=pt_27, Axis=Vector(0, 0, 1))  # -> flatten(Geometry), Transform
rot3d_2 = Rotate3D(Geometry=xz_2, Angle=pi_2, Center=pt_29, Axis=Vector(0, 0, 1))  # -> flatten(Geometry), Transform
yz_2 = YZPlane(Origin=pt_28)  # -> flatten(Plane)
xz_3 = XZPlane(Origin=pt_30)  # -> flatten(Plane)
merge_10 = Merge(Data1=rot3d.Geometry, Data2=yz_2, Data3=rot3d_2.Geometry, Data4=xz_3)
merge_11 = Merge(Data1=crv_6, Data2=crv_4, Data3=crv_7, Data4=crv_5)
item_4 = ListItem(List=merge_10, Index=list_2, Wrap=True)
item_5 = ListItem(List=merge_11, Index=list_2, Wrap=True)

# ----
# INNER WYTHE PARAMETERS
addition_5 = Addition(A=num_14, B=int_7)
subtraction_7 = Subtraction(A=num_14, B=int_11)
subtraction_8 = Subtraction(A=num_14, B=int_11)
subtraction_9 = Subtraction(A=subtraction_8, B=int_8)
Z_13 = UnitZ(Factor=addition_5)
Z_14 = UnitZ(Factor=subtraction_7)
Z_15 = UnitZ(Factor=subtraction_9)

# ----
# LEVELS
# PANEL POINTS
# @ FACADE CORNERS
series_2 = Series(Start=0, Step=num_13, Count=expr("x + 1", int_10))
multiplication_4 = Multiplication(A=num_12, B=int_10)
xy = XYPlane(Origin=pt_26)
Z_16 = UnitZ(Factor=series_2)
X_2 = UnitX(Factor=multiplication_4)
move_13 = Move(Geometry=xy, Motion=Z_16)  # -> Geometry, Transform
pln_2 = Plane(move_13.Geometry)
pt_31 = Point(pln_2)
move_14 = Move(Geometry=pt_31, Motion=X_2)  # -> Geometry, Transform

# ----
# ADDITIONAL LEVEL
series_3 = Series(Start=0, Step=num_13, Count=expr("x + 2", int_10))
Z_17 = UnitZ(Factor=series_3)
move_15 = Move(Geometry=xy, Motion=Z_17)  # -> Geometry, Transform
pln_3 = Plane(move_15.Geometry)

# ----
# MAKE HM CURVE
# TILEABLE IN 'Z'
cluster_5 = Cluster(curve_a=cluster_4, base_pt=pt_25, bldg_height=bldg_height)

# ---- group: Inner Wythe: BOTTOM Vertical Shift
vec = Vector(Z_13)

# ---- group: Inner Wythe: TOP Vertical Shift
vec_2 = Vector(Z_15)

# ---- group: RE-ORIENTED PLANE
pln_4 = Plane(item_4)

# ---- group: Facade Perimeter
crv_8 = Curve(item_5)

# ---- group: Spandrel: BOTTOM Vertical Shift
vec_3 = Vector(Z_14)

# ---- group: RM VECTORS
vec_4 = Vector(addition_4)

# ---- group: HM CURVE LEFT
crv_9 = Curve(flatten(cluster_5))

# ----
# HM CURVES (CALLIGRAPHY)
multiplication_5 = Multiplication(A=num_8, B=num_9)
Z_18 = UnitZ(Factor=multiplication_5)
X_3 = UnitX(Factor=num_10)
addition_6 = Addition(A=Z_18, B=X_3)
crv_10 = Curve(crv_9)
move_16 = Move(Geometry=crv_10, Motion=addition_6)  # -> Geometry, Transform
vec_5 = Vector(vec_4)
move_17 = Move(Geometry=crv_10, Motion=vec_5)  # -> flatten(Geometry), Transform
move_18 = Move(Geometry=move_16.Geometry, Motion=vec_5)  # -> flatten(Geometry), Transform

crv_11 = Curve(merge_11)
x_tremez = Extremes(Curve=crv_11, Plane=PlaneXY(0, 0, 0))  # -> Highest, Lowest
explode_3 = Explode(Curve=crv_11, Recursive=True)  # -> Segments, Vertices
pdecon_9 = Deconstruct(Point=x_tremez.Highest)  # -> XComponent, YComponent, graft(ZComponent)
pdecon_10 = Deconstruct(Point=explode_3.Vertices)  # -> XComponent, YComponent, ZComponent
subtraction_10 = Subtraction(A=pdecon_9.ZComponent, B=pdecon_10.ZComponent)
abs = Absolute(Value=subtraction_10)
smaller = SmallerThan(FirstNumber=abs, SecondNumber=300)  # -> SmallerThan, OrEqualTo
cull = CullPattern(List=explode_3.Vertices, CullPattern=smaller.SmallerThan)
Z_19 = UnitZ(Factor=0)
Z_20 = UnitZ(Factor=-4000)
move_19 = Move(Geometry=cull, Motion=Z_19)  # -> Geometry, Transform
move_20 = Move(Geometry=cull, Motion=Z_20)  # -> Geometry, Transform
merge_12 = Merge(Data1=move_19.Geometry, Data2=reverse(move_20.Geometry))
pline_5 = PolyLine(Vertices=merge_12, Closed=True)

# ---- group: COMPLETE vs MINIMAL
list_3 = ValueList({"Complete": 0, "Minimal": 1}, selected="Complete")
int_12 = Integer(list_3)

# ----
# GATE FOR OPTIMIZATION
flatten = FlattenTree(Tree=move_17.Geometry, Path="{0}")
flatten_2 = FlattenTree(Tree=move_18.Geometry, Path="{0}")
gate = StreamGate(Stream=flatten, Gate=int_12)  # -> Target0, Target1
gate_2 = StreamGate(Stream=flatten_2, Gate=int_12)  # -> Target0, Target1

# ---- group: ORIGIN
pt_32 = Point(pt_8)

# ---- group: BLDG HEIGHT
bldg_height_2 = Vector(Z_11)

# ----
# HM CURVES PER BAY
cluster_6 = Cluster_2(curve_a=gate.Target0, base_pt=pt_32, bldg_height=bldg_height_2)
cluster_7 = Cluster_2(curve_a=gate_2.Target0, base_pt=pt_32, bldg_height=bldg_height_2)

# ---- group: OFFSET TO CONCEAL MULLION
int_13 = Integer("25")

# ---- group: ROUND TO
int_14 = Integer("50")

# ---- group: LEVEL PLANES
pln_5 = Plane(pln_2)

# ---- group: WORLD XZ
pln_6 = Plane(xz)

# ---- group: HM CURVE LEFT
crv_12 = Curve(crv_9)

crv_13 = Curve(crv_12)

# ---- group: HM CURVE RIGHT
crv_14 = Curve(move_16.Geometry)

crv_15 = Curve(crv_14)

# ----
# BOUNDS IN 'X'
# PER LEVEL
cluster_8 = Cluster_10(pln=pln_6, crv_left=crv_13, crv_right=crv_15, level_planes=pln_5)  # -> x_leftmost_2, x_rightmost_2

# ---- group: HM CURVES LEFT
crv_16 = Curve(cluster_6)

# ---- group: HM CURVES RIGHT
crv_17 = Curve(cluster_7)

# ---- group: VERTICAL SHIFT PER BAY
num_15 = Number(split.ListA)

# ---- group: BAY QTY
int_15 = Integer(int_2)

# ---- group: LEVEL QTY
int_16 = Integer(level_qty)

# ---- group: FLOOR HEIGHT
num_16 = Number(floor_height)

# ---- group: Glazing Left (original)
num_17 = Number(cluster_8.x_leftmost_2)

# ---- group: Glazing Right (original)
num_18 = Number(cluster_8.x_rightmost_2)

# ---- group: VERTICAL SHIFT PER BAY
num_19 = Number(num_15)

# ----
# PANEL SNAPS
X_4 = Number(num_17)
round_to = Integer(int_14)
min_offset = Integer(int_13)
X_5 = Number(num_18)
round_to_2 = Integer(int_14)
min_offset_2 = Integer(int_13)
division = Division(A=X_4, B=round_to)
division_2 = Division(A=X_5, B=round_to_2)
round = Round(Number=division)  # -> Nearest, Floor, Ceiling
round_2 = Round(Number=division_2)  # -> Nearest, Floor, Ceiling
multiplication_6 = Multiplication(A=round.Ceiling, B=round_to)
multiplication_7 = Multiplication(A=round_2.Floor, B=round_to_2)
addition_7 = Addition(A=multiplication_6, B=min_offset)
subtraction_11 = Subtraction(A=multiplication_7, B=min_offset_2)
min = Integer(addition_7)
min_2 = Integer(subtraction_11)

# ---- group: WANDER RATIO
number_slider_2 = Slider(0.1, range=0..1)

# ---- group: BLDG HEIGHT
bldg_height_3 = Vector(Z_11)

# ---- group: TOWER LEVELS (ELEVATIONS)
num_20 = Number(series_2)

# ---- group: Leftmost
num_21 = Number(min)

# ---- group: Rightmost
num_22 = Number(min_2)

# ---- group: BAY QTY
int_17 = Integer(int_2)

# ---- group: Glazing Left Snap
int_18 = Integer(num_21)

# ---- group: Glazing Right Snap
int_19 = Integer(num_22)

# ---- group: TOWER LEVELS
num_23 = Number(num_20)

# ---- group: ORIGIN
pt_33 = Point(pt_8)

# ---- group: SHIFT PER BAY in 'X'
vec_6 = Vector(X)

# ---- group: Panel Array: Shift from Grid
int_20 = Integer(int_4)

# ---- group: GRID X
num_24 = Number(grid_x)

# ---- group: WORLD XZ
pln_7 = Plane(xz)

# ---- group: BAY QTY
int_21 = Integer(int_2)

# ---- group: Glazing Left (original)
num_25 = Number(num_17)

# ---- group: TEXT POSITION
pt_34 = Point(<point referenced from the Rhino model>)

# ----
bnd = Bounds(Numbers=num_25)
dedomain = DeconstructDomain(Domain=bnd)  # -> Start, End
yz_3 = YZPlane(Origin=pt_34)
subtraction_12 = Subtraction(A=dedomain.End, B=dedomain.Start)
pi_3 = Pi(Factor=1)
Z_21 = UnitZ(Factor=7000)
rot3d_3 = Rotate3D(Geometry=yz_3, Angle=pi_3, Center=pt_34, Axis=Vector(0, 0, 1))  # -> Geometry, Transform
move_21 = Move(Geometry=rot3d_3.Geometry, Motion=Z_21)  # -> Geometry, Transform
panel_10 = Panel("""AMPLITUDE
OF CURVE (mm)""")
swatch_3 = ColourSwatch(SwatchColor=RGB(0, 0, 0))
int_22 = Integer(subtraction_12)
tag = TextTag3D(Location=move_21.Geometry, Text=panel_10, Size="1200", Colour=swatch_3, Justification=7)
tag_2 = TextTag3D(Location=rot3d_3.Geometry, Text=int_22, Size="3500", Colour=swatch_3, Justification=7)

panel_11 = Panel(num_21)
panel_12 = Panel(num_25)
subtraction_13 = Subtraction(A=panel_11, B=panel_12)
graph = QuickGraph(subtraction_13)

# ---- group: WORLD XZ
pln_8 = Plane(xz)

# ---- group: Inner Wythe: TOP Vertical Shift
vec_7 = Vector(vec_2)

# ---- group: Inner Wythe: BOTTOM Vertical Shift
vec_8 = Vector(vec)

# ---- group: BLDG HEIGHT
bldg_height_4 = Vector(Z_11)

# ---- group: Facade Perimeters
crv_18 = Curve(merge_11)

# ---- group: RE-ORIENTED PLANES
pln_9 = Plane(merge_10)

# ---- group: Inner Wythe Reveal at Top
int_23 = Integer("-25")

# ----
list_4 = ValueList({"Right Hand": 1, "Left Hand": 0}, selected="Right Hand")

# ---- group: ZERO
vec_9 = VectorXYZ(XComponent=0, YComponent=0, ZComponent=0)  # -> Vector, Length

# ---- group: Rough Opening Gap
panel_13 = Panel("12.7")

# ---- group: Vent Height
panel_14 = Panel("1800")

# ---- group: FRAME CURVES
crv_19 = Curve(<curve referenced from the Rhino model>)
crv_20 = Curve(<curve referenced from the Rhino model>)
crv_21 = Curve(<curve referenced from the Rhino model>)
crv_22 = Curve(<curve referenced from the Rhino model>)
crv_23 = Curve(<curve referenced from the Rhino model>)
crv_24 = Curve(<curve referenced from the Rhino model>)

# ---- group: Mullion Thickness
panel_15 = Panel("50")

# ---- group: Rounding Integer (mm)
panel_16 = Panel("2")

# ---- group: Min. Vent Width
panel_17 = Panel("450")

# ---- group: Floor Grouping
panel_18 = Panel("3")

# ---- group: MID-PANEL OFFSET
panel_19 = Panel("125")
panel_20 = Panel("75")

panel_21 = Panel("50")
panel_22 = Panel("100")

# ---- group: BAY QTY
int_24 = Integer(int_2)

# ---- group: LEVEL QTY
int_25 = Integer(level_qty)

# ---- group: BAY QTY
int_26 = Integer(int_2)

# ---- group: LEVEL QTY
int_27 = Integer(level_qty)

# ---- group: SCHEDULE LOCATION
pt_35 = Point(<point referenced from the Rhino model>)

# ---- group: FOLD POSITION
division_3 = Division(A=1, B="3")
num_26 = Number(division_3)

# ---- group: PANEL MIN. THICKNESS
Y = UnitY(Factor="25")
rev_3 = Reverse(Vector=Y)

Y_2 = UnitY(Factor="25")
rev_4 = Reverse(Vector=Y_2)

# ---- group: PANEL CHAMFER
panel_23 = Panel("50")
panel_24 = Panel("38")

# ---- group: CHAMFER in 'X'
num_27 = Number(panel_24)

# ---- group: MID-PANEL OFFSET
Y_3 = UnitY(Factor="125")
rev_5 = Reverse(Vector=Y_3)

# ---- group: RIDGE DEPTH
Y_4 = UnitY(Factor="150")
rev_6 = Reverse(Vector=Y_4)

# ---- group: PANEL MIN. THICKNESS
Y_5 = UnitY(Factor="50")
rev_7 = Reverse(Vector=Y_5)

# ---- group: WORLD XZ
pln_10 = Plane(xz)

# ---- group: RE-ORIENTED PLANES
pln_11 = Plane(merge_10)

# ---- group: WORLD XZ
pln_12 = Plane(xz)

# ---- group: RE-ORIENTED PLANES
pln_13 = Plane(merge_10)

# ----
panel_25 = Panel("""79
80
81
82
83
84
85
86
87
88
89""")
panel_26 = Panel("""1100, 400
1100, 450
1100, 500
1100, 550
1100, 600
1150, 400
1150, 600
1200, 400
1200, 450
1200, 500
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""")

# ---- group: QTY GROOVES
panel_27 = Panel("44")

# ---- group: QTY GROOVES PER EDGE
panel_28 = Panel("4")

# ---- group: GROOVE DIMS
dom = ConstructDomain(DomainStart=expr("x * -0.5", "12.7"), DomainEnd=expr("x * 0.5", "12.7"))
dom_2 = ConstructDomain(DomainStart=-25, DomainEnd="25")

# ---- group: RE-ORIENTED PLANES
pln_14 = Plane(graft(merge_10))

# ---- group: Facade Perimeters
crv_25 = Curve(graft(merge_11))

# ---- group: Facade Perimeter
crv_26 = Curve(crv_8)  # disabled

# ---- group: WORLD XZ
pln_15 = Plane(xz)

# ---- group: RE-ORIENTED PLANE
pln_16 = Plane(pln_4)

# ---- group: Facade Perimeter
crv_27 = Curve(crv_8)

# ---- group: BLDG HEIGHT
bldg_height_5 = Vector(Z_11)

# ---- group: WORLD XZ
pln_17 = Plane(xz)

# ---- group: RE-ORIENTED PLANE
pln_18 = Plane(pln_4)

# ---- group: BLDG HEIGHT
bldg_height_6 = Vector(Z_11)

# ---- group: ADDITIONAL LEVEL
pln_19 = Plane(pln_3)

# ---- group: Panel Elev. Drop from T.O. Slab
int_28 = Integer(int_5)

# ---- group: WORLD XZ
pln_20 = Plane(xz)

# ---- group: RE-ORIENTED PLANE
pln_21 = Plane(pln_4)

# ---- group: LEVEL PLANES
pln_22 = Plane(pln_2)

# ----
vec_10 = Vector(bldg_height_5)

orient = Orient(Geometry=pln_19, Source=pln_20, Target=pln_21)  # -> flatten(Geometry), Transform
Z_22 = UnitZ(Factor=int_28)
move_22 = Move(Geometry=orient.Geometry, Motion=Z_22)  # -> Geometry, Transform

orient_2 = Orient(Geometry=pln_19, Source=pln_20, Target=pln_14)  # -> Geometry, Transform

# ---- group: Facade Perimeter
crv_28 = Curve(crv_8)

# ---- group: RE-ORIENTED PLANE
pln_23 = Plane(pln_16)

# ----
move_23 = Move(Geometry=orient_2.Geometry, Motion=Z_22)  # -> Geometry, Transform

# ---- group: Revit Floor Slabs (Jan. 9)
brep = Brep([<brep referenced from the Rhino model> x19])

# ----
brep_2 = Brep([<brep referenced from the Rhino model> x18])
brep_3 = Brep([<brep referenced from the Rhino model> x17])

pcx = CurvePlane(FacadePerim=crv_25, Plane=move_23.Geometry)  # -> Points, ParamsC, ParamsP
item_6 = ListItem(List=pcx.Points, Index=0, Wrap=True)
item_7 = ListItem(List=pcx.Points, Index=1, Wrap=True)
ln = Line(StartPoint=item_6, EndPoint=item_7)
pshift = ShiftPaths(Data=ln, Offset=-1)
cull_i = CullIndex(List=reverse(pshift), Indices=0, Wrap=True)  # -> reverse(List)
crv_29 = Curve(cull_i)
offset = Offset(Curve=crv_29, Distance="-25", Plane=PlaneXY(0, 0, 0), Corners=1)

Z_23 = UnitZ(Factor=-25)

# ---- group: Ext_Wall
crv_30 = Curve(offset)

# ---- group: RE-ORIENTED PLANE
pln_24 = Plane(pln_4)
vec_11 = Vector(pln_24)

# ----
inner_wythe_setback = Panel("-50")
inner_wythe_thickness = Panel("75")

# ---- group: Door_Arc
crv_31 = Curve()

# ---- group: Int_Wall
crv_32 = Curve()

# ---- group: Door_Line
crv_33 = Curve()

# ---- group: Int_Wall
crv_34 = Curve(crv_32)

# ---- group: Ext_Wall
crv_35 = Curve(crv_30)

# ---- group: Door_Line
crv_36 = Curve(crv_33)

# ---- group: Door_Arc
crv_37 = Curve(crv_31)

# ---- group: Facade Perimeter
crv_38 = Curve(crv_27)

# ----
# OUTER WYTHE
# PERIMETERS
cluster_9 = Cluster_25(curve_a=crv_13, curve_b=crv_15, level_planes=pln_2)  # -> A, B, panel_perimeters_2, A_2, B_2
Z_24 = UnitZ(Factor=int_23)
move_24 = Move(Geometry=cluster_9.B, Motion=Z_24)  # -> Geometry, Transform
move_25 = Move(Geometry=cluster_9.B_2, Motion=Z_24)  # -> Geometry, Transform
merge_13 = Merge(Data1=graft(cluster_9.A), Data2=graft(move_24.Geometry), Data3=graft(move_25.Geometry), Data4=graft(cluster_9.A_2))

# ---- group: PANELS OUTER WYTHE (POINTS)
pt_36 = Point(merge_13)

# ----
# WANDERING CURVE
# FOLD POSITION (UNITIZED)
cluster_10 = Cluster_28(outer_wythe_pts=pt_36, wander_ratio=number_slider_2, chamfer_in_x=num_27, bldg_height=bldg_height_3)  # -> fold_position_unitized_2, wandering_curve_2, panels_2

crv_39 = Curve(cluster_10.wandering_curve_2)
crv_40 = Curve(cluster_10.panels_2)

# ---- group: PANELS OUTER WYTHE (POINTS)
pt_37 = Point(pt_36)

# ----
# COMPARISON OF HM CURVE
# AND SINE CURVE
cluster_11 = Cluster_29(panels_outer_wythe_points=pt_37)  # -> sine_vs_hm_curve_2, sine_2
graph_2 = QuickGraph(cluster_11.sine_vs_hm_curve_2)
graph_3 = QuickGraph(cluster_11.sine_2)

# ---- group: FOLD POSITION (UNITIZED)
num_28 = Number(cluster_10.fold_position_unitized_2)

# ----
# PANEL TYPE CLASSIFICATION
division_4 = Division(A=num_19, B=num_16)
int_29 = Integer(int_15)
int_30 = Integer(int_16)
int_31 = Integer(division_4)
subtraction_14 = Subtraction(A=int_30, B=int_31)
series_4 = Series(Start=0, Step=1, Count=int_30)
# PANEL TYPOLOGY
panel_29 = Panel("""A
B
C
D
E
F
G
H
I
J
K
L
M
N
O
P
Q
R
S
T
U
V
W
X
Y
Z""")
split_2 = SplitList(List=panel_29, Index=int_30)  # -> ListA, ListB
gradient = Gradient(
    LowerLimit=0,
    UpperLimit=expr("x - 1", int_30),
    Parameter=series_4,
    stops=[0: RGB(0, 128, 0), 0.5: RGB(255, 255, 0), 1: RGB(255, 0, 0)])
panel_30 = Panel(split_2.ListA)
dup = DuplicateData(Data=graft(gradient), Number=int_29, Order=True)
flip = FlipMatrix(Data=dup)

addition_8 = Addition(A=series_4, B=1)
int_32 = Integer(addition_8)
shift = ShiftList(List=int_32, Shift=9, Wrap=True)
concat = Concatenate(FragmentA="PA-", FragmentB=shift)

# ---- group: SHIFT LIST (PER BAY)
num_29 = Number(subtraction_14)

# ----
dup_2 = DuplicateData(Data=graft(shift), Number=int_29, Order=True)
flip_2 = FlipMatrix(Data=dup_2)
shift_2 = ShiftList(List=simplify(flip_2), Shift=simplify(graft(num_29)), Wrap=True)  # -> simplify(List)
shift_3 = ShiftList(List=simplify(flip), Shift=simplify(graft(num_29)), Wrap=True)  # -> simplify(List)

# ---- group: PANEL TYPE 'LETTERS'
txt = Text(shift_2)

# ---- group: PANEL TYPE 'COLOURS'
col = Colour(shift_3)

# ---- group: VERTICAL SHIFT PER BAY (UNITIZED)
int_33 = Integer(division_4)

int_34 = Integer(int_33)

# ----
# INNER WYTHE
move_26 = Move(Geometry=pt_33, ShiftPerBayInX=vec_6)  # -> Geometry, Transform
subtraction_15 = Subtraction(A=int_20, B=num_24)
X_6 = UnitX(Factor=subtraction_15)
move_27 = Move(Geometry=move_26.Geometry, Motion=X_6)  # -> Geometry, Transform
pdecon_11 = Deconstruct(Point=flatten(move_26.Geometry))  # -> graft(ShiftInX), YComponent, ZComponent
cluster_12 = Cluster_14(
    bay_qty=int_17,
    glazing_left_snap=int_18,
    glazing_right_snap=int_19,
    vertical_shift_per_bay_unitized=int_34,
    shift_per_bay_in_x=pdecon_11.ShiftInX,
    elevations=num_23)  # -> top_left_pt_2, bottom_left_pt_2, top_right_pt_2, bottom_right_pt_2, window_width
addition_9 = Addition(A=pdecon_11.ShiftInX, B=subtraction_15)
line = LineSDL(Start=move_27.Geometry, Direction=Vector(0, 0, 1), Length=50000)

rec_2pt = Rectangle2Pt(Plane=pln_8, PointA=cluster_12.bottom_right_pt_2, PointB=cluster_12.top_left_pt_2, Radius=0)  # -> Rectangle, Length

# ---- group: GRID 'X' VALUES
num_30 = Number(addition_9)

# ---- group: TOP LEFT PT
pt_38 = Point(cluster_12.top_left_pt_2)

# ---- group: BOTTOM LEFT PT
pt_39 = Point(cluster_12.bottom_left_pt_2)

# ---- group: TOP RIGHT PT
pt_40 = Point(cluster_12.top_right_pt_2)

# ---- group: BOTTOM RIGHT PT
pt_41 = Point(cluster_12.bottom_right_pt_2)

# ----
merge_14 = Merge(Data1=pt_39, Data2=pt_38, Data3=pt_40, Data4=pt_41)

# ---- group: INNER WYTHE PERIMETER
# INNER WYTHE
# PERIMETERS
move_28 = Move(Geometry=pt_38, Motion=vec_7)  # -> Geometry, Transform
move_29 = Move(Geometry=pt_39, Motion=vec_8)  # -> Geometry, Transform
move_30 = Move(Geometry=pt_40, Motion=vec_7)  # -> Geometry, Transform
move_31 = Move(Geometry=pt_41, Motion=vec_8)  # -> Geometry, Transform
merge_15 = Merge(Data1=move_29.Geometry, Data2=move_28.Geometry, Data3=move_30.Geometry, Data4=move_31.Geometry)
pline_6 = PolyLine(Vertices=merge_15, Closed=True)
crv_41 = Curve(pline_6)

# ---- group: INNER WYTHE PTS
pt_42 = Point(merge_14)

# ----
split_3 = SplitTree(Data=crv_41, Masks=flatten("{*;0}"))  # -> Positive, Negative
move_32 = Move(Geometry=split_3.Positive, Motion=bldg_height_4)  # -> Geometry, Transform
path_mapper = PathMapper(move_32.Geometry, source="{A;B}", target="{A;18}")

# ----
# OUTER WYTHE
# PERIMETERS
cluster_13 = Cluster_3(curve_a=crv_16, curve_b=crv_17, level_planes=pln_2)  # -> A, B, panel_perimeters_2, A_2, B_2
crv_42 = Curve(crv_41)
Z_25 = UnitZ(Factor=int_23)
move_33 = Move(Geometry=cluster_13.B, Motion=Z_25)  # -> Geometry, Transform
move_34 = Move(Geometry=cluster_13.B_2, Motion=Z_25)  # -> Geometry, Transform
merge_16 = Merge(Data1=graft(cluster_13.A), Data2=graft(move_33.Geometry), Data3=graft(move_34.Geometry), Data4=graft(cluster_13.A_2))
pline_7 = PolyLine(Vertices=merge_16, Closed=True)

# ---- group: Panel Perimeters
crv_43 = Curve(cluster_13.panel_perimeters_2)

# ----
rotate = Rotate(Geometry=pln_7, Angle=1.570796327, Plane=PlaneXY(0, 0, 0))  # -> Geometry, Transform
item_8 = ListItem(List=crv_43, Index=0, Wrap=True)
x_tremez_2 = Extremes(Curve=item_8, Plane=rotate.Geometry)  # -> Highest, Lowest
dup_3 = DuplicateData(Data=pdecon_11.ShiftInX, Number=int_21, Order=True)  # -> simplify(graft(Data))
pdecon_12 = Deconstruct(Point=simplify(x_tremez_2.Highest))  # -> XComponent, YComponent, ZComponent
subtraction_16 = Subtraction(A=pdecon_12.XComponent, B=dup_3)
xz_4 = XZPlane(Origin=cluster_12.top_left_pt_2)
Z_26 = UnitZ(Factor=-900)
int_35 = Integer(simplify(graft(cluster_12.window_width)))
move_35 = Move(Geometry=xz_4, Motion=Z_26)  # -> Geometry, Transform
int_36 = Integer(subtraction_16)
tag_3 = TextTag3D(Location=move_35.Geometry, Text=int_36, Size=600, Colour=ColourSwatch(SwatchColor=RGB(255, 140, 140)), Justification=7)
tag_4 = TextTag3D(Location=xz_4, Text=int_35, Size=600, Colour=ColourSwatch(SwatchColor=RGB(255, 255, 255)), Justification=7)

merge_17 = Merge(Data1=path_mapper, Data2=crv_41)

# ---- group: PANELS INNER WITHE
crv_44 = Curve(merge_17)

# ----
# INNER WYTHE
# CORNER POINTS INCLUDED
# FOR WINDOW WALL
cluster_14 = Cluster_40(panels_inner_wythe=crv_44, facade_perimeters=crv_18, pln=pln_9)  # -> window_curves_2, corner_window_curves_2

# ---- group: WINDOW CURVES
crv_45 = Curve(cluster_14.window_curves_2)

# ---- group: CORNER WINDOW CURVES
crv_46 = Curve(cluster_14.corner_window_curves_2)

# ----
cluster_15 = Cluster_37(
    solids_toggle=Toggle(True),
    jamb=crv_19,
    header=crv_20,
    horiz_tbar=crv_21,
    sill=crv_22,
    vert_tbar=crv_23,
    caulking=crv_24,
    r_o_gap=panel_13,
    mullion_thickness=panel_15,
    window_curves=crv_45,
    vent_height=panel_14,
    rounding_integer=panel_16,
    bottom_pts_vert_shift=vec_9.Vector,
    vent_l_r_hand=list_4,
    min_vent_width=panel_17,
    floor_grouping=panel_18)  # -> B, window_wall_meshes_2, approx_window_center_pt_3, window_pts_2, window_pts_levels_2, window_widths_3, window_type_2, window_type_descriptions_2
cset = CreateSet(List=flatten(cluster_15.window_type_2))  # -> Set, Map
sort = SortList(Keys=cset.Set)  # -> Keys, ValuesA
split_4 = SplitTree(Data=cluster_15.window_type_2, Masks=flatten("{*;18}"))  # -> Positive, Negative
int_37 = Integer(sort.Keys)

# ---- group: SHIFT LIST (PER BAY)
num_31 = Number(num_29)

num_32 = Number(num_29)

# ----
panel_31 = Panel(split_4.Positive)
panel_32 = Panel(int_37)

series_5 = Series(Start=0, Step=1, Count=expr("x / 2", int_27))
dom_3 = ConstructDomain(DomainStart=panel_20, DomainEnd=panel_19)
bnd_2 = Bounds(Numbers=series_5)
remap = RemapNumbers(Value=series_5, Source=bnd_2, Target=dom_3)
num_33 = Number(reverse(remap))
merge_18 = Merge(Data1=remap, Data2=num_33)
dup_4 = DuplicateData(Data=graft(merge_18), Number=int_26, Order=True)
flip_3 = FlipMatrix(Data=dup_4)
shift_4 = ShiftList(List=simplify(flip_3), Shift=simplify(graft(num_31)), Wrap=True)  # -> simplify(List)

series_6 = Series(Start=0, Step=1, Count=expr("x / 2", int_25))
dom_4 = ConstructDomain(DomainStart=panel_21, DomainEnd=panel_22)
bnd_3 = Bounds(Numbers=series_6)
remap_2 = RemapNumbers(Value=series_6, Source=bnd_3, Target=dom_4)
num_34 = Number(reverse(remap_2))
merge_19 = Merge(Data1=num_34, Data2=remap_2)
dup_5 = DuplicateData(Data=graft(merge_19), Number=int_24, Order=True)
flip_4 = FlipMatrix(Data=dup_5)
shift_5 = ShiftList(List=simplify(flip_4), Shift=simplify(graft(num_32)), Wrap=True)  # -> simplify(List)

# ----
# WINDOW WALL
# WINDOW WIDTHS
# 0   R.O. WIDTH (Revit window width)
# 1   VENT WIDTH (Glass width of operable vent)
num_35 = Number(cluster_15.window_widths_3)
panel_33 = Panel(num_35)

lng_2 = ListLength(List=int_37)
cluster_16 = Cluster_38(
    windows_meshes=cluster_15.window_wall_meshes_2,
    window_walls=cluster_15.B,
    approx_window_center_pt=cluster_15.approx_window_center_pt_3,
    window_widths=num_35,
    schedule_location=pt_35)  # -> re_oriented_windows_meshes_2, re_oriented_window_walls_2, window_type_qty_2, schedule_planes_2, schedule_cells_2, vent_width_2, window_width_2
panel_34 = Panel(lng_2)

# ---- group: PANEL CHAMFER
num_36 = Number(shift_5)

# ---- group: VERTICAL SHIFT PER BAY (UNITIZED)
int_38 = Integer(int_33)

# ----
explode_4 = Explode(Curve=crv_46, Recursive=True)  # -> Segments, Vertices
neg = Negative(Value=graft(int_38))

# ---- group: MID-PANEL OFFSET (RE-MAPPED)
Y_6 = UnitY(Factor=shift_4)
rev_8 = Reverse(Vector=Y_6)

# ----
cull_i_2 = CullIndex(List=explode_4.Vertices, Indices=4, Wrap=True)
lng_3 = ListLength(List=num_36)
lng_4 = ListLength(List=rev_8)
shift_6 = ShiftList(List=num_28, Shift=neg, Wrap=True)  # -> simplify(List)
lng_5 = ListLength(List=shift_6)

# ---- group: PANELS OUTER WYTHE (POINTS)
pt_43 = Point(merge_16)

# ----
dup_6 = DuplicateData(Data=num_26, Number=lng_5, Order=True)
dup_7 = DuplicateData(Data=panel_23, Number=lng_3, Order=True)
dup_8 = DuplicateData(Data=rev_5, Number=lng_4, Order=True)
pshift_2 = ShiftPaths(Data=cull_i_2, Offset=-2)
pshift_3 = ShiftPaths(Data=dup_6, Offset=-1)
pshift_4 = ShiftPaths(Data=dup_7, Offset=-1)
pshift_5 = ShiftPaths(Data=dup_8, Offset=-1)
cluster_17 = Cluster_42(world_xz=pln_12, window_pts=pshift_2, re_oriented_planes=pln_13)  # -> windows_breps_4, windows_meshes_4, window_pts_4, window_planes_2
cluster_18 = Cluster_42(
    world_xz=pln_10,
    windows_breps=cluster_15.B,
    windows_meshes=cluster_15.window_wall_meshes_2,
    window_pts=cluster_15.window_pts_levels_2,
    re_oriented_planes=pln_11)  # -> windows_breps_4, windows_meshes_4, window_pts_4, window_planes_2

vec_12 = VectorXYZ(XComponent=1000, YComponent=-1000, ZComponent=0)  # -> Vector, Length
vec_13 = VectorXYZ(XComponent=0, YComponent=-1600, ZComponent=0)  # -> Vector, Length
int_39 = Integer(cluster_16.vent_width_2)
int_40 = Integer(cluster_16.window_width_2)
expression = Expression(x=int_40, y=int_39, Expression="Format(\"{0}, {1}\", x, y)")
move_36 = Move(Geometry=cluster_16.schedule_planes_2, Motion=vec_12.Vector)  # -> Geometry, Transform
move_37 = Move(Geometry=cluster_16.schedule_planes_2, Motion=vec_13.Vector)  # -> Geometry, Transform
crv_47 = Curve(cluster_16.schedule_cells_2)
swatch_4 = ColourSwatch(SwatchColor=RGB(0, 124, 140))
preview_3 = CustomPreview(Geometry=crv_47, Shader=swatch_4)
brep_4 = Brep(cluster_16.re_oriented_window_walls_2)
tag_5 = TextTag3D(Location=move_36.Geometry, Text=cluster_16.window_type_qty_2, Size=600, Colour=swatch_4, Justification=7)
tag_6 = TextTag3D(Location=move_37.Geometry, Text=expression, Size=500, Colour=swatch_4, Justification=8)
preview_4 = CustomPreview(Geometry=cluster_16.re_oriented_windows_meshes_2, Shader=ColourSwatch(SwatchColor=RGB(56, 56, 56)))

int_41 = Integer(flatten(int_40))

# ----
# SOLID PANELS WITH CHAMFERS (IN/OUT)
# AND WANDERING RIDGE/VALLEY
cluster_19 = Cluster_26(
    fold_position=pshift_3,
    ridge_depth=pshift_5,
    min_thickness=rev_3,
    pt=pt_43,
    chamfer_in_y=pshift_4,
    chamfer_in_x=panel_24)  # -> dims_in_x_2, dims_in_y_2, srf_2, perim_2
cluster_20 = Cluster_23(srf=cluster_19.srf_2)
join = BrepJoin(Breps=cluster_19.srf_2)  # -> Breps, Closed
cap = CapHoles(Brep=join.Breps)
path_mapper_2 = PathMapper(cluster_20, source="{A;B}", target="{3;A;B}")
path_mapper_3 = PathMapper(cap, source="{A;B}", target="{3;A;B}")
path_mapper_4 = PathMapper(cluster_19.perim_2, source="{A;B}", target="{3;A;B}")

# ----
# SOLID PANELS WITH CHAMFERS (IN/OUT)
cluster_21 = Cluster_19(fold_position=num_26, ridge_depth=rev_8, min_thickness=rev_3, pt=pt_43, chamfer_in_y=num_36, chamfer_in_x=panel_24)  # -> srf_2, perim_2
cluster_22 = Cluster_23(srf=cluster_21.srf_2)
join_2 = BrepJoin(Breps=cluster_21.srf_2)  # -> Breps, Closed
cap_2 = CapHoles(Brep=join_2.Breps)
path_mapper_5 = PathMapper(cluster_22, source="{A;B}", target="{2;A;B}")
path_mapper_6 = PathMapper(cap_2, source="{A;B}", target="{2;A;B}")
path_mapper_7 = PathMapper(cluster_21.perim_2, source="{A;B}", target="{2;A;B}")

# ----
# SOLID PANELS WITH CHAMFERS (RIDGE)
cluster_23 = Cluster_19(fold_position=num_26, ridge_depth=rev_5, min_thickness=rev_4, pt=pt_43, chamfer_in_y=panel_23, chamfer_in_x=panel_24)  # -> srf_2, perim_2
cluster_24 = Cluster_23(srf=cluster_23.srf_2)
join_3 = BrepJoin(Breps=cluster_23.srf_2)  # -> Breps, Closed
cap_3 = CapHoles(Brep=join_3.Breps)
path_mapper_8 = PathMapper(cluster_24, source="{A;B}", target="{1;A;B}")
path_mapper_9 = PathMapper(cap_3, source="{A;B}", target="{1;A;B}")
path_mapper_10 = PathMapper(cluster_23.perim_2, source="{A;B}", target="{1;A;B}")

# ----
# SOLID PANELS WITH RIDGE
cluster_25 = Cluster_16(ridge_depth=rev_6, min_thickness=rev_7, pt=pt_43)  # -> srf_2, perim_2
cluster_26 = Cluster_23(srf=cluster_25.srf_2)
join_4 = BrepJoin(Breps=cluster_25.srf_2)  # -> Breps, Closed
cap_4 = CapHoles(Brep=join_4.Breps)
path_mapper_11 = PathMapper(cluster_26, source="{A;B}", target="{0;A;B}")
path_mapper_12 = PathMapper(cap_4, source="{A;B}", target="{0;A;B}")
path_mapper_13 = PathMapper(cluster_25.perim_2, source="{A;B}", target="{0;A;B}")

# ---- group: INNER WYTHE PTS
pt_44 = Point(pt_42)

# ----
clean = CleanTree(Tree=cluster_17.window_pts_4, CleanInvalid=True, CleanEmpty=True)
txt_2 = Text(flatten(expression))
pdecon_13 = Deconstruct(Point=pt_44)  # -> XComponent, YComponent, ZComponent

# ---- group: WINDOWS (BREPS)
brep_5 = Brep(cluster_18.windows_breps_4)

# ---- group: WINDOWS (MESH)
mesh = Mesh(cluster_18.windows_meshes_4)

# ---- group: WINDOWS (BREPS)
brep_6 = Brep(cluster_17.windows_breps_4)

# ---- group: WINDOWS (MESH)
mesh_2 = Mesh(cluster_17.windows_meshes_4)

# ---- group: WINDOW PTS
pt_45 = Point(cluster_18.window_pts_4)

# ---- group: WINDOW TYPE
txt_3 = Text(cluster_15.window_type_2)

# ---- group: WINDOW PTS
pt_46 = Point(clean)

# ----
panel_35 = Panel(txt_2)
item_9 = ListItem(List=pdecon_13.XComponent, Index=0, Wrap=True)
item_10 = ListItem(List=pdecon_13.XComponent, Index=3, Wrap=True)
pline_8 = PolyLine(Vertices=pt_46, Closed=True)
pline_9 = PolyLine(Vertices=pt_45, Closed=True)
split_5 = SplitTree(Data=mesh, Masks=flatten("{3;*}"))  # -> Positive, Negative
merge_20 = Merge(Data1=item_9, Data2=item_10)
crv_48 = Curve(pline_8)
crv_49 = Curve(pline_9)

# ---- group: GRID 'X' VALUES
num_37 = Number(num_30)

# ---- group: OUTER WYTHE DIMS in 'X'
num_38 = Number(cluster_19.dims_in_x_2)

# ---- group: OUTER WYTHE DIMS in 'Y'
num_39 = Number(cluster_19.dims_in_y_2)

# ---- group: INNER WYTHE DIMS in 'X'
num_40 = Number(merge_20)

# ----
# PREVIEW GLAZING
mesh_3 = MeshBrep(
    Brep=crv_48,
    Settings={GridMaxCount=0, GridMinCount=16, JaggedSeams=False, MaxEdgeLength=0, MinEdgeLength=0.0001, MinTolerance=0, Refine=True, RefineAngle=0, RelativeTolerance=0.65, SimplePlanes=True, Tolerance=0})
preview_5 = CustomPreview(Geometry=mesh_3, Shader=ColourSwatch(SwatchColor=RGBA(51, 211, 255, 142)))
preview_6 = CustomPreview(Geometry=mesh_2, Shader=ColourSwatch(SwatchColor=RGB(56, 56, 56)))

# ----
# PREVIEW GLAZING
mesh_4 = MeshBrep(
    Brep=crv_49,
    Settings={GridMaxCount=0, GridMinCount=16, JaggedSeams=False, MaxEdgeLength=0, MinEdgeLength=0.0001, MinTolerance=0, Refine=True, RefineAngle=0, RelativeTolerance=0.65, SimplePlanes=True, Tolerance=0})
preview_7 = CustomPreview(Geometry=mesh_4, Shader=ColourSwatch(SwatchColor=RGBA(51, 211, 255, 142)))
preview_8 = CustomPreview(Geometry=split_5.Positive, Shader=ColourSwatch(SwatchColor=RGB(56, 56, 56)))

# ----
# WINDOW TYPE
swatch_5 = ColourSwatch(SwatchColor=RGB(0, 0, 0))
tag_7 = TextTag3D(Location=cluster_18.window_planes_2, Text=txt_3, Size=600, Colour=swatch_5, Justification=5)

merge_21 = Merge(Data1=num_38, Data2=num_40)

# ----
# EXPORT GEOMETRY TO INVENTOR
split_6 = SplitTree(Data=num_37, Masks=flatten("{0;2}"))  # -> Positive, Negative
split_7 = SplitTree(Data=merge_21, Masks=flatten("{2;*}"))  # -> Positive, Negative
split_8 = SplitTree(Data=num_39, Masks=flatten("{2;*}"))  # -> Positive, Negative
path_mapper_14 = PathMapper(split_7.Positive, source="{A;B}", target="{0;B}")
path_mapper_15 = PathMapper(split_8.Positive, source="{A;B}", target="{0;B}")
cluster_27 = Cluster_33(prefix="P", datum_offset="1000", grid_x_value=split_6.Positive, dims_in_x=path_mapper_14, dims_in_y=path_mapper_15)
panel_36 = Panel(cluster_27)

# ---- group: PANELS INNER WITHE
crv_50 = Curve(crv_42)

# ---- group: PANELS OUTER WYTHE
crv_51 = Curve(pline_7)

# ---- group: PANEL TYPE 'LETTERS'
txt_4 = Text(txt)

# ---- group: PANEL TYPE 'COLOURS'
col_2 = Colour(col)

# ---- group: PANEL TYPE 'LETTERS'
txt_5 = Text(txt_4)

# ---- group: PANEL TYPE 'COLOURS'
col_3 = Colour(col_2)

# ---- group: OUTER WYTHE
crv_52 = Curve(crv_51)

# ---- group: PANELS (FLAT)
crv_53 = Curve(crv_51)

# ---- group: INNER WYTHE
crv_54 = Curve(crv_50)

# ---- group: IN-PLACE CORNER WINDOW CURVES
crv_55 = Curve(crv_48)

# ---- group: IN-PLACE WINDOW CURVES
crv_56 = Curve(crv_49)

# ---- group: CORNER GLAZING
crv_57 = Curve(crv_55)

# ---- group: WINDOW TYPE
txt_6 = Text(txt_3)

# ----
pshift_6 = ShiftPaths(Data=txt_6, Offset=-2)  # disabled
txt_7 = Text(flatten(pshift_6))

# ---- group: PANEL OPTIONS
list_5 = ValueList({"Ridge": 0, "In Only": 1, "In/Out": 2, "Wander": 3}, selected="Wander")
txt_8 = Text(["{0;*}", "{1;*}", "{2;*}", "{3;*}"])
item_11 = ListItem(List=txt_8, Index=list_5, Wrap=True)

# ----
# OPTIONS (SOLIDS)
sqft = Panel("44")
merge_22 = Merge(Data1=path_mapper_2, Data2=path_mapper_5, Data3=path_mapper_8, Data4=path_mapper_11)
merge_23 = Merge(Data1=path_mapper_3, Data2=path_mapper_6, Data3=path_mapper_9, Data4=path_mapper_12)
merge_24 = Merge(Data1=path_mapper_4, Data2=path_mapper_7, Data3=path_mapper_10, Data4=path_mapper_13)
txt_9 = Text(item_11)
split_9 = SplitTree(Data=merge_22, Masks=flatten(txt_9))  # -> Positive, Negative
split_10 = SplitTree(Data=merge_23, Masks=flatten(txt_9))  # -> Positive, Negative
split_11 = SplitTree(Data=merge_24, Masks=flatten(txt_9))  # -> Positive, Negative
cluster_28 = Cluster_30(outer_wythe=split_11.Positive, cost_per_sqft=sqft)  # -> cost_per_panel_2, total_cost_2

# ---- group: PANEL OPTIONS (continued)
panel_37 = Panel(cluster_28.total_cost_2)

# ----
# GROOVES
srf = Surface(split_9.Positive)  # disabled
edges = BrepEdges(Brep=srf)  # -> Naked, Interior, NonManifold
item_12 = ListItem(List=edges.Naked, Index=1, Wrap=True)
item_13 = ListItem(List=edges.Naked, Index=3, Wrap=True)
pshift_7 = ShiftPaths(Data=item_12, Offset=-1)
pshift_8 = ShiftPaths(Data=item_13, Offset=-1)
flip_5 = FlipCurve(Curve=pshift_8)  # -> Curve, Flag

cost_per_panel = Integer(cluster_28.cost_per_panel_2)

# ----
# REGULAR RIDGE/VALLEY
cluster_29 = Cluster_27(top_edge=pshift_7, bottom_edge=flip_5.Curve, qty_grooves=panel_27)
line_2 = Line(cluster_29)

# ----
# WANDERING RIDGE/VALLEY
divide = DivideCurve(Curve=pshift_7, Count=expr("x + 1", panel_28), Kinks=False)  # -> Points, Tangents, Parameters
divide_2 = DivideCurve(Curve=flip_5.Curve, Count=expr("x + 1", panel_28), Kinks=False)  # -> Points, Tangents, Parameters
addition_10 = Addition(A=panel_28, B=1)
merge_25 = Merge(Data1="0", Data2=addition_10)
ln_2 = Line(StartPoint=divide.Points, EndPoint=divide_2.Points)
cull_i_3 = CullIndex(List=ln_2, Indices=merge_25, Wrap=True)
pshift_9 = ShiftPaths(Data=cull_i_3, Offset=-1)

pshift_10 = ShiftPaths(Data=pshift_9, Offset=-1)
ext = ExtendCurve(Curve=pshift_10, Type=0, Start="100", End="100")
simplify = SimplifyCurve(Curve=ext)  # -> reparameterize(Curve), Simplified
pframe = PerpFrame(Curve=simplify.Curve, Parameter=0)
len = Length(Curve=simplify.Curve)
vec_14 = Vector(simplify.Curve)
amp = Amplitude(Vector=vec_14, Amplitude=len)
rectangle_2 = Rectangle(Plane=pframe, XSize=dom_2, YSize=dom, Radius=0)  # -> Rectangle, Length
extr = Extrude(Base=rectangle_2.Rectangle, Direction=amp)
cap_5 = CapHoles(Brep=extr)

# ---- group: GROOVES
crv_58 = Curve(pshift_9)

# ----
preview_9 = CustomPreview(Geometry=crv_58, Shader=ColourSwatch(SwatchColor=RGB(0, 0, 0)))

# ---- group: OUTER WYTHE (SOLID)
solids_panels_with_ridge = Brep(split_10.Positive)

# ----
sdiff = SolidDifference(BrepsA=solids_panels_with_ridge, BrepsB=cap_5)  # disabled

# ---- group: GROOVES
crv_59 = Curve(crv_58)

# ---- group: COST PER PANEL
int_42 = Integer(cost_per_panel)

# ---- group: OUTER WYTHE (SOLID)
solids_panels_with_ridge_2 = Brep(solids_panels_with_ridge)

# ----
# INCLUSION
pshift_11 = ShiftPaths(Data=simplify(crv_59), Offset=-1)
pshift_12 = ShiftPaths(Data=simplify(solids_panels_with_ridge_2), Offset=-1)
pshift_13 = ShiftPaths(Data=simplify(crv_54), Offset=-1)
pshift_14 = ShiftPaths(Data=simplify(crv_52), Offset=-1)
orient_3 = Orient(Geometry=pshift_13, Source=pln_15, Target=pln_16)  # -> graft(Geometry), Transform
cluster_30 = Cluster_24(G=pshift_11, A=pln_15, B=pln_16, T=vec_10)
cluster_31 = Cluster_20(G=pshift_12, A=pln_15, B=pln_16, T=vec_10)
cluster_32 = Cluster_20(G=pshift_13, A=pln_15, B=pln_16, T=vec_10)
cluster_33 = Cluster_20(G=pshift_14, A=pln_15, B=pln_16, T=vec_10)
cluster_34 = Cluster_18(C=cluster_32, C_2=crv_27)
cluster_35 = Cluster_18(C=orient_3.Geometry, C_2=crv_27)
viewer = ParamViewer(cluster_30)
bool = Boolean(cluster_34)
cull_2 = CullPattern(List=viewer, CullPattern=flatten(bool))
branch = TreeBranch(Tree=cluster_30, Path=cull_2, MaintainPaths=True)
cull_3 = CullPattern(List=cluster_31, CullPattern=bool)
cull_4 = CullPattern(List=cluster_32, CullPattern=bool)
cull_5 = CullPattern(List=cluster_33, CullPattern=bool)
cull_6 = CullPattern(List=orient_3.Geometry, CullPattern=cluster_35)

# ----
# INCLUSION
pshift_15 = ShiftPaths(Data=simplify(crv_53), Offset=-1)
pshift_16 = ShiftPaths(Data=simplify(int_42), Offset=-1)
concat_2 = Concatenate(FragmentA="$ ", FragmentB=pshift_16)
area = Area(Geometry=pshift_15)  # -> Area, Centroid
xz_5 = XZPlane(Origin=area.Centroid)
cluster_36 = Cluster_22(col=col_3)
cluster_37 = Cluster_21(txt=txt_5)
cluster_38 = Cluster_21(txt=concat_2)
cluster_39 = Cluster_20(G=xz_5, A=pln_17, B=pln_18, T=bldg_height_6)
Z_27 = UnitZ(Factor=-700)
bool_2 = Boolean(cluster_34)
cull_7 = CullPattern(List=cluster_39, CullPattern=bool_2)
move_38 = Move(Geometry=cull_7, Motion=Z_27)  # -> Geometry, Transform
cull_8 = CullPattern(List=cluster_37, CullPattern=bool_2)
cull_9 = CullPattern(List=cluster_36, CullPattern=bool_2)
cull_10 = CullPattern(List=cluster_38, CullPattern=bool_2)

# ---- group: INNER WYTHE
crv_60 = Curve(orient_3.Geometry)

# ----
# CORNER GLAZING
# 1. THIS CLUSTER ASSUMES THAT
# PANEL EXCLUSIONS ONLY OCCUR
# AT THE BOTTOM END OF BAYS.
# 2. CORNER UNITS DETECTED USING
# 10% VECTOR SIMILARITY THRESHOLD
# (THIS VALUE COULD BE HIGHER AS REQ'D)
cluster_40 = Cluster_31(inner_wythe=crv_60, facade_perim=crv_28, re_oriented_pl=pln_23)  # -> corner_left_2, corner_right_2, typ_glazing_2
crv_61 = Curve(flatten(cluster_40.corner_left_2))
crv_62 = Curve(flatten(cluster_40.corner_right_2))
crv_63 = Curve(flatten(cluster_40.typ_glazing_2))
merge_26 = Merge(Data1=crv_61, Data2=crv_63, Data3=crv_62)

merge_27 = Merge(Data1=cluster_40.corner_left_2, Data2=cluster_40.corner_right_2)

# ---- group: OUTER WYTHE
crv_64 = Curve(cull_5)

# ---- group: GROOVES
crv_65 = Curve(branch)

# ---- group: OUTER WYTHE (SOLID)
solids_panels_with_ridge_3 = Brep(cull_3)

# ---- group: INNER WYTHE
crv_66 = Curve(cull_4)

# ---- group: GLAZING (INCL. CORNERS)
crv_67 = Curve(merge_26)

# ---- group: TYP. GLAZING
crv_68 = Curve(cluster_40.typ_glazing_2)

# ---- group: CORNER GLAZING
crv_69 = Curve(merge_27)  # disabled

# ---- group: INNER WYTHE
crv_70 = Curve(crv_66)

crv_71 = Curve(crv_66)

# ---- group: OUTER WYTHE (SOLID)
solids_panels_with_ridge_4 = Brep(solids_panels_with_ridge_3)

# ----
pshift_17 = ShiftPaths(Data=crv_68, Offset=-1)
crv_72 = Curve(pshift_17)
crv_73 = Curve(graft(crv_72))
viewer_2 = ParamViewer(crv_73)
item_14 = ListItem(List=viewer_2, Index=0, Wrap=True)
branch_2 = TreeBranch(Tree=crv_73, Path=item_14, MaintainPaths=True)
x_tremez_3 = Extremes(Curve=branch_2, Plane=PlaneXY(0, 0, 0))  # -> Highest, Lowest
pdecon_14 = Deconstruct(Point=x_tremez_3.Highest)  # -> XComponent, YComponent, ZComponent
pdecon_15 = Deconstruct(Point=x_tremez_3.Lowest)  # -> XComponent, YComponent, ZComponent
subtraction_17 = Subtraction(A=pdecon_14.ZComponent, B=pdecon_15.ZComponent)

# ----
# PANEL TYPE
swatch_6 = ColourSwatch(SwatchColor=RGB(0, 0, 0))
tag_8 = TextTag3D(Location=cull_7, Text=cull_8, Size=750, Colour=swatch_6, Justification=5)

# ----
# COST PER PANEL
swatch_7 = ColourSwatch(SwatchColor=RGB(0, 0, 0))
tag_9 = TextTag3D(Location=move_38.Geometry, Text=cull_10, Size=300, Colour=swatch_7, Justification=5)

crv_74 = Curve(graft(crv_71))
viewer_3 = ParamViewer(crv_74)
item_15 = ListItem(List=viewer_3, Index=0, Wrap=True)
branch_3 = TreeBranch(Tree=crv_74, Path=item_15, MaintainPaths=True)
x_tremez_4 = Extremes(Curve=branch_3, Plane=PlaneXY(0, 0, 0))  # -> Highest, Lowest
pdecon_16 = Deconstruct(Point=x_tremez_4.Highest)  # -> XComponent, YComponent, ZComponent
pdecon_17 = Deconstruct(Point=x_tremez_4.Lowest)  # -> XComponent, YComponent, ZComponent
subtraction_18 = Subtraction(A=pdecon_16.ZComponent, B=pdecon_17.ZComponent)

addition_11 = Addition(A=inner_wythe_setback, B=inner_wythe_thickness, C=inner_wythe_thickness)
amp_2 = Amplitude(Vector=vec_11, Amplitude=inner_wythe_setback)
move_39 = Move(Geometry=crv_70, Motion=amp_2)  # -> Geometry, Transform
amp_3 = Amplitude(Vector=vec_11, Amplitude=addition_11)
amp_4 = Amplitude(Vector=vec_11, Amplitude=inner_wythe_thickness)
extr_2 = Extrude(Base=move_39.Geometry, Direction=amp_4)
cap_6 = CapHoles(Brep=extr_2)
# PREVIEW
move_40 = Move(Geometry=crv_65, Motion=amp_3)  # -> Geometry, Transform
move_41 = Move(Geometry=solids_panels_with_ridge_4, Motion=amp_3)  # -> Geometry, Transform
move_42 = Move(Geometry=cap_6, Motion=amp_4)  # -> Geometry, Transform

# ---- group: GLAZING HEIGHT
num_41 = Number(subtraction_17)

# ----
cluster_41 = Cluster_6(glazing=crv_67, num=num_41)  # -> L, int_3
cluster_42 = Cluster_6(glazing=crv_72, num=num_41)  # -> L, int_3
panel_38 = Panel(cluster_42.int_3)
qty_typical_sizes = Panel(cluster_42.L)
qty_widths = Panel(cluster_41.L)

# ---- group: OUTER WYTHE (SOLID)
solids_panels_with_ridge_5 = Brep(move_41.Geometry)

# ---- group: INSULATION (SOLID)
solids_panels_with_ridge_6 = Brep(move_42.Geometry)

# ---- group: INNER WYTHE (SOLID)
solids_panels_with_ridge_7 = Brep(cap_6)

# ---- group: OUTER WYTHE
crv_75 = Curve(crv_64)

# ---- group: INNER WYTHE HEIGHT
num_42 = Number(subtraction_18)

# ----
cluster_43 = Cluster_9(G=crv_71, B=num_42)  # -> L, S
cluster_44 = Cluster_5(panels=crv_75, crv=crv_38)
qty_per_width = Panel(cluster_43.L)
lng_6 = ListLength(List=cluster_43.L)
inner_wythe_widths = Panel(cluster_43.S)
solid_surface = Panel(cluster_44)
qty_widths_2 = Panel(lng_6)

# ---- group: PANEL TYPE 'COLOURS'
col_4 = Colour(cull_9)

# ----
material = CreateMaterial(Diffuse=col_4, Specular=RGB(255, 255, 255), Emission=col_4, Transparency=0, Shine=0)

mesh_5 = MeshBrep(
    Brep=solids_panels_with_ridge_5,
    Settings={GridMaxCount=0, GridMinCount=16, JaggedSeams=False, MaxEdgeLength=0, MinEdgeLength=0.0001, MinTolerance=0, Refine=True, RefineAngle=0, RelativeTolerance=0.65, SimplePlanes=True, Tolerance=0})
mesh_6 = MeshBrep(
    Brep=solids_panels_with_ridge_6,
    Settings={GridMaxCount=0, GridMinCount=16, JaggedSeams=False, MaxEdgeLength=0, MinEdgeLength=0.0001, MinTolerance=0, Refine=True, RefineAngle=0, RelativeTolerance=0.65, SimplePlanes=True, Tolerance=0})
mesh_7 = MeshBrep(
    Brep=solids_panels_with_ridge_7,
    Settings={GridMaxCount=0, GridMinCount=16, JaggedSeams=False, MaxEdgeLength=0, MinEdgeLength=0.0001, MinTolerance=0, Refine=True, RefineAngle=0, RelativeTolerance=0.65, SimplePlanes=True, Tolerance=0})
preview_10 = CustomPreview(Geometry=move_40.Geometry, Shader=ColourSwatch(SwatchColor=RGB(0, 0, 0)))
preview_11 = CustomPreview(Geometry=mesh_5, Shader=material)
preview_12 = CustomPreview(Geometry=mesh_5, Shader=ColourSwatch(SwatchColor=RGB(158, 158, 158)))
preview_13 = CustomPreview(Geometry=mesh_6, Shader=ColourSwatch(SwatchColor=RGB(255, 133, 241)))
preview_14 = CustomPreview(Geometry=mesh_7, Shader=ColourSwatch(SwatchColor=RGB(97, 97, 97)))

# ----
# EXPORT GEOMETRY TO REVIT
cluster_45 = Cluster_15(slab_solids=brep_2)

explode_5 = Explode(Curve=cluster_45, Recursive=True)  # -> Segments, Vertices

project = Project(Geometry=cluster_45, Plane=simplify(graft(move_22.Geometry)))  # -> Geometry, Transform
crv_76 = Curve(flatten(project.Geometry))
cull_i_4 = CullIndex(List=reverse(crv_76), Indices=0, Wrap=True)  # -> reverse(List)
crv_77 = Curve(cull_i_4)

pshift_18 = ShiftPaths(Data=crv_56, Offset=-1)
pln_25 = Plane(pln_14)
explode_6 = Explode(Curve=pshift_18, Recursive=True)  # -> Segments, Vertices
amp_5 = Amplitude(Vector=pln_25, Amplitude="25")
item_16 = ListItem(List=explode_6.Segments, Index=3, Wrap=True)
move_43 = Move(Geometry=pln_25, Motion=amp_5)  # -> Geometry, Transform

move_44 = Move(Geometry=item_16, Motion=Z_23)  # -> Geometry, Transform
split_12 = SplitTree(Data=move_44.Geometry, Masks=flatten(["{0;*;18}", "{1;*;18}", "{2;*;17}", "{3;*;17}"]))  # -> Positive, Negative

clean_2 = CleanTree(Tree=split_12.Positive, CleanInvalid=True, CleanEmpty=True)
pshift_19 = ShiftPaths(Data=clean_2, Offset=-2)
pln_26 = Plane(simplify(move_43.Geometry))
explode_7 = Explode(Curve=pshift_19, Recursive=True)  # -> Segments, Vertices
viewer_4 = ParamViewer(pshift_19)
item_17 = ListItem(List=explode_7.Segments, Index=3, Wrap=True)
branch_4 = TreeBranch(Tree=pln_26, Path=viewer_4, MaintainPaths=True)
pshift_20 = ShiftPaths(Data=item_17, Offset=-1)
project_2 = Project(Geometry=pshift_20, Plane=branch_4)  # -> Geometry, Transform

pshift_21 = ShiftPaths(Data=move_44.Geometry, Offset=-2)  # disabled

project_3 = Project(Geometry=pshift_21, Plane=move_43.Geometry)  # -> Geometry, Transform

# ---- group: Window by Type
crv_78 = Curve(project_3.Geometry)

# ----
end = EndPoints(Curve=split_12.Positive)  # -> Start, End

# ---- group: Window by Width
crv_79 = Curve(project_2.Geometry)

crv_80 = Curve(crv_79)

# ---- group: Window
crv_81 = Curve(crv_78)

# ----
len_2 = Length(Curve=crv_79)
cset_2 = CreateSet(List=flatten(len_2))  # -> Set, Map
sort_2 = SortList(Keys=cset_2.Set)  # -> Keys, ValuesA
int_43 = Integer(sort_2.Keys)
panel_39 = Panel(int_43)

dom_5 = ConstructDomain(DomainStart=-10000, DomainEnd=10000)
rectangle_3 = Rectangle(Plane=PlaneXY(0, 0, 0), XSize=dom_5, YSize=dom_5, Radius=0)  # -> Rectangle, Length
scale = Scale(Geometry=crv_34, Center=Point(0, 0, 0), Factor="0.00328084")  # -> Geometry, Transform
scale_2 = Scale(Geometry=crv_35, Center=Point(0, 0, 0), Factor="0.00328084")  # -> Geometry, Transform
scale_3 = Scale(Geometry=crv_36, Center=Point(0, 0, 0), Factor="0.00328084")  # -> Geometry, Transform
scale_4 = Scale(Geometry=crv_37, Center=Point(0, 0, 0), Factor="0.00328084")  # -> Geometry, Transform
scale_5 = Scale(Geometry=crv_81, Center=Point(0, 0, 0), Factor="0.00328084")  # -> Geometry, Transform
scale_6 = Scale(Geometry=rectangle_3.Rectangle, Center=Point(0, 0, 0), Factor="0.00328084")  # -> Geometry, Transform

project_4 = Project(Geometry=rectangle_3.Rectangle, Plane=simplify(graft(move_22.Geometry)))  # -> Geometry, Transform

# ---- group: Floor
crv_82 = Curve(project_4.Geometry)

crv_83 = Curve(crv_82)

# ----
scale_7 = Scale(Geometry=crv_80, Center=Point(0, 0, 0), Factor="0.00328084")  # -> Geometry, Transform

scale_8 = Scale(Geometry=crv_83, Center=Point(0, 0, 0), Factor="0.00328084")  # -> Geometry, Transform

explode_8 = Explode(Curve=scale_7.Geometry, Recursive=True)  # -> flatten(Segments), Vertices

explode_9 = Explode(Curve=scale.Geometry, Recursive=True)  # -> flatten(Segments), Vertices
explode_10 = Explode(Curve=scale_2.Geometry, Recursive=True)  # -> flatten(Segments), Vertices
explode_11 = Explode(Curve=scale_5.Geometry, Recursive=True)  # -> flatten(Segments), Vertices
explode_12 = Explode(Curve=scale_6.Geometry, Recursive=True)  # -> flatten(Segments), Vertices
explode_13 = Explode(Curve=scale_8.Geometry, Recursive=True)  # -> flatten(Segments), Vertices
clean_3 = CleanTree(Data=scale_3.Geometry, CleanInvalid=True, CleanEmpty=True)
clean_4 = CleanTree(Data=scale_4.Geometry, CleanInvalid=True, CleanEmpty=True)
cluster_46 = Cluster_11(C=explode_8.Segments, prefix="_Window")
cluster_47 = Cluster_11(C=explode_9.Segments, prefix="_Int_Line")
cluster_48 = Cluster_11(C=explode_10.Segments, prefix="_Ext_Line")
cluster_49 = Cluster_11(C=clean_3, prefix="_Door_Line")
cluster_50 = Cluster_12(crv=clean_4, prefix="_Door_Arc")
merge_28 = Merge(Data1=explode_12.Segments, Data2=explode_13.Segments)
cluster_51 = Cluster_11(C=merge_28, prefix="_Floor")
path_mapper_16 = PathMapper(cluster_47, source="{A}", target="{0}")
path_mapper_17 = PathMapper(cluster_48, source="{A}", target="{1}")
path_mapper_18 = PathMapper(cluster_49, source="{A}", target="{2}")
path_mapper_19 = PathMapper(cluster_50, source="{A}", target="{3}")
path_mapper_20 = PathMapper(cluster_46, source="{A}", target="{4}")
path_mapper_21 = PathMapper(cluster_51, source="{A}", target="{6}")

cluster_52 = Cluster_32(C=explode_11.Segments, prefix="_WindowType", type_prefix="W_T", window_type=txt_7)
path_mapper_22 = PathMapper(cluster_52, source="{A}", target="{5}")

explode_14 = Explode(Curve=crv_81, Recursive=True)  # -> flatten(Segments), Vertices
len_3 = Length(Curve=explode_14.Segments)
cset_3 = CreateSet(List=len_3)  # -> Set, Map
sort_3 = SortList(Keys=cset_3.Set)  # -> Keys, ValuesA
panel_40 = Panel(sort_3.Keys)

merge_29 = Merge(
    Data1=path_mapper_16,
    Data2=path_mapper_17,
    Data3=path_mapper_18,
    Data4=path_mapper_19,
    Data5=path_mapper_20,
    Data6=path_mapper_22,
    Data7=path_mapper_21)

cluster_53 = Cluster_13(data=merge_29)

panel_41 = Panel(cluster_53)

# ==== cluster Cluster
bldg_height = ClusterInput()
curve_a = ClusterInput()
bldg_height_2 = Vector(bldg_height)
rev = Reverse(Vector=bldg_height_2)
curve_a_2 = Curve(curve_a)
move = Move(Geometry=curve_a_2, Motion=rev)  # -> Geometry, Transform
move_2 = Move(Geometry=curve_a_2, Motion=bldg_height_2)  # -> Geometry, Transform
cp = ControlPoints(Curve=move.Geometry)  # -> Points, Weights, Knots
cp_2 = ControlPoints(Curve=curve_a_2)  # -> Points, Weights, Knots
cp_3 = ControlPoints(Curve=move_2.Geometry)  # -> Points, Weights, Knots
merge = Merge(Data1=cp.Points, Data2=cp_2.Points, Data3=cp_3.Points)
base_pt = ClusterInput()
nurbs = NurbsCurve(Vertices=merge, Degree=3, Periodic=False)  # -> Curve, Length, Domain
curve_a_3 = Curve(nurbs.Curve)
base_pt_2 = Point(base_pt)
bldg_height_3 = Vector(bldg_height_2)
xy = XYPlane(Origin=base_pt_2)
move_3 = Move(Geometry=xy, Motion=bldg_height_3)  # -> Geometry, Transform
pcx = CurvePlane(Curve=curve_a_3, Plane=xy)  # -> Points, ParamsC, ParamsP
pcx_2 = CurvePlane(Curve=curve_a_3, Plane=move_3.Geometry)  # -> Points, ParamsC, ParamsP
dom = ConstructDomain(DomainStart=pcx.ParamsC, DomainEnd=pcx_2.ParamsC)
subcrv = SubCurve(BaseCurve=curve_a_3, Domain=dom)
curve_a_4 = Curve(subcrv)
bldg_height_4 = Vector(bldg_height_2)
rev_2 = Reverse(Vector=bldg_height_4)
curve_a_5 = Curve(curve_a_4)
move_4 = Move(Geometry=curve_a_5, Motion=rev_2)  # -> Geometry, Transform
move_5 = Move(Geometry=move_4.Geometry, Motion=rev_2)  # -> Geometry, Transform
move_6 = Move(Geometry=curve_a_5, Motion=bldg_height_4)  # -> Geometry, Transform
move_7 = Move(Geometry=move_6.Geometry, Motion=bldg_height_4)  # -> Geometry, Transform
divide = DivideCurve(Curve=move_5.Geometry, Count=10, Kinks=False)  # -> Points, Tangents, Parameters
divide_2 = DivideCurve(Curve=move_4.Geometry, Count=10, Kinks=False)  # -> Points, Tangents, Parameters
divide_3 = DivideCurve(Curve=curve_a_5, Count=10, Kinks=False)  # -> Points, Tangents, Parameters
divide_4 = DivideCurve(Curve=move_6.Geometry, Count=10, Kinks=False)  # -> Points, Tangents, Parameters
divide_5 = DivideCurve(Curve=move_7.Geometry, Count=10, Kinks=False)  # -> Points, Tangents, Parameters
merge_2 = Merge(Data1=divide.Points, Data2=divide_2.Points, Data3=divide_3.Points, Data4=divide_4.Points, Data5=divide_5.Points)
cp_4 = ControlPoints(Curve=move_5.Geometry)  # -> Points, Weights, Knots
cp_5 = ControlPoints(Curve=move_4.Geometry)  # -> Points, Weights, Knots
cp_6 = ControlPoints(Curve=curve_a_5)  # -> Points, Weights, Knots
cp_7 = ControlPoints(Curve=move_6.Geometry)  # -> Points, Weights, Knots
cp_8 = ControlPoints(Curve=move_7.Geometry)  # -> Points, Weights, Knots
cullpt = CullDuplicates(Points=merge_2, Tolerance=0.1, CullMode=3)  # -> Points, Indices, Valence
merge_3 = Merge(Data1=cp_4.Points, Data2=cp_5.Points, Data3=cp_6.Points, Data4=cp_7.Points, Data5=cp_8.Points)
intcrv = Interpolate(Vertices=cullpt.Points, Degree=3, Periodic=False, KnotStyle=1)  # -> Curve, Length, Domain
nurbs_2 = NurbsCurve(Vertices=merge_3, Degree=3, Periodic=False)  # -> Curve, Length, Domain
curve_a_6 = Curve(intcrv.Curve)
curve_a_7 = ClusterOutput(curve_a_6)

# ==== cluster Cluster_2
curve_a = ClusterInput()
base_pt = ClusterInput()
bldg_height = ClusterInput()
curve_a_2 = Curve(graft(curve_a))
base_pt_2 = Point(base_pt)
bldg_height_2 = Vector(bldg_height)
xy = XYPlane(Origin=base_pt_2)
move = Move(Geometry=xy, Motion=bldg_height_2)  # -> Geometry, Transform
pcx = CurvePlane(Curve=curve_a_2, Plane=xy)  # -> Points, ParamsC, ParamsP
pcx_2 = CurvePlane(Curve=curve_a_2, Plane=move.Geometry)  # -> Points, ParamsC, ParamsP
dom = ConstructDomain(DomainStart=pcx.ParamsC, DomainEnd=pcx_2.ParamsC)
pshift = ShiftPaths(Data=dom, Offset=-1)
subcrv = SubCurve(BaseCurve=curve_a_2, Domain=pshift)
curve_a_3 = Curve(subcrv)
curve_a_4 = ClusterOutput(curve_a_3)

# ==== cluster Cluster_3
curve_a = ClusterInput()
curve_b = ClusterInput()
level_planes = ClusterInput()
curve_a_2 = Curve(curve_a)
curve_b_2 = Curve(curve_b)
level_planes_2 = Plane(level_planes)
pcx = CurvePlane(Curve=curve_a_2, Plane=level_planes_2)  # -> simplify(Points), ParamsC, ParamsP
pcx_2 = CurvePlane(Curve=curve_b_2, Plane=level_planes_2)  # -> simplify(Points), ParamsC, ParamsP
pshift = ShiftPaths(Data=pcx.Points, Offset=-1)
pshift_2 = ShiftPaths(Data=pcx_2.Points, Offset=-1)
ln = Line(StartPoint=pshift, EndPoint=pshift_2)
shift = ShiftList(List=pshift, Shift=1, Wrap=False)  # -> simplify(List)
shift_2 = ShiftList(List=pshift_2, Shift=1, Wrap=False)  # -> simplify(List)
shift_3 = ShiftList(List=ln, Shift=1, Wrap=False)  # -> simplify(List)
short = ShortestList(ListA=pshift, ListB=shift, TrimMode=2)  # -> ListA, ListB
short_2 = ShortestList(ListA=pshift_2, ListB=shift_2, TrimMode=2)  # -> ListA, ListB
short_3 = ShortestList(ListA=ln, ListB=shift_3, TrimMode=2)  # -> ListA, ListB
ln_2 = Line(StartPoint=short.ListA, EndPoint=short.ListB)  # -> graft(Line)
ln_3 = Line(StartPoint=short_2.ListA, EndPoint=short_2.ListB)  # -> graft(Line)
A = ClusterOutput(short.ListA)
B = ClusterOutput(short.ListB)
A_2 = ClusterOutput(short_2.ListA)
B_2 = ClusterOutput(short_2.ListB)
crv = Curve(graft(short_3.ListA))
crv_2 = Curve(graft(short_3.ListB))
merge = Merge(Data1=ln_2, Data2=crv, Data3=ln_3, Data4=crv_2)
panel_perimeters = Curve(merge)
panel_perimeters_2 = ClusterOutput(panel_perimeters)

# ==== cluster Cluster_4
variables = ClusterInput()
qty = ClusterInput()
option = ClusterInput()
variables_2 = Number(variables)
qty_2 = Integer(qty)
option_2 = Integer(option)
subtraction = Subtraction(A=option_2, B=1)
partition = PartitionList(List=variables_2, Size=qty_2)
viewer = ParamViewer(partition)
item = ListItem(List=viewer, Index=subtraction, Wrap=True)
branch = TreeBranch(Tree=partition, Path=item, MaintainPaths=True)  # -> flatten(Branch)
item_2 = ListItem(List=branch, Index=0, Wrap=True)
item_3 = ListItem(List=branch, Index=1, Wrap=True)
item_4 = ListItem(List=branch, Index=2, Wrap=True)
scale_x = Number(item_2)
vertical_shift = Number(item_3)
horizontal_shift = Number(item_4)
scale_x_2 = ClusterOutput(scale_x)
vertical_shift_2 = ClusterOutput(vertical_shift)
horizontal_shift_2 = ClusterOutput(horizontal_shift)

# ==== cluster Cluster_5
panels = ClusterInput()
crv = ClusterInput()
panels_2 = Curve(panels)
crv_2 = Curve(crv)
area = Area(Geometry=panels_2)  # -> Area, Centroid
area_2 = Area(Geometry=crv_2)  # -> Area, Centroid
ma = MassAddition(Input=flatten(area.Area))  # -> Result, PartialResults
division = Division(A=ma.Result, B=area_2.Area)
expression = Expression(x=division, Expression="Format(\"{0:0.0}%\", (x * 100))")
R = ClusterOutput(expression)

# ==== cluster Cluster_6
glazing = ClusterInput()
num = ClusterInput()
glazing_2 = Curve(glazing)
area = Area(Geometry=glazing_2)  # -> Area, Centroid
num_2 = Number(num)
division = Division(A=area.Area, B=num_2)
int = Integer(division)
cset = CreateSet(List=flatten(int))  # -> GlazingWidths, Map
sort = SortList(Keys=cset.GlazingWidths)  # -> Keys, ValuesA
lng = ListLength(List=cset.GlazingWidths)
int_2 = Integer(sort.Keys)
L = ClusterOutput(lng)
int_3 = ClusterOutput(int_2)

# ==== cluster Cluster_7
grid_pts = ClusterInput()
grid_pts_2 = Point(grid_pts)
viewer = ParamViewer(grid_pts_2)
dpath = DeconstructPath(Branch=viewer)  # -> flatten(Indices)
item = ListItem(List=reverse(dpath), Index=0, Wrap=True)
item_2 = ListItem(List=dpath, Index=0, Wrap=True)
equals = Equality(FirstNumber=dpath, SecondNumber=item_2)  # -> Equality, Inequality
equals_2 = Equality(FirstNumber=dpath, SecondNumber=item)  # -> Equality, Inequality
or = GateOr(A=equals.Equality, B=equals_2.Equality)
F = ClusterInput()
dispatch = Dispatch(List=viewer, DispatchPattern=or)  # -> ListA, ListB
branch = TreeBranch(Tree=grid_pts_2, Path=dispatch.ListA, MaintainPaths=True)
shift_in_x = UnitX(Factor=F)
branch_2 = TreeBranch(Tree=grid_pts_2, Path=dispatch.ListB, MaintainPaths=True)
move = Move(Geometry=branch_2, Motion=shift_in_x)  # -> Geometry, Transform
merge = Merge(Data1=branch, Data2=move.Geometry)
intcrv = Interpolate(Vertices=merge, Degree=3, Periodic=False, KnotStyle=1)  # -> Curve, Length, Domain
verticals = Curve(intcrv.Curve)
verticals_2 = ClusterOutput(verticals)

# ==== cluster Cluster_8
txt = ClusterInput()
txt_2 = Text(txt)
len = TextLength(Text=txt_2)
fragment = TextFragment(Text=txt_2, Start=0, Count=expr("x - 2", len))
chars = Characters(Text=fragment)  # -> reverse(Result), Unicode
partition = PartitionList(List=chars.Result, Size=3)
join = TextJoin(Text=reverse(partition))
concat = Concatenate(FragmentA=join, FragmentB=",")  # -> flatten(Result)
txt_3 = Text(reverse(concat))
join_2 = TextJoin(Text=txt_3)
len_2 = TextLength(Text=join_2)
fragment_2 = TextFragment(Text=join_2, Start=0, Count=expr("x - 1", len_2))
txt_4 = Text(fragment_2)
txt_5 = ClusterOutput(txt_4)

# ==== cluster Cluster_9
B = ClusterInput()
G = ClusterInput()
area = Area(Geometry=G)  # -> Area, Centroid
division = Division(A=area.Area, B=B)
num = Number(flatten(division))
int = Integer(num)
sort = SortList(Keys=int)  # -> Keys, ValuesA
cset = CreateSet(List=sort.Keys)  # -> Set, Map
similar = Similarity(FirstNumber=num, SecondNumber=graft(cset.Set), Threshold=0.1)  # -> Similarity, AbsoluteDifference
S = ClusterOutput(cset.Set)
cull = CullPattern(List=int, CullPattern=similar.Similarity)
lng = ListLength(List=cull)  # -> flatten(Length)
L = ClusterOutput(lng)

# ==== cluster Cluster_10
pln = ClusterInput()
crv_left = ClusterInput()
crv_right = ClusterInput()
level_planes = ClusterInput()
pln_2 = Plane(pln)
crv_left_2 = Curve(crv_left)
crv_right_2 = Curve(crv_right)
level_planes_2 = Plane(level_planes)
pcx = CurvePlane(Curve=crv_left_2, Plane=level_planes_2)  # -> flatten(Points), ParamsC, ParamsP
pcx_2 = CurvePlane(Curve=crv_right_2, Plane=level_planes_2)  # -> flatten(Points), ParamsC, ParamsP
shift = ShiftList(List=pcx.Points, Shift=1, Wrap=False)
shift_2 = ShiftList(List=pcx_2.Points, Shift=1, Wrap=False)
short = ShortestList(ListA=shift, ListB=pcx.Points, TrimMode=2)  # -> ListA, ListB
short_2 = ShortestList(ListA=shift_2, ListB=pcx_2.Points, TrimMode=2)  # -> ListA, ListB
rotate = Rotate(Geometry=pln_2, Angle=1.570796327, Plane=PlaneXY(0, 0, 0))  # -> Geometry, Transform
ln = Line(StartPoint=short.ListA, EndPoint=short.ListB)
ln_2 = Line(StartPoint=short_2.ListA, EndPoint=short_2.ListB)
x_tremez = Extremes(Curve=ln, Plane=rotate.Geometry)  # -> Highest, Lowest
x_tremez_2 = Extremes(Curve=ln_2, Plane=rotate.Geometry)  # -> Highest, Lowest
pdecon = Deconstruct(Point=x_tremez.Highest)  # -> XComponent, YComponent, ZComponent
pdecon_2 = Deconstruct(Point=x_tremez_2.Lowest)  # -> XComponent, YComponent, ZComponent
x_leftmost = Number(pdecon.XComponent)
x_rightmost = Number(pdecon_2.XComponent)
x_leftmost_2 = ClusterOutput(x_leftmost)
x_rightmost_2 = ClusterOutput(x_rightmost)

# ==== cluster Cluster_11
C = ClusterInput()
prefix = ClusterInput()
end = EndPoints(Curve=flatten(C))  # -> graft(Start), graft(End)
pt2num = PointsToNumbers(Points=end.Start, Mask=4)
pt2num_2 = PointsToNumbers(Points=end.End, Mask=4)
item = ListItem(List=pt2num, Index=0, Wrap=True)
item_2 = ListItem(List=pt2num, Index=1, Wrap=True)
item_3 = ListItem(List=pt2num, Index=2, Wrap=True)
item_4 = ListItem(List=pt2num_2, Index=0, Wrap=True)
item_5 = ListItem(List=pt2num_2, Index=1, Wrap=True)
item_6 = ListItem(List=pt2num_2, Index=2, Wrap=True)
expression = Expression(
    prefix=prefix,
    d1=item,
    d2=item_2,
    d3=item_3,
    d4=item_4,
    d5=item_5,
    d6=item_6,
    Expression="Format(\"{0}, {1}, {2}, {3}, {4}, {5}, {6}\", prefix, d1, d2, d3, d4, d5, d6)")  # -> flatten(R)
R = ClusterOutput(expression)

# ==== cluster Cluster_12
crv = ClusterInput()
prefix = ClusterInput()
crv_2 = Curve(crv)
eval = EvaluateCurve(Curve=reparameterize(crv_2), Parameter=0.5)  # -> graft(Point), Tangent, Angle
end = EndPoints(Curve=crv_2)  # -> graft(Start), graft(End)
merge = Merge(Data1=end.Start, Data2=end.End, Data3=eval.Point)  # -> simplify(Result)
item = ListItem(List=merge, Index=0, Wrap=True)
item_2 = ListItem(List=merge, Index=1, Wrap=True)
item_3 = ListItem(List=merge, Index=2, Wrap=True)
pt2num = PointsToNumbers(Points=item, Mask=4)
pt2num_2 = PointsToNumbers(Points=item_2, Mask=4)
pt2num_3 = PointsToNumbers(Points=item_3, Mask=4)
item_4 = ListItem(List=pt2num, Index=0, Wrap=True)
item_5 = ListItem(List=pt2num, Index=1, Wrap=True)
item_6 = ListItem(List=pt2num, Index=2, Wrap=True)
item_7 = ListItem(List=pt2num_2, Index=0, Wrap=True)
item_8 = ListItem(List=pt2num_2, Index=1, Wrap=True)
item_9 = ListItem(List=pt2num_2, Index=2, Wrap=True)
item_10 = ListItem(List=pt2num_3, Index=0, Wrap=True)
item_11 = ListItem(List=pt2num_3, Index=1, Wrap=True)
item_12 = ListItem(List=pt2num_3, Index=2, Wrap=True)
expression = Expression(
    prefix=prefix,
    d1=item_4,
    d2=item_5,
    d3=item_6,
    d4=item_7,
    d5=item_8,
    d6=item_9,
    d7=item_10,
    d8=item_11,
    d9=item_12,
    Expression="Format(\"{0}, {1}, {2}, {3}, {4}, {5}, {6}, {7}, {8}, {9}\", prefix, d1, d2, d3, d4, d5, d6, d7, d8, d9)")  # -> flatten(R)
R = ClusterOutput(expression)

# ==== cluster Cluster_13
data = ClusterInput()
data_2 = Text(data)
lng = ListLength(List=data_2)
equals = Equality(FirstNumber=lng, SecondNumber=1)  # -> Equality, Inequality
cull = CullPattern(List=data_2, CullPattern=equals.Inequality)
clean = CleanTree(Data=cull, CleanInvalid=True, CleanEmpty=True)
export = Text(clean)
export_2 = ClusterOutput(export)

# ==== cluster Cluster_14
bay_qty = ClusterInput()
glazing_left_snap = ClusterInput()
glazing_right_snap = ClusterInput()
vertical_shift_per_bay_unitized = ClusterInput()
elevations = ClusterInput()
shift_per_bay_in_x = ClusterInput()
elevations_2 = Number(elevations)
shift = ShiftList(List=elevations_2, Shift=1, Wrap=False)
short = ShortestList(ListA=elevations_2, ListB=shift, TrimMode=2)  # -> simplify(graft(ListA)), simplify(graft(ListB))
bay_qty_2 = Integer(bay_qty)
glazing_left_snap_2 = Integer(glazing_left_snap)
int = Integer(bay_qty_2)
vertical_shift_per_bay_unitized_2 = Integer(simplify(graft(vertical_shift_per_bay_unitized)))
int_2 = Integer(bay_qty_2)
glazing_right_snap_2 = Integer(glazing_right_snap)
dup = DuplicateData(Data=short.ListA, Number=bay_qty_2, Order=True)  # -> simplify(Data)
dup_2 = DuplicateData(Data=short.ListB, Number=bay_qty_2, Order=True)  # -> simplify(Data)
dup_3 = DuplicateData(Data=glazing_left_snap_2, Number=int_2, Order=True)
dup_4 = DuplicateData(Data=glazing_right_snap_2, Number=int, Order=True)
lng = ListLength(List=shift)
neg = Negative(Value=vertical_shift_per_bay_unitized_2)
partition = PartitionList(List=dup_3, Size=lng)  # -> simplify(Chunks)
partition_2 = PartitionList(List=dup_4, Size=lng)  # -> simplify(Chunks)
shift_2 = ShiftList(List=partition, Shift=neg, Wrap=True)
shift_3 = ShiftList(List=partition_2, Shift=neg, Wrap=True)
pshift = ShiftPaths(Data=shift_2, Offset=-1)
pshift_2 = ShiftPaths(Data=shift_3, Offset=-1)
shift_per_bay_in_x_2 = Integer(simplify(shift_per_bay_in_x))
flip = FlipMatrix(Data=dup)  # -> graft(Data)
flip_2 = FlipMatrix(Data=dup_2)  # -> graft(Data)
addition = Addition(A=pshift, B=shift_per_bay_in_x_2)  # -> graft(Result)
addition_2 = Addition(A=pshift_2, B=shift_per_bay_in_x_2)  # -> graft(Result)
pt = ConstructPoint(XCoordinate=addition, YCoordinate=0, ZCoordinate=flip_2)
pt_2 = ConstructPoint(XCoordinate=addition, YCoordinate=0, ZCoordinate=flip)
pt_3 = ConstructPoint(XCoordinate=addition_2, YCoordinate=0, ZCoordinate=flip_2)
pt_4 = ConstructPoint(XCoordinate=addition_2, YCoordinate=0, ZCoordinate=flip)
window_width = ClusterOutput(shift_2)
top_left_pt = Point(pt)
bottom_left_pt = Point(pt_2)
top_right_pt = Point(pt_3)
bottom_right_pt = Point(pt_4)
top_left_pt_2 = ClusterOutput(top_left_pt)
bottom_left_pt_2 = ClusterOutput(bottom_left_pt)
top_right_pt_2 = ClusterOutput(top_right_pt)
bottom_right_pt_2 = ClusterOutput(bottom_right_pt)

# ==== cluster Cluster_15
slab_solids = ClusterInput()
slab_solids_2 = Brep(slab_solids)
volume = Volume(Geometry=slab_solids_2)  # -> Volume, Centroid
pdecon = Deconstruct(Point=volume.Centroid)  # -> XComponent, YComponent, ZComponent
sort = SortList(Keys=pdecon.ZComponent, ValuesA=slab_solids_2, ValuesB=volume.Centroid)  # -> Keys, ValuesA, ValuesB
xy = XYPlane(Origin=sort.ValuesB)
sec = BrepPlane(Brep=sort.ValuesA, Plane=xy)  # -> Curves, Points
crv = Curve(sec.Curves)
join = JoinCurves(Curves=crv, Preserve=False)
len = Length(Curve=join)
sort_2 = SortList(Keys=len, ValuesA=join)  # -> Keys, ValuesA
item = ListItem(List=reverse(sort_2.ValuesA), Index=0, Wrap=True)  # -> simplify(Item)
slab_curves = Curve(item)
slab_curves_2 = ClusterOutput(slab_curves)

# ==== cluster Cluster_16
pt = ClusterInput()
pt_2 = Point(pt)
pline = PolyLine(Vertices=pt_2, Closed=True)
item = ListItem(List=pt_2, Index=0, Wrap=True)
item_2 = ListItem(List=pt_2, Index=1, Wrap=True)
item_3 = ListItem(List=pt_2, Index=2, Wrap=True)
item_4 = ListItem(List=pt_2, Index=3, Wrap=True)
ridge_depth = ClusterInput()
min_thickness = ClusterInput()
pshift = ShiftPaths(Data=item, Offset=-1)
pshift_2 = ShiftPaths(Data=item_2, Offset=-1)
pshift_3 = ShiftPaths(Data=item_3, Offset=-1)
ln = Line(StartPoint=pshift_2, EndPoint=pshift_3)
pshift_4 = ShiftPaths(Data=item_4, Offset=-1)
ln_2 = Line(StartPoint=pshift, EndPoint=pshift_4)
eval = EvaluateCurve(Curve=ln_2, Parameter=0.33)  # -> Point, Tangent, Angle
eval_2 = EvaluateCurve(Curve=ln, Parameter=0.33)  # -> Point, Tangent, Angle
ridge_depth_2 = Vector(ridge_depth)
min_thickness_2 = Vector(min_thickness)
move = Move(Geometry=eval.Point, Motion=ridge_depth_2)  # -> Geometry, Transform
move_2 = Move(Geometry=eval_2.Point, Motion=ridge_depth_2)  # -> Geometry, Transform
move_3 = Move(Geometry=pshift, Motion=min_thickness_2)  # -> Geometry, Transform
move_4 = Move(Geometry=pshift_2, Motion=min_thickness_2)  # -> Geometry, Transform
move_5 = Move(Geometry=pshift_3, Motion=min_thickness_2)  # -> Geometry, Transform
move_6 = Move(Geometry=pshift_4, Motion=min_thickness_2)  # -> Geometry, Transform
pt_3 = Point(move.Geometry)
pt_4 = Point(move_2.Geometry)
pt_5 = Point(move_3.Geometry)
pt_6 = Point(move_4.Geometry)
pt_7 = Point(move_5.Geometry)
pt_8 = Point(move_6.Geometry)
pt_9 = Point(pshift_2)
pt_10 = Point(pshift)
pt_11 = Point(pshift_3)
pt_12 = Point(pshift_4)
srf4pt = _4PointSurface(CornerA=graft(pt_4), CornerB=graft(pt_3), CornerC=graft(pt_5), CornerD=graft(pt_6))
srf4pt_2 = _4PointSurface(CornerA=graft(pt_3), CornerB=graft(pt_4), CornerC=graft(pt_7), CornerD=graft(pt_8))
srf4pt_3 = _4PointSurface(CornerA=graft(pt_5), CornerB=graft(pt_6), CornerC=graft(pt_9), CornerD=graft(pt_10))
srf4pt_4 = _4PointSurface(CornerA=graft(pt_8), CornerB=graft(pt_7), CornerC=graft(pt_11), CornerD=graft(pt_12))
outer_wythe = BoundarySurfaces(Edges=pline)
perim = Curve(pline)
perim_2 = ClusterOutput(perim)
merge = Merge(Data1=srf4pt, Data2=srf4pt_2, Data3=srf4pt_3, Data4=srf4pt_4, Data5=outer_wythe)
srf = Surface(merge)
srf_2 = ClusterOutput(srf)

# ==== cluster Cluster_17
F = ClusterInput()
G = ClusterInput()
X = UnitX(Factor=F)
move = Move(Geometry=G, Motion=X)  # -> Geometry, Transform
crv = Curve(flatten(move.Geometry))
eval = EvaluateCurve(Curve=reparameterize(crv), Parameter=0.5)  # -> Point, Tangent, Angle
X_2 = ClusterInput()
xz = XZPlane(Origin=eval.Point)
scale_nu = ScaleNU(Geometry=crv, Plane=xz, ScaleX=X_2, ScaleY=1, ScaleZ=1)  # -> Geometry, Transform
hm_curve_left = Curve(scale_nu.Geometry)
hm_curve_left_2 = ClusterOutput(hm_curve_left)

# ==== cluster Cluster_18
C = ClusterInput()
C_2 = ClusterInput()
explode = Explode(Curve=C, Recursive=True)  # -> Segments, Vertices
cullpt = CullDuplicates(Points=explode.Vertices, Tolerance=0.1, CullMode=3)  # -> Points, Indices, Valence
incurve = PointInCurve(Point=cullpt.Points, Curve=C_2)  # -> Relationship, Point
avr = Average(Input=incurve.Relationship)
equals = Equality(FirstNumber=avr, SecondNumber=2)  # -> Equality, Inequality
pshift = ShiftPaths(Data=equals.Equality, Offset=-2)
inside_facade = Boolean(pshift)
inside_facade_2 = ClusterOutput(inside_facade)

# ==== cluster Cluster_19
fold_position = ClusterInput()
ridge_depth = ClusterInput()
min_thickness = ClusterInput()
pt = ClusterInput()
chamfer_in_y = ClusterInput()
chamfer_in_x = ClusterInput()
fold_position_2 = Number(fold_position)
chamfer_in_y_2 = Number(chamfer_in_y)
chamfer_in_x_2 = Number(chamfer_in_x)
pt_2 = Point(pt)
Y = UnitY(Factor=chamfer_in_y_2)
X = UnitX(Factor=chamfer_in_x_2)
rev = Reverse(Vector=Y)
rev_2 = Reverse(Vector=X)
pline = PolyLine(Vertices=pt_2, Closed=True)
item = ListItem(List=pt_2, Index=0, Wrap=True)
item_2 = ListItem(List=pt_2, Index=1, Wrap=True)
item_3 = ListItem(List=pt_2, Index=2, Wrap=True)
item_4 = ListItem(List=pt_2, Index=3, Wrap=True)
addition = Addition(A=rev, B=rev_2)
addition_2 = Addition(A=rev, B=X)
pshift = ShiftPaths(Data=item, Offset=-1)
pshift_2 = ShiftPaths(Data=item_2, Offset=-1)
pshift_3 = ShiftPaths(Data=item_3, Offset=-1)
ln = Line(StartPoint=pshift_2, EndPoint=pshift_3)
pshift_4 = ShiftPaths(Data=item_4, Offset=-1)
ln_2 = Line(StartPoint=pshift, EndPoint=pshift_4)
eval = EvaluateCurve(Curve=ln_2, Parameter=fold_position_2)  # -> Point, Tangent, Angle
eval_2 = EvaluateCurve(Curve=ln, Parameter=fold_position_2)  # -> Point, Tangent, Angle
ridge_depth_2 = Vector(ridge_depth)
min_thickness_2 = Vector(min_thickness)
move = Move(Geometry=eval.Point, Motion=ridge_depth_2)  # -> Geometry, Transform
move_2 = Move(Geometry=eval_2.Point, Motion=ridge_depth_2)  # -> Geometry, Transform
move_3 = Move(Geometry=pshift, Motion=addition)  # -> Geometry, Transform
move_4 = Move(Geometry=pshift_2, Motion=addition)  # -> Geometry, Transform
move_5 = Move(Geometry=pshift_3, Motion=addition_2)  # -> Geometry, Transform
move_6 = Move(Geometry=pshift_4, Motion=addition_2)  # -> Geometry, Transform
pt_3 = Point(move.Geometry)
pt_4 = Point(move_2.Geometry)
pt_5 = Point(pshift_2)
pt_6 = Point(pshift)
pt_7 = Point(pshift_3)
pt_8 = Point(pshift_4)
pt_9 = Point(move_3.Geometry)
move_7 = Move(Geometry=pt_9, Motion=min_thickness_2)  # -> Geometry, Transform
pt_10 = Point(move_7.Geometry)
pt_11 = Point(move_4.Geometry)
move_8 = Move(Geometry=pt_11, Motion=min_thickness_2)  # -> Geometry, Transform
pt_12 = Point(move_8.Geometry)
pt_13 = Point(move_5.Geometry)
move_9 = Move(Geometry=pt_13, Motion=min_thickness_2)  # -> Geometry, Transform
pt_14 = Point(move_9.Geometry)
pt_15 = Point(move_6.Geometry)
move_10 = Move(Geometry=pt_15, Motion=min_thickness_2)  # -> Geometry, Transform
pt_16 = Point(move_10.Geometry)
merge = Merge(Data1=graft(pt_9), Data2=graft(pt_11), Data3=graft(pt_13), Data4=graft(pt_15))
pline_2 = PolyLine(Vertices=merge, Closed=True)
srf4pt = _4PointSurface(CornerA=graft(pt_10), CornerB=graft(pt_12), CornerC=graft(pt_4), CornerD=graft(pt_3))
srf4pt_2 = _4PointSurface(CornerA=graft(pt_3), CornerB=graft(pt_4), CornerC=graft(pt_14), CornerD=graft(pt_16))
srf4pt_3 = _4PointSurface(CornerA=graft(pt_10), CornerB=graft(pt_12), CornerC=graft(pt_11), CornerD=graft(pt_9))
srf4pt_4 = _4PointSurface(CornerA=graft(pt_16), CornerB=graft(pt_14), CornerC=graft(pt_13), CornerD=graft(pt_15))
srf4pt_5 = _4PointSurface(CornerA=graft(pt_6), CornerB=graft(pt_5), CornerC=graft(pt_11), CornerD=graft(pt_9))
srf4pt_6 = _4PointSurface(CornerA=graft(pt_8), CornerB=graft(pt_7), CornerC=graft(pt_13), CornerD=graft(pt_15))
outer_wythe = BoundarySurfaces(Edges=pline)
perim = Curve(pline_2)
merge_2 = Merge(Data1=srf4pt, Data2=srf4pt_2, Data3=srf4pt_3, Data4=srf4pt_4, Data5=outer_wythe, Data6=srf4pt_5, Data7=srf4pt_6)
perim_2 = ClusterOutput(perim)
srf = Surface(merge_2)
srf_2 = ClusterOutput(srf)

# ==== cluster Cluster_20
G = ClusterInput()
A = ClusterInput()
B = ClusterInput()
orient = Orient(Geometry=G, Source=A, Target=B)  # -> Geometry, Transform
item = ListItem(List=orient.Geometry, Index=0, Wrap=True)
T = ClusterInput()
move = Move(Geometry=item, Motion=T)  # -> Geometry, Transform
merge = Merge(Data1=orient.Geometry, Data2=move.Geometry)
R = ClusterOutput(merge)

# ==== cluster Cluster_21
txt = ClusterInput()
txt_2 = Text(txt)
item = ListItem(List=txt_2, Index=0, Wrap=True)
merge = Merge(Data1=txt_2, Data2=item)
R = ClusterOutput(merge)

# ==== cluster Cluster_22
col = ClusterInput()
col_2 = Colour(col)
item = ListItem(List=col_2, Index=0, Wrap=True)
merge = Merge(Data1=col_2, Data2=item)
R = ClusterOutput(merge)

# ==== cluster Cluster_23
srf = ClusterInput()
srf_2 = Surface(srf)
item = ListItem(List=srf_2, Index=1, Wrap=True)
item_2 = ListItem(List=srf_2, Index=0, Wrap=True)
merge = Merge(Data1=item, Data2=item_2)
R = ClusterOutput(merge)

# ==== cluster Cluster_24
G = ClusterInput()
A = ClusterInput()
B = ClusterInput()
T = ClusterInput()
orient = Orient(Geometry=G, Source=A, Target=B)  # -> Geometry, Transform
lng = ListLength(List=orient.Geometry)
split = SplitTree(Data=orient.Geometry, Masks=flatten("{*;0}"))  # -> Positive, Negative
split_2 = SplitTree(Data=lng, Masks=flatten("{*;0}"))  # -> Positive, Negative
pshift = ShiftPaths(Data=split_2.Positive, Offset=-1)
split_3 = SplitTree(Data=orient.Geometry, Masks=flatten("{0;*}"))  # -> Positive, Negative
pshift_2 = ShiftPaths(Data=lng, Offset=-1)
pshift_3 = ShiftPaths(Data=orient.Geometry, Offset=-1)
addition = Addition(A=lng, B=1)
move = Move(Geometry=split.Positive, Motion=T)  # -> Geometry, Transform
pshift_4 = ShiftPaths(Data=move.Geometry, Offset=-1)
merge = Merge(Data1=pshift_3, Data2=pshift_4)
merge_2 = Merge(Data1=pshift_2, Data2=pshift)
partition = PartitionList(List=merge, Size=merge_2)
merge_3 = Merge(Data1=orient.Geometry, Data2=move.Geometry)
panel = Panel(partition)
C = ClusterOutput(partition)

# ==== cluster Cluster_25
curve_a = ClusterInput()
curve_b = ClusterInput()
level_planes = ClusterInput()
curve_a_2 = Curve(curve_a)
curve_b_2 = Curve(curve_b)
level_planes_2 = Plane(level_planes)
pcx = CurvePlane(Curve=curve_a_2, Plane=level_planes_2)  # -> Points, ParamsC, ParamsP
pcx_2 = CurvePlane(Curve=curve_b_2, Plane=level_planes_2)  # -> Points, ParamsC, ParamsP
pt = Point(flatten(pcx.Points))
pt_2 = Point(flatten(pcx_2.Points))
ln = Line(StartPoint=pt, EndPoint=pt_2)
shift = ShiftList(List=pt, Shift=1, Wrap=False)  # -> simplify(List)
shift_2 = ShiftList(List=pt_2, Shift=1, Wrap=False)  # -> simplify(List)
shift_3 = ShiftList(List=ln, Shift=1, Wrap=False)  # -> simplify(List)
short = ShortestList(ListA=pt, ListB=shift, TrimMode=2)  # -> flatten(ListA), flatten(ListB)
short_2 = ShortestList(ListA=pt_2, ListB=shift_2, TrimMode=2)  # -> flatten(ListA), flatten(ListB)
short_3 = ShortestList(ListA=ln, ListB=shift_3, TrimMode=2)  # -> flatten(ListA), flatten(ListB)
ln_2 = Line(StartPoint=short.ListA, EndPoint=short.ListB)  # -> graft(Line)
ln_3 = Line(StartPoint=short_2.ListA, EndPoint=short_2.ListB)  # -> graft(Line)
crv = Curve(graft(short_3.ListA))
crv_2 = Curve(graft(short_3.ListB))
merge = Merge(Data1=ln_2, Data2=crv, Data3=ln_3, Data4=crv_2)
panel_perimeters = Curve(merge)
A = ClusterOutput(short.ListA)
B = ClusterOutput(short.ListB)
panel_perimeters_2 = ClusterOutput(panel_perimeters)
A_2 = ClusterOutput(short_2.ListA)
B_2 = ClusterOutput(short_2.ListB)

# ==== cluster Cluster_26
fold_position = ClusterInput()
ridge_depth = ClusterInput()
min_thickness = ClusterInput()
pt = ClusterInput()
chamfer_in_y = ClusterInput()
chamfer_in_x = ClusterInput()
fold_position_2 = Number(fold_position)
chamfer_in_y_2 = Number(chamfer_in_y)
chamfer_in_x_2 = Number(chamfer_in_x)

# ---- group: CHAMFER in 'Y'
num = Number(graft(chamfer_in_y_2))

# ----
pt_2 = Point(pt)
Y = UnitY(Factor=chamfer_in_y_2)
X = UnitX(Factor=chamfer_in_x_2)
shift = ShiftList(List=fold_position_2, Shift=1, Wrap=True)
rev = Reverse(Vector=Y)
rev_2 = Reverse(Vector=X)
pline = PolyLine(Vertices=pt_2, Closed=True)
item = ListItem(List=pt_2, Index=0, Wrap=True)
item_2 = ListItem(List=pt_2, Index=1, Wrap=True)
item_3 = ListItem(List=pt_2, Index=2, Wrap=True)
item_4 = ListItem(List=pt_2, Index=3, Wrap=True)
pshift = ShiftPaths(Data=shift, Offset=-1)
addition = Addition(A=rev, B=rev_2)
addition_2 = Addition(A=rev, B=X)
pshift_2 = ShiftPaths(Data=item, Offset=-1)
pshift_3 = ShiftPaths(Data=item_2, Offset=-1)
pshift_4 = ShiftPaths(Data=item_3, Offset=-1)
ln = Line(StartPoint=pshift_3, EndPoint=pshift_4)
pshift_5 = ShiftPaths(Data=item_4, Offset=-1)
ln_2 = Line(StartPoint=pshift_2, EndPoint=pshift_5)
eval = EvaluateCurve(Curve=ln_2, Parameter=fold_position_2)  # -> Point, Tangent, Angle
eval_2 = EvaluateCurve(Curve=ln, Parameter=pshift)  # -> Point, Tangent, Angle
ridge_depth_2 = Vector(ridge_depth)
min_thickness_2 = Vector(min_thickness)
move = Move(Geometry=eval.Point, Motion=ridge_depth_2)  # -> Geometry, Transform
move_2 = Move(Geometry=eval_2.Point, Motion=ridge_depth_2)  # -> Geometry, Transform
move_3 = Move(Geometry=pshift_2, Motion=addition)  # -> Geometry, Transform
move_4 = Move(Geometry=pshift_3, Motion=addition)  # -> Geometry, Transform
move_5 = Move(Geometry=pshift_4, Motion=addition_2)  # -> Geometry, Transform
move_6 = Move(Geometry=pshift_5, Motion=addition_2)  # -> Geometry, Transform
pt_3 = Point(move.Geometry)
pt_4 = Point(move_2.Geometry)
pt_5 = Point(pshift_3)
pt_6 = Point(pshift_2)
pt_7 = Point(pshift_4)
pt_8 = Point(pshift_5)
pt_9 = Point(move_3.Geometry)
move_7 = Move(Geometry=pt_9, Motion=min_thickness_2)  # -> Geometry, Transform
pt_10 = Point(move_7.Geometry)
pt_11 = Point(move_4.Geometry)
move_8 = Move(Geometry=pt_11, Motion=min_thickness_2)  # -> Geometry, Transform
pt_12 = Point(move_8.Geometry)
pt_13 = Point(move_5.Geometry)
move_9 = Move(Geometry=pt_13, Motion=min_thickness_2)  # -> Geometry, Transform
pt_14 = Point(move_9.Geometry)
pt_15 = Point(move_6.Geometry)
move_10 = Move(Geometry=pt_15, Motion=min_thickness_2)  # -> Geometry, Transform
pt_16 = Point(move_10.Geometry)
merge = Merge(Data1=graft(pt_9), Data2=graft(pt_11), Data3=graft(pt_13), Data4=graft(pt_15))
pline_2 = PolyLine(Vertices=merge, Closed=True)
srf4pt = _4PointSurface(CornerA=graft(pt_10), CornerB=graft(pt_12), CornerC=graft(pt_4), CornerD=graft(pt_3))
srf4pt_2 = _4PointSurface(CornerA=graft(pt_3), CornerB=graft(pt_4), CornerC=graft(pt_14), CornerD=graft(pt_16))
srf4pt_3 = _4PointSurface(CornerA=graft(pt_10), CornerB=graft(pt_12), CornerC=graft(pt_11), CornerD=graft(pt_9))
srf4pt_4 = _4PointSurface(CornerA=graft(pt_16), CornerB=graft(pt_14), CornerC=graft(pt_13), CornerD=graft(pt_15))
srf4pt_5 = _4PointSurface(CornerA=graft(pt_6), CornerB=graft(pt_5), CornerC=graft(pt_11), CornerD=graft(pt_9))
srf4pt_6 = _4PointSurface(CornerA=graft(pt_8), CornerB=graft(pt_7), CornerC=graft(pt_13), CornerD=graft(pt_15))
outer_wythe = BoundarySurfaces(Edges=pline)
perim = Curve(pline_2)
merge_2 = Merge(Data1=srf4pt, Data2=srf4pt_2, Data3=srf4pt_3, Data4=srf4pt_4, Data5=outer_wythe, Data6=srf4pt_5, Data7=srf4pt_6)
perim_2 = ClusterOutput(perim)
srf = Surface(merge_2)
pdecon = Deconstruct(Point=pt_5)  # -> XComponent, YComponent, ZComponent
srf_2 = ClusterOutput(srf)
merge_3 = Merge(Data1=graft(pt_10), Data2=graft(pt_3), Data3=graft(pt_16))
merge_4 = Merge(Data1=graft(pt_12), Data2=graft(pt_4), Data3=graft(pt_14))
merge_5 = Merge(Data1=graft(pt_3), Data2=graft(pt_4))
pdecon_2 = Deconstruct(Point=merge_3)  # -> XComponent, YComponent, ZComponent
pdecon_3 = Deconstruct(Point=merge_4)  # -> XComponent, YComponent, ZComponent
pdecon_4 = Deconstruct(Point=merge_5)  # -> XComponent, YComponent, ZComponent

# ---- group: CHAMFER in 'Y'
num_2 = Number(num)

# ----
neg = Negative(Value=pdecon_4.YComponent)
merge_6 = Merge(Data1=pdecon_2.XComponent, Data2=pdecon_3.XComponent)
pline_3 = PolyLine(Vertices=merge_3, Closed=False)
merge_7 = Merge(Data1=neg, Data2=num_2)
dims_in_x = Number(merge_6)
dims_in_y = Number(merge_7)
dims_in_x_2 = ClusterOutput(dims_in_x)
dims_in_y_2 = ClusterOutput(dims_in_y)

# ==== cluster Cluster_27
top_edge = ClusterInput()
bottom_edge = ClusterInput()
top_edge_2 = Line(top_edge)
len = Length(Curve=top_edge_2)
bottom_edge_2 = Line(bottom_edge)
pshift = ShiftPaths(Data=len, Offset=-1)
viewer = ParamViewer(pshift)
item = ListItem(List=viewer, Index=0, Wrap=True)
branch = TreeBranch(Tree=pshift, Path=item, MaintainPaths=True)
qty_grooves = ClusterInput()
bnd = Bounds(Numbers=branch)
dedomain = DeconstructDomain(Domain=bnd)  # -> Start, End
qty_grooves_2 = Integer(qty_grooves)
integer_division = IntegerDivision(A=dedomain.Start, B=qty_grooves_2)
multiplication = Multiplication(A=integer_division, B=2)
merge = Merge(Data1=multiplication, Data2=integer_division)
divide = DivideCurve(Curve=top_edge_2, Count=merge, Kinks=False)  # -> Points, Tangents, Parameters
divide_2 = DivideCurve(Curve=bottom_edge_2, Count=merge, Kinks=False)  # -> Points, Tangents, Parameters
ln = Line(StartPoint=divide.Points, EndPoint=divide_2.Points)
grooves = Line(ln)
grooves_2 = ClusterOutput(grooves)

# ==== cluster Cluster_28
outer_wythe_pts = ClusterInput()
chamfer_in_x = ClusterInput()

# ---- group: PANELS OUTER WYTHE (POINTS)
outer_wythe_pts_2 = Point(outer_wythe_pts)

# ----
chamfer_in_x_2 = Number(chamfer_in_x)
neg = Negative(Value=chamfer_in_x_2)
item = ListItem(List=outer_wythe_pts_2, Index=0, Wrap=True)
item_2 = ListItem(List=outer_wythe_pts_2, Index=1, Wrap=True)
item_3 = ListItem(List=outer_wythe_pts_2, Index=2, Wrap=True)
item_4 = ListItem(List=outer_wythe_pts_2, Index=3, Wrap=True)
X = UnitX(Factor=neg)
X_2 = UnitX(Factor=chamfer_in_x_2)
move = Move(Geometry=item, Motion=X)  # -> Geometry, Transform
move_2 = Move(Geometry=item_2, Motion=X)  # -> Geometry, Transform
move_3 = Move(Geometry=item_3, Motion=X_2)  # -> Geometry, Transform
move_4 = Move(Geometry=item_4, Motion=X_2)  # -> Geometry, Transform
merge = Merge(Data1=move.Geometry, Data2=move_2.Geometry, Data3=move_3.Geometry, Data4=move_4.Geometry)
pt = Point(move.Geometry)
dist = Distance(PointA=move.Geometry, PointB=move_4.Geometry)
pdecon = Deconstruct(Point=move.Geometry)  # -> XComponent, YComponent, ZComponent
wander_ratio = ClusterInput()
pshift = ShiftPaths(Data=pdecon.XComponent, Offset=-1)
pshift_2 = ShiftPaths(Data=dist, Offset=-1)
wander_ratio_2 = Number(wander_ratio)
bldg_height = ClusterInput()
bnd = Bounds(Numbers=pshift)
bldg_height_2 = Vector(bldg_height)
subtraction = Subtraction(A=1, B=wander_ratio_2)
dom = ConstructDomain(DomainStart=wander_ratio_2, DomainEnd=subtraction)
remap = RemapNumbers(Value=pshift, Source=bnd, Target=dom)
multiplication = Multiplication(A=remap, B=pshift_2)
X_3 = UnitX(Factor=graft(multiplication))
move_5 = Move(Geometry=pt, Motion=X_3)  # -> Geometry, Transform
pshift_3 = ShiftPaths(Data=move_5.Geometry, Offset=-1)
item_5 = ListItem(List=pshift_3, Index=0, Wrap=True)
move_6 = Move(Geometry=item_5, Motion=bldg_height_2)  # -> Geometry, Transform
merge_2 = Merge(Data1=pshift_3, Data2=move_6.Geometry)
intcrv = Interpolate(Vertices=merge_2, Degree=3, Periodic=False, KnotStyle=1)  # -> Curve, Length, Domain
pline = PolyLine(Vertices=merge, Closed=True)
fold_position_unitized = Number(remap)
wandering_curve = Curve(intcrv.Curve)
panels = Curve(pline)
fold_position_unitized_2 = ClusterOutput(fold_position_unitized)
wandering_curve_2 = ClusterOutput(wandering_curve)
panels_2 = ClusterOutput(panels)

# ==== cluster Cluster_29
panels_outer_wythe_points = ClusterInput()
panels_outer_wythe_points_2 = Point(panels_outer_wythe_points)
item = ListItem(List=panels_outer_wythe_points_2, Index=0, Wrap=True)
pshift = ShiftPaths(Data=item, Offset=-1)
viewer = ParamViewer(pshift)
item_2 = ListItem(List=viewer, Index=0, Wrap=True)
branch = TreeBranch(Tree=pshift, Path=item_2, MaintainPaths=True)
pdecon = Deconstruct(Point=branch)  # -> XComponent, YComponent, ZComponent
num = Number(pdecon.XComponent)
shift = ShiftList(List=num, Shift=-4, Wrap=True)  # -> flatten(List)
pi = Pi(Factor=0.5)
bnd = Bounds(Numbers=num)
dom = ConstructDomain(DomainStart=0, DomainEnd=1)
dom_2 = ConstructDomain(DomainStart=0, DomainEnd=pi)
remap = RemapNumbers(Value=shift, Source=bnd, Target=dom)
remap_2 = RemapNumbers(Value=shift, Source=bnd, Target=dom_2)
sin = Sine(Value=remap_2)
merge = Merge(Data1=graft(sin), Data2=graft(remap))
flip = FlipMatrix(Data=merge)
sine_vs_hm_curve = Number(flip)
sine = Number(sin)
sine_vs_hm_curve_2 = ClusterOutput(sine_vs_hm_curve)
sine_2 = ClusterOutput(sine)

# ==== cluster Cluster_30
outer_wythe = ClusterInput()
cost_per_sqft = ClusterInput()
outer_wythe_2 = Curve(outer_wythe)
cost_per_sqft_2 = Number(cost_per_sqft)
_1_sqft_in_mm_2 = Panel("92903.04")
area = Area(Geometry=outer_wythe_2)  # -> Area, Centroid
division = Division(A=area.Area, B=_1_sqft_in_mm_2)
multiplication = Multiplication(A=division, B=cost_per_sqft_2)
ma = MassAddition(Input=flatten(multiplication))  # -> Result, PartialResults
cost_per_panel = Integer(multiplication)

# ---- group: TOTAL COST (CURRENT FACADE)
total_cost = Integer(ma.Result)

# ----
cost_per_panel_2 = ClusterOutput(cost_per_panel)
total_cost_2 = ClusterOutput(total_cost)

# ==== cluster Cluster_31
inner_wythe = ClusterInput()
facade_perim = ClusterInput()
re_oriented_pl = ClusterInput()
inner_wythe_2 = Curve(inner_wythe)
facade_perim_2 = Curve(facade_perim)
re_oriented_pl_2 = Plane(re_oriented_pl)
deplane = DeconstructPlane(Plane=re_oriented_pl_2)  # -> Origin, XAxis, YAxis, ZAxis

crv = Curve(inner_wythe_2)
pshift = ShiftPaths(Data=crv, Offset=-1)

explode = Explode(Curve=inner_wythe_2, Recursive=True)  # -> Segments, Vertices
cullpt = CullDuplicates(Points=explode.Vertices, Tolerance=0.1, CullMode=3)  # -> Points, Indices, Valence
incurve = PointInCurve(Point=cullpt.Points, Curve=facade_perim_2)  # -> Relationship, Point
avr = Average(Input=incurve.Relationship)
equals = Equality(FirstNumber=avr, SecondNumber=2)  # -> Equality, Inequality
crv_2 = Curve(inner_wythe_2)
pshift_2 = ShiftPaths(Data=equals.Equality, Offset=-2)
viewer = ParamViewer(crv_2)
inside_facade = Boolean(pshift_2)
cull = CullPattern(List=viewer, CullPattern=flatten(inside_facade))
branch = TreeBranch(Tree=crv_2, Path=cull, MaintainPaths=True)
cull_2 = CullPattern(List=crv_2, CullPattern=inside_facade)
pshift_3 = ShiftPaths(Data=branch, Offset=-1)
viewer_2 = ParamViewer(pshift_3)
cull_i = CullIndex(List=reverse(viewer_2), Indices=0, Wrap=True)  # -> reverse(List)
branch_2 = TreeBranch(Tree=pshift_3, Path=cull_i, MaintainPaths=True)

branch_3 = TreeBranch(Tree=crv, Path=cull, MaintainPaths=True)

branch_4 = TreeBranch(Tree=pshift, Path=viewer_2, MaintainPaths=True)
explode_2 = Explode(Curve=branch_4, Recursive=True)  # -> Segments, Vertices
cull_i_2 = CullIndex(List=explode_2.Vertices, Indices=4, Wrap=True)
pshift_4 = ShiftPaths(Data=cull_i_2, Offset=-1)
relitem = RelativeItem(Tree=pshift_4, Offset="{1;0}", WrapPaths=False, WrapItems=False)  # -> ItemA, ItemB
item = ListItem(List=relitem.ItemA, Index=3, Wrap=True)
item_2 = ListItem(List=relitem.ItemA, Index=2, Wrap=True)
item_3 = ListItem(List=relitem.ItemB, Index=1, Wrap=True)
item_4 = ListItem(List=relitem.ItemB, Index=0, Wrap=True)
merge = Merge(Data1=item, Data2=item_2, Data3=item_3, Data4=item_4)
pline = PolyLine(Vertices=merge, Closed=True)
pshift_5 = ShiftPaths(Data=pline, Offset=-1)
short = ShortestList(ListA=branch_2, ListB=pshift_5, TrimMode=1)  # -> ListA, ListB
crv_3 = Curve(short.ListB)

explode_3 = Explode(Curve=branch_3, Recursive=True)  # -> Segments, Vertices
cull_i_3 = CullIndex(List=explode_3.Vertices, Indices=4, Wrap=True)
pshift_6 = ShiftPaths(Data=cull_i_3, Offset=-2)
relitem_2 = RelativeItem(Tree=pshift_6, Offset="{1;0}", WrapPaths=False, WrapItems=False)  # -> ItemA, ItemB

pshift_7 = ShiftPaths(Data=inside_facade, Offset=-1)
lng = ListLength(List=pshift_7)  # -> flatten(Length)
partition = PartitionList(List=viewer, Size=lng)
flip = FlipMatrix(Data=partition)
flip_2 = FlipMatrix(Data=pshift_7)
cull_3 = CullPattern(List=flip, CullPattern=flip_2)
item_5 = ListItem(List=reverse(cull_3), Index=0, Wrap=True)
item_6 = ListItem(List=cull_3, Index=0, Wrap=True)

item_7 = ListItem(List=relitem_2.ItemA, Index=3, Wrap=True)
item_8 = ListItem(List=relitem_2.ItemA, Index=2, Wrap=True)
item_9 = ListItem(List=relitem_2.ItemB, Index=1, Wrap=True)
item_10 = ListItem(List=relitem_2.ItemB, Index=0, Wrap=True)
merge_2 = Merge(Data1=item_7, Data2=item_8, Data3=item_9, Data4=item_10)
pline_2 = PolyLine(Vertices=merge_2, Closed=True)

branch_5 = TreeBranch(Tree=cull_2, Path=flatten(item_6), MaintainPaths=True)
branch_6 = TreeBranch(Tree=cull_2, Path=flatten(item_5), MaintainPaths=True)
path_mapper = PathMapper(branch_5, source="{A;B}", target="{B}")
path_mapper_2 = PathMapper(branch_6, source="{A;B}", target="{B}")

viewer_3 = ParamViewer(branch_5)
viewer_4 = ParamViewer(branch_6)

explode_4 = Explode(Curve=path_mapper_2, Recursive=True)  # -> Segments, Vertices
item_11 = ListItem(List=explode_4.Vertices, Index=3, Wrap=True)
item_12 = ListItem(List=explode_4.Vertices, Index=2, Wrap=True)
xy = XYPlane(Origin=item_11)
xy_2 = XYPlane(Origin=item_12)
pcx = CurvePlane(Curve=facade_perim_2, Plane=xy)  # -> Points, ParamsC, ParamsP
pcx_2 = CurvePlane(Curve=facade_perim_2, Plane=xy_2)  # -> Points, ParamsC, ParamsP
pshift_8 = ShiftPaths(Data=pcx.Points, Offset=-1)
pshift_9 = ShiftPaths(Data=pcx_2.Points, Offset=-1)
vec2pt = Vector2Pt(PointA=item_11, PointB=pshift_8, Unitize=False)  # -> unitize(Vector), Length
vec2pt_2 = Vector2Pt(PointA=item_12, PointB=pshift_9, Unitize=False)  # -> unitize(Vector), Length
devec = DeconstructVector(Vector=vec2pt.Vector)  # -> XComponent, YComponent, ZComponent
devec_2 = DeconstructVector(Vector=deplane.XAxis)  # -> XComponent, YComponent, ZComponent
devec_3 = DeconstructVector(Vector=vec2pt_2.Vector)  # -> XComponent, YComponent, ZComponent
addition = Addition(A=devec.XComponent, B=devec.YComponent, C=devec.ZComponent)
addition_2 = Addition(A=devec_2.XComponent, B=devec_2.YComponent)
addition_3 = Addition(A=devec_3.XComponent, B=devec_3.YComponent, C=devec_3.ZComponent)
similar = Similarity(FirstNumber=addition, SecondNumber=addition_2, Threshold=10)  # -> Similarity, AbsoluteDifference
similar_2 = Similarity(FirstNumber=addition_3, SecondNumber=addition_2, Threshold=10)  # -> Similarity, AbsoluteDifference
cull_4 = CullPattern(List=pshift_8, CullPattern=similar.Similarity)
cull_5 = CullPattern(List=pshift_9, CullPattern=similar_2.Similarity)
pdecon = Deconstruct(Point=cull_4)  # -> XComponent, YComponent, ZComponent
pdecon_2 = Deconstruct(Point=cull_5)  # -> XComponent, YComponent, ZComponent
pt = ConstructPoint(XCoordinate=pdecon.XComponent, YCoordinate=pdecon.YComponent, ZCoordinate=pdecon_2.ZComponent)
merge_3 = Merge(Data1=cull_4, Data2=pt, Data3=item_12, Data4=item_11)
pline_3 = PolyLine(Vertices=merge_3, Closed=True)

explode_5 = Explode(Curve=path_mapper, Recursive=True)  # -> Segments, Vertices
item_13 = ListItem(List=explode_5.Vertices, Index=0, Wrap=True)
item_14 = ListItem(List=explode_5.Vertices, Index=1, Wrap=True)
xy_3 = XYPlane(Origin=item_13)
xy_4 = XYPlane(Origin=item_14)
pcx_3 = CurvePlane(Curve=facade_perim_2, Plane=xy_3)  # -> Points, ParamsC, ParamsP
pcx_4 = CurvePlane(Curve=facade_perim_2, Plane=xy_4)  # -> Points, ParamsC, ParamsP
pshift_10 = ShiftPaths(Data=pcx_3.Points, Offset=-1)
pshift_11 = ShiftPaths(Data=pcx_4.Points, Offset=-1)
vec2pt_3 = Vector2Pt(PointA=item_11, PointB=pshift_10, Unitize=False)  # -> unitize(Vector), Length
vec2pt_4 = Vector2Pt(PointA=item_12, PointB=pshift_11, Unitize=False)  # -> unitize(Vector), Length
devec_4 = DeconstructVector(Vector=vec2pt_3.Vector)  # -> XComponent, YComponent, ZComponent
devec_5 = DeconstructVector(Vector=deplane.XAxis)  # -> XComponent, YComponent, ZComponent
devec_6 = DeconstructVector(Vector=vec2pt_4.Vector)  # -> XComponent, YComponent, ZComponent
addition_4 = Addition(A=devec_4.XComponent, B=devec_4.YComponent, C=devec_4.ZComponent)
addition_5 = Addition(A=devec_5.XComponent, B=devec_5.YComponent)
addition_6 = Addition(A=devec_6.XComponent, B=devec_6.YComponent, C=devec_6.ZComponent)
neg = Negative(Value=addition_5)
similar_3 = Similarity(FirstNumber=addition_4, SecondNumber=neg, Threshold=10)  # -> Similarity, AbsoluteDifference
similar_4 = Similarity(FirstNumber=addition_6, SecondNumber=neg, Threshold=10)  # -> Similarity, AbsoluteDifference
cull_6 = CullPattern(List=pshift_10, CullPattern=similar_3.Similarity)
cull_7 = CullPattern(List=pshift_11, CullPattern=similar_4.Similarity)
pdecon_3 = Deconstruct(Point=cull_6)  # -> XComponent, YComponent, ZComponent
pdecon_4 = Deconstruct(Point=cull_7)  # -> XComponent, YComponent, ZComponent
pt_2 = ConstructPoint(XCoordinate=pdecon_3.XComponent, YCoordinate=pdecon_3.YComponent, ZCoordinate=pdecon_4.ZComponent)
merge_4 = Merge(Data1=cull_6, Data2=pt_2, Data3=item_14, Data4=item_13)
pline_4 = PolyLine(Vertices=merge_4, Closed=True)

path = DataPath(viewer_3)
path_2 = DataPath(viewer_4)
dpath = DeconstructPath(Branch=path)
dpath_2 = DeconstructPath(Branch=path_2)
item_15 = ListItem(List=dpath, Index=1, Wrap=True)  # -> flatten(Item)
item_16 = ListItem(List=dpath_2, Index=1, Wrap=True)  # -> flatten(Item)
sort = SortList(Keys=item_15, ValuesA=path)  # -> Keys, ValuesA
sort_2 = SortList(Keys=item_16, ValuesA=path_2)  # -> Keys, ValuesA
viewer_5 = ParamViewer(pline_4)
viewer_6 = ParamViewer(pline_3)
replace = ReplacePaths(Data=pline_4, Search=viewer_5, Replace=sort.ValuesA)
replace_2 = ReplacePaths(Data=pline_3, Search=viewer_6, Replace=sort_2.ValuesA)
path_mapper_3 = PathMapper(replace, source="{A;B}", target="{A - 1;B}")
corner_left = Curve(path_mapper_3)
corner_right = Curve(replace_2)
typ_glazing = Curve(pline_2)
corner_left_2 = ClusterOutput(corner_left)
corner_right_2 = ClusterOutput(corner_right)
typ_glazing_2 = ClusterOutput(typ_glazing)

# ==== cluster Cluster_32
C = ClusterInput()
prefix = ClusterInput()
type_prefix = ClusterInput()
window_type = ClusterInput()
end = EndPoints(Curve=flatten(C))  # -> graft(Start), graft(End)
type_prefix_2 = Text(type_prefix)
window_type_2 = Text(window_type)
concat = Concatenate(FragmentA=type_prefix_2, FragmentB=window_type_2)  # -> graft(Result)
pt2num = PointsToNumbers(Points=end.Start, Mask=4)
pt2num_2 = PointsToNumbers(Points=end.End, Mask=4)
item = ListItem(List=pt2num, Index=0, Wrap=True)
item_2 = ListItem(List=pt2num, Index=1, Wrap=True)
item_3 = ListItem(List=pt2num, Index=2, Wrap=True)
item_4 = ListItem(List=pt2num_2, Index=0, Wrap=True)
item_5 = ListItem(List=pt2num_2, Index=1, Wrap=True)
item_6 = ListItem(List=pt2num_2, Index=2, Wrap=True)
expression = Expression(
    prefix=prefix,
    d1=item,
    d2=item_2,
    d3=item_3,
    d4=item_4,
    d5=item_5,
    d6=item_6,
    d7=concat,
    Expression="Format(\"{0}, {1}, {2}, {3}, {4}, {5}, {6}, {7}\", prefix, d1, d2, d3, d4, d5, d6, d7)")  # -> flatten(R)
R = ClusterOutput(expression)

# ==== cluster Cluster_33
prefix = ClusterInput()
datum_offset = ClusterInput()
grid_x_value = ClusterInput()
dims_in_x = ClusterInput()
dims_in_y = ClusterInput()
grid_x_value_2 = Number(grid_x_value)
dims_in_x_2 = Number(dims_in_x)
dims_in_y_2 = Number(dims_in_y)
viewer = ParamViewer(dims_in_x_2)
subtraction = Subtraction(A=dims_in_x_2, B=grid_x_value_2)
lng = ListLength(List=viewer)
datum_offset_2 = Number(datum_offset)
series = Series(Start=1, Step=1, Count=lng)
addition = Addition(A=subtraction, B=datum_offset_2)
int = Integer(series)
int_2 = Integer(addition)
pshift = ShiftPaths(Data=int, Offset=-1)  # -> graft(Data)
concat = Concatenate(FragmentA=int_2, FragmentB=" mm")
concat_2 = Concatenate(FragmentA=dims_in_y_2, FragmentB=" mm")
prefix_2 = Text(prefix)
concat_3 = Concatenate(FragmentA=prefix_2, FragmentB=pshift)
item = ListItem(List=concat, Index=0, Wrap=True)
item_2 = ListItem(List=concat, Index=1, Wrap=True)
item_3 = ListItem(List=concat, Index=2, Wrap=True)
item_4 = ListItem(List=concat, Index=3, Wrap=True)
item_5 = ListItem(List=concat, Index=4, Wrap=True)
item_6 = ListItem(List=concat, Index=5, Wrap=True)
item_7 = ListItem(List=concat, Index=6, Wrap=True)
item_8 = ListItem(List=concat, Index=7, Wrap=True)
item_9 = ListItem(List=concat_2, Index=0, Wrap=True)
item_10 = ListItem(List=concat_2, Index=1, Wrap=True)
item_11 = ListItem(List=concat_2, Index=2, Wrap=True)
expression = Expression(
    prefix=concat_3,
    d1=item,
    d2=item_2,
    d3=item_3,
    d4=item_4,
    d5=item_5,
    d6=item_6,
    d7=item_7,
    d8=item_8,
    d9=item_9,
    d10=item_10,
    d11=item_11,
    Expression="Format(\"{0}, {1}, {2}, {3}, {4}, {5}, {6}, {7}, {8}, {9}, {10}, {11}\", prefix, d1, d2, d3, d4, d5, d6, d7, d8, d9, d10, d11)")  # -> flatten(R)
panel_dims = Text(expression)
panel_dims_2 = ClusterOutput(panel_dims)

# ==== cluster Cluster_37
r_o_gap = ClusterInput()
mullion_thickness = ClusterInput()
window_curves = ClusterInput()
vent_height = ClusterInput()
bottom_pts_vert_shift = ClusterInput()
window_curves_2 = Curve(window_curves)
vent_height_2 = Number(vent_height)
bottom_pts_vert_shift_2 = Vector(bottom_pts_vert_shift)
explode = Explode(Curve=window_curves_2, Recursive=True)  # -> Segments, Vertices
vent_l_r_hand = ClusterInput()
solids_toggle = ClusterInput()
min_vent_width = ClusterInput()
floor_grouping = ClusterInput()
pshift = ShiftPaths(Data=explode.Vertices, Offset=-1)
vent_l_r_hand_2 = Integer(vent_l_r_hand)
min_vent_width_2 = Number(min_vent_width)
floor_grouping_2 = Integer(floor_grouping)
item = ListItem(List=pshift, Index=0, Wrap=True)
item_2 = ListItem(List=pshift, Index=1, Wrap=True)
item_3 = ListItem(List=pshift, Index=3, Wrap=True)
item_4 = ListItem(List=pshift, Index=2, Wrap=True)
solids_toggle_2 = Boolean(solids_toggle)
r_o_gap_2 = Number(r_o_gap)
mullion_thickness_2 = Number(mullion_thickness)

# ---- group: Bottom Left
pt = Point(item)

# ----
move = Move(Geometry=pt, Motion=bottom_pts_vert_shift_2)  # -> Geometry, Transform

# ---- group: Top Left
pt_2 = Point(item_2)

# ---- group: Bottom Right
pt_3 = Point(item_3)

# ----
move_2 = Move(Geometry=pt_3, Motion=bottom_pts_vert_shift_2)  # -> Geometry, Transform

# ---- group: Top Right
pt_4 = Point(item_4)

# ----
ln = Line(StartPoint=pt, EndPoint=pt_3)
merge = Merge(Data1=pt, Data2=pt_3)

# ----
# GROUP VENT WIDTHS BY EVERY 'N-th" FLOOR
item_5 = ListItem(List=merge, Index=vent_l_r_hand_2, Wrap=True)
viewer = ParamViewer(item_5)
pdecon = Deconstruct(Point=item_5)  # -> XComponent, YComponent, ZComponent
pshift_2 = ShiftPaths(Data=pdecon.XComponent, Offset=-1)
partition = PartitionList(List=pshift_2, Size=floor_grouping_2)
bnd = Bounds(Numbers=partition)
dedomain = DeconstructDomain(Domain=bnd)  # -> Start, End
subtraction = Subtraction(A=dedomain.Start, B=partition)
subtraction_2 = Subtraction(A=dedomain.End, B=partition)
pshift_3 = ShiftPaths(Data=subtraction, Offset=-1)  # -> graft(Data)
pshift_4 = ShiftPaths(Data=subtraction_2, Offset=-1)  # -> graft(Data)
viewer_2 = ParamViewer(pshift_3)
viewer_3 = ParamViewer(pshift_3)
replace = ReplacePaths(Data=pshift_3, Search=viewer_2, Replace=viewer)
replace_2 = ReplacePaths(Data=pshift_3, Search=viewer_3, Replace=viewer)
subtraction_3 = Subtraction(A=min_vent_width_2, B=replace)
addition = Addition(A=min_vent_width_2, B=replace_2)
merge_2 = Merge(Data1=subtraction_3, Data2=addition)
item_6 = ListItem(List=reverse(merge_2), Index=vent_l_r_hand_2, Wrap=True)

merge_3 = Merge(Data1=move.Geometry, Data2=pt_2, Data3=pt_4, Data4=move_2.Geometry)
dist = Distance(PointA=pt, PointB=pt_3)
rounding_integer = ClusterInput()

# ---- group: Bottom Left
pt_5 = Point(pt)

# ---- group: Bottom Right
pt_6 = Point(pt_3)

# ---- group: R.O. Width
num = Number(dist)

# ---- group: Window Pts
pt_7 = Point(merge_3)

# ---- group: Rounding Integer
rounding_integer_2 = Integer(rounding_integer)

# ----
# POSITION VECTORS
addition_2 = Addition(A=r_o_gap_2, B=mullion_thickness_2)
pt_8 = ConstructPoint(XCoordinate=0, YCoordinate=0, ZCoordinate=0)
multiplication = Multiplication(A=addition_2, B=2)
vec2pt = Vector2Pt(PointA=pt_8, PointB=pt_5, Unitize=False)  # -> Vector, Length
vec2pt_2 = Vector2Pt(PointA=pt_8, PointB=pt_6, Unitize=False)  # -> Vector, Length
subtraction_4 = Subtraction(A=num, B=multiplication)
X = UnitX(Factor=r_o_gap_2)
X_2 = UnitX(Factor=mullion_thickness_2)

division = Division(A=num, B=rounding_integer_2)

# ---- group: Vert. Mullion Location
num_2 = Number(item_6)

# ----
rev = Reverse()

subtraction_5 = Subtraction(A=num_2, B=mullion_thickness_2)
Z = UnitZ(Factor=vent_height_2)
X_3 = UnitX(Factor=num_2)
rev_2 = Reverse(Vector=X_3)
merge_4 = Merge(Data1=rev_2, Data2=X_3)

round = Round(Number=division)  # -> Nearest, Floor, Ceiling
multiplication_2 = Multiplication(A=round.Nearest, B=rounding_integer_2)
rev_3 = Reverse(Vector=X_2)
rev_4 = Reverse(Vector=X)

# ---- group: Window Width (glass)
num_3 = Number(subtraction_4)

# ---- group: R.O. Width (Rounded)
num_4 = Number(multiplication_2)

# ---- group: VENT L/R HAND
int = Integer(vent_l_r_hand_2)

# ---- group: Vent Width (glass)
num_5 = Number(subtraction_5)

# ---- group: R.O. Gap
vec = Vector(rev_4)

# ---- group: Mullion Thickness
vec_2 = Vector(rev_3)

# ----
rev_5 = Reverse(Vector=merge_4)
jamb = ClusterInput()
header = ClusterInput()
horiz_tbar = ClusterInput()
sill = ClusterInput()
vert_tbar = ClusterInput()
caulking = ClusterInput()
jamb_2 = Curve(jamb)
header_2 = Curve(header)
horiz_tbar_2 = Curve(horiz_tbar)
sill_2 = Curve(sill)
vert_tbar_2 = Curve(vert_tbar)
caulking_2 = Curve(caulking)

# ---- group: Mullion Thickness
vec_3 = Vector(vec_2)

# ---- group: WITHOUT R.O. GAP
move_3 = Move(Geometry=caulking_2, Motion=vec2pt.Vector)  # -> Geometry, Transform
move_4 = Move(Geometry=caulking_2, Motion=vec2pt_2.Vector)  # -> Geometry, Transform

# ----
int_2 = Integer(1)
int_3 = Integer(-1)
bool = Boolean(solids_toggle_2)
bool_2 = Boolean(bool)
bool_3 = Boolean(bool)
bool_4 = Boolean(True)
cluster = Cluster_36(C=sill_2)  # -> r1, r2

# ---- group: HEADER
crv = Curve(header_2)

# ----
x_tremez = Extremes(Curve=move_3.Geometry, Plane=PlaneXY(0, 0, 0))  # -> Highest, Lowest
x_tremez_2 = Extremes(Curve=move_4.Geometry, Plane=PlaneXY(0, 0, 0))  # -> Highest, Lowest
merge_5 = Merge(Data1=x_tremez_2.Lowest, Data2=x_tremez_2.Highest, Data3=x_tremez.Highest, Data4=x_tremez.Lowest)
xz = XZPlane(Origin=Point(0, 0, 0))
project = Project(Geometry=merge_5, Plane=xz)  # -> Geometry, Transform

# ---- group: Mullion Thickness
vec_4 = Vector(vec_2)

# ---- group: R.O. Gap
vec_5 = Vector(vec)

# ----
int_4 = Integer(1)

# ---- group: Window Pts (@ Jambs)
pt_9 = Point(project.Geometry)

# ----
avr = Average(Input=pt_9)
approx_window_center_pt = Point(avr)
window_pts = Point(pt_9)
window_pts_levels = Point(pt_7)

approx_window_center_pt_2 = XZPlane(APPROXWINDOWCENTERPT=approx_window_center_pt)
approx_window_center_pt_3 = ClusterOutput(approx_window_center_pt)
window_pts_2 = ClusterOutput(window_pts)
window_pts_levels_2 = ClusterOutput(window_pts_levels)
split = SplitTree(Data=window_curves_2, Masks=flatten("{0;*}"))  # -> Positive, Negative

item_7 = ListItem(List=rev_5, Index=int, Wrap=True)
X_4 = UnitX(Factor=num_5)
rev_6 = Reverse(Vector=X_4)
rev_7 = Reverse(Vector=vec_3)
merge_6 = Merge(Data1=rev_6, Data2=X_4)
merge_7 = Merge(Data1=rev_7, Data2=vec_3)
item_8 = ListItem(List=merge_6, Index=int, Wrap=True)
item_9 = ListItem(List=merge_7, Index=int, Wrap=True)

rev_8 = Reverse(Vector=item_8)
rev_9 = Reverse(Vector=item_9)

# ----
# CONSTANT
# VECTORS
rev_10 = Reverse(Vector=vec)
rev_11 = Reverse(Vector=vec_2)
X_5 = UnitX(Factor=num_3)
addition_3 = Addition(A=vec2pt.Vector, B=rev_10)
addition_4 = Addition(A=vec2pt_2.Vector, B=vec)
addition_5 = Addition(A=addition_3, B=rev_11)
addition_6 = Addition(A=addition_4, B=vec_2)
merge_8 = Merge(Data1=addition_3, Data2=addition_4)
merge_9 = Merge(Data1=addition_5, Data2=addition_6)

item_10 = ListItem(List=merge_9, Index=int, Wrap=True)
item_11 = ListItem(List=merge_8, Index=int, Wrap=True)
addition_7 = Addition(A=item_10, B=Z)
addition_8 = Addition(A=item_11, B=item_7)

rev_12 = Reverse(Vector=X_5)
p_n_c = PickNChoose(Pattern=bool, Stream1=addition_7)
p_n_c_2 = PickNChoose(Pattern=bool, Stream1=addition_8)

vec_6 = Vector(rev_12)

# ---- group: RIGHT JAMB LOCATION
vec_7 = Vector(addition_3)

# ---- group: LEFT JAMB LOCATION
vec_8 = Vector(addition_4)

# ----
# DATA DEFINED BY VENT L/R HAND
move_5 = Move(Geometry=horiz_tbar_2, Motion=p_n_c)  # -> Geometry, Transform
move_6 = Move(Geometry=vert_tbar_2, Motion=p_n_c_2)  # -> Geometry, Transform
extr = Extrude(Base=move_5.Geometry, Direction=rev_8)  # disabled
extr_2 = Extrude(Base=move_6.Geometry, Direction=rev_9)  # disabled

# ---- group: RIGHT JAMB LOCATION
vec_9 = Vector(vec_7)

# ---- group: LEFT JAMB LOCATION
vec_10 = Vector(vec_8)

# ----
cluster_2 = Cluster_35(R=move_5.Geometry, V=item_8, plane_sign=int_2)
cluster_3 = Cluster_35(R=move_6.Geometry, V=rev_9, plane_sign=int_3)
cluster_4 = Cluster_34(C=move_5.Geometry, V=rev_8)  # disabled
cluster_5 = Cluster_34(C=move_6.Geometry, V=rev_9)  # disabled
mesh = Mesh(cluster_2)
mesh_2 = Mesh(cluster_3)
p_n_c_3 = PickNChoose(Pattern=bool, Stream1=addition_6)

# ---- group: HEADER IN-PLACE
move_7 = Move(Geometry=crv, Motion=p_n_c_3)  # -> Geometry, Transform

# ---- group: SILL IN-PLACE (POLYLINE)
move_8 = Move(Geometry=sill_2, Motion=p_n_c_3)  # -> Geometry, Transform; disabled

# ---- group: SILL IN-PLACE (R1 & R2)
move_9 = Move(Geometry=cluster.r1, Motion=p_n_c_3)  # -> Geometry, Transform
move_10 = Move(Geometry=cluster.r2, Motion=p_n_c_3)  # -> Geometry, Transform

# ----
cluster_6 = Cluster_35(R=move_7.Geometry, V=vec_6, plane_sign=int_4)
cluster_7 = Cluster_35(R=move_9.Geometry, V=vec_6, plane_sign=int_4)
cluster_8 = Cluster_35(R=move_10.Geometry, V=vec_6, plane_sign=int_4)
merge_10 = Merge(Data1=cluster_7, Data2=cluster_8)
extr_3 = Extrude(Base=move_7.Geometry, Direction=vec_6)  # disabled
extr_4 = Extrude(Base=move_8.Geometry, Direction=vec_6)  # disabled
mesh_3 = Mesh(cluster_6)
mesh_4 = Mesh(merge_10)

merge_11 = Merge(Data1=num_4, Data2=num_5)
viewer_4 = ParamViewer(merge_11)
window_widths = Number(merge_11)

window_widths_2 = Number(window_widths)

viewer_5 = ParamViewer(window_widths_2)
item_12 = ListItem(List=window_widths_2, Index="0", Wrap=True)  # -> flatten(Item)
item_13 = ListItem(List=window_widths_2, Index="1", Wrap=True)  # -> flatten(Item)
lng = ListLength(List=viewer_5)
series = Series(Start=0, Step=1, Count=lng)
int_5 = Integer(series)
pshift_5 = ShiftPaths(Data=int_5, Offset=-1)
sort = SortList(Keys=item_12, ValuesA=item_13, ValuesB=viewer_5, ValuesC=pshift_5)  # -> Keys, ValuesA, ValuesB, ValuesC
cset = CreateSet(List=sort.Keys)  # -> graft(Set), Map
mindex = MemberIndex(Set=sort.Keys, Member=cset.Set)  # -> Index, Count
pshift_6 = ShiftPaths(Data=mindex.Index, Offset=-1)
item_14 = ListItem(List=sort.Keys, Index=pshift_6, Wrap=True)
item_15 = ListItem(List=sort.ValuesA, Index=pshift_6, Wrap=True)
item_16 = ListItem(List=sort.ValuesB, Index=pshift_6, Wrap=True)
item_17 = ListItem(List=sort.ValuesC, Index=pshift_6, Wrap=True)
sort_2 = SortList(Keys=item_15, ValuesA=item_14, ValuesB=item_16, ValuesC=item_17)  # -> Keys, ValuesA, ValuesB, ValuesC
cset_2 = CreateSet(List=sort_2.Keys)  # -> Set, Map
mindex_2 = MemberIndex(Set=sort_2.Keys, Member=cset_2.Set)  # -> Index, Count
partition_2 = PartitionList(List=sort_2.ValuesB, Size=mindex_2.Count)
partition_3 = PartitionList(List=sort_2.ValuesC, Size=mindex_2.Count)
partition_4 = PartitionList(List=sort_2.Keys, Size=mindex_2.Count)
partition_5 = PartitionList(List=sort_2.ValuesA, Size=mindex_2.Count)

int_6 = Integer(sort_2.ValuesA)
int_7 = Integer(sort_2.Keys)

int_8 = Integer(cset_2.Set)
lng_2 = ListLength(List=int_8)  # -> flatten(Length)
int_9 = Integer(graft(int_8))
viewer_6 = ParamViewer(int_9)
lng_3 = ListLength(List=viewer_6)
series_2 = Series(Start=1, Step=1, Count=lng_3)
pshift_7 = ShiftPaths(Data=series_2, Offset=-1)
int_10 = Integer(pshift_7)
partition_6 = PartitionList(List=int_10, Size=lng_2)  # -> graft(Chunks)

concat = Concatenate(FragmentA=int_6, FragmentB="_", FragmentC=int_7)
cset_3 = CreateSet(List=flatten(concat))  # -> Set, Map

# ---- group: BREP DATA BRANCHES (GRAFTED)
txt = Text(partition_2)

# ----
txt_2 = Text(flatten(txt))
lng_4 = ListLength(List=txt)
dup = DuplicateData(Data=partition_6, Number=lng_4, Order=True)

# ---- group: ONE OF EACH WINDOW TYPE
item_18 = ListItem(List=partition_2, Index=0, Wrap=True)
item_19 = ListItem(List=partition_3, Index=0, Wrap=True)  # -> flatten(Item)
item_20 = ListItem(List=partition_4, Index=0, Wrap=True)
item_21 = ListItem(List=partition_5, Index=0, Wrap=True)
int_11 = Integer(mindex_2.Count)
int_12 = Integer(graft(int_11))
viewer_7 = ParamViewer(int_12)
viewer_8 = ParamViewer(int_11)

# ---- group: DE-SORTED INDICES (GRAFTED)
int_13 = Integer(flatten(partition_3))

# ---- group: WINDOW TYPE (GRAFTED)
int_14 = Integer(flatten(dup))

# ----
window_widths_3 = ClusterOutput(window_widths)

# ---- group: GRID DATA BRANCHES
txt_3 = Text(viewer_8)

txt_4 = Text(viewer_7)

# ---- group: WINDOW TYPE QTY
int_15 = Integer(int_11)

# ---- group: BREP DATA BRANCHES
txt_5 = Text(item_18)

# ---- group: DE-SORTED INDICES
int_16 = Integer(item_19)

# ---- group: VENT WIDTH
int_17 = Integer(item_20)

# ---- group: WINDOW WIDTH
int_18 = Integer(item_21)

# ----
sort_3 = SortList(Keys=int_13, ValuesA=int_14, ValuesB=txt_2)  # -> Keys, ValuesA, ValuesB
int_19 = Integer(graft(sort_3.ValuesA))

viewer_9 = ParamViewer(int_19)
replace_3 = ReplacePaths(Data=int_19, Search=viewer_9, Replace=viewer_4)
window_type = Text(replace_3)
window_type_descriptions = Text(cset_3.Set)

window_type_2 = ClusterOutput(window_type)
window_type_descriptions_2 = ClusterOutput(window_type_descriptions)
sort_4 = SortList(Keys=int_16, ValuesA=txt_4)  # -> Keys, ValuesA

# ---- group: BREP DATA BRANCHES
branch_w_type = Text(flatten(txt_5))

# ----
branch = TreeBranch(Tree=approx_window_center_pt_2, Path=branch_w_type, MaintainPaths=True)

# ---- group: DE-SORTED GRID DATA BRANCHES
branch_grid = Text(flatten(sort_4.ValuesA))

# ----
viewer_10 = ParamViewer(branch)
replace_4 = ReplacePaths(Data=branch, Search=viewer_10, Replace=branch_grid)

# ----
# MESHES :: JAMBS
p_n_c_4 = PickNChoose(Pattern=bool_2, Stream1=vec_9)
p_n_c_5 = PickNChoose(Pattern=bool_2, Stream1=vec_10)
cluster_9 = Cluster_36(C=jamb_2)  # -> r1, r2
int_20 = Integer(1)
neg = Negative(Value=int_20)

# ---- group: RIGHT JAMB LOCATION
vec_11 = Vector(p_n_c_4)

# ---- group: LEFT JAMB LOCATION
vec_12 = Vector(p_n_c_5)

# ---- group: RIGHT JAMB IN-PLACE (R1 & R2)
move_11 = Move(Geometry=cluster_9.r1, Motion=vec_11)  # -> Geometry, Transform
move_12 = Move(Geometry=cluster_9.r2, Motion=vec_11)  # -> Geometry, Transform

# ---- group: LEFT JAMB IN-PLACE (R1 & R2)
move_13 = Move(Geometry=cluster_9.r1, Motion=vec_12)  # -> Geometry, Transform
move_14 = Move(Geometry=cluster_9.r2, Motion=vec_12)  # -> Geometry, Transform

# ----
cluster_10 = Cluster_35(R=move_11.Geometry, V=vec_4, plane_sign=neg)
cluster_11 = Cluster_35(R=move_12.Geometry, V=vec_4, plane_sign=neg)
cluster_12 = Cluster_35(R=move_13.Geometry, V=vec_4, plane_sign=int_20)
cluster_13 = Cluster_35(R=move_14.Geometry, V=vec_4, plane_sign=int_20)
merge_12 = Merge(Data1=cluster_10, Data2=cluster_11)
merge_13 = Merge(Data1=cluster_12, Data2=cluster_13)

# ---- group: POSITION RIGHT JAMB
move_15 = Move(Geometry=jamb_2, Motion=p_n_c_4)  # -> Geometry, Transform; disabled

# ---- group: POSITION LEFT JAMB
move_16 = Move(Geometry=jamb_2, Motion=p_n_c_5)  # -> Geometry, Transform; disabled

# ----
extr_5 = Extrude(Base=move_15.Geometry, Direction=rev_11)  # disabled
extr_6 = Extrude(Base=move_16.Geometry, Direction=vec_2)  # disabled
mesh_5 = Mesh(merge_12)
mesh_6 = Mesh(merge_13)
merge_14 = Merge(Data1=extr_5, Data2=extr_6, Data3=extr_3, Data4=extr_4, Data5=extr, Data6=extr_2)
window_wall = CapHoles(Brep=merge_14)
window_walls = Brep(window_wall)
branch_2 = TreeBranch(Tree=window_walls, Path=branch_w_type, MaintainPaths=True)
viewer_11 = ParamViewer(branch_2)
B = ClusterOutput(window_wall)
replace_5 = ReplacePaths(Data=branch_2, Search=viewer_11, Replace=branch_grid)

# ----
# MESHES :: CAULKING
p_n_c_6 = PickNChoose(Pattern=bool_3, Stream1=vec_9)
p_n_c_7 = PickNChoose(Pattern=bool_3, Stream1=vec_10)
cluster_14 = Cluster_36(C=jamb_2)  # -> r1, r2
int_21 = Integer(1)
neg_2 = Negative(Value=int_21)

# ---- group: RIGHT JAMB LOCATION
vec_13 = Vector(p_n_c_6)

# ---- group: LEFT JAMB LOCATION
vec_14 = Vector(p_n_c_7)

# ---- group: RIGHT CAULKING IN-PLACE (R1 & R2)
move_17 = Move(Geometry=cluster_14.r1, Motion=vec_13)  # -> Geometry, Transform
move_18 = Move(Geometry=cluster_14.r2, Motion=vec_13)  # -> Geometry, Transform

# ---- group: LEFT CAULKING IN-PLACE (R1 & R2)
move_19 = Move(Geometry=cluster_14.r1, Motion=vec_14)  # -> Geometry, Transform
move_20 = Move(Geometry=cluster_14.r2, Motion=vec_14)  # -> Geometry, Transform

# ----
cluster_15 = Cluster_35(R=move_17.Geometry, V=vec_5, plane_sign=int_21)
cluster_16 = Cluster_35(R=move_18.Geometry, V=vec_5, plane_sign=int_21)
cluster_17 = Cluster_35(R=move_19.Geometry, V=vec_5, plane_sign=neg_2)
cluster_18 = Cluster_35(R=move_20.Geometry, V=vec_5, plane_sign=neg_2)
merge_15 = Merge(Data1=cluster_15, Data2=cluster_16)
merge_16 = Merge(Data1=cluster_17, Data2=cluster_18)

mesh_7 = Mesh(merge_15)
mesh_8 = Mesh(merge_16)
merge_17 = Merge(Data1=mesh_7, Data2=mesh_8, Data3=mesh_5, Data4=mesh_6, Data5=mesh_3, Data6=mesh_4, Data7=mesh, Data8=mesh_2)
window_wall_meshes = Mesh(merge_17)
split_2 = SplitTree(Data=window_wall_meshes, Masks=flatten("{0;*}"))  # -> Positive, Negative
window_wall_meshes_2 = ClusterOutput(window_wall_meshes)

# ==== cluster Cluster_38
window_widths = ClusterInput()
window_widths_2 = Number(window_widths)

viewer = ParamViewer(window_widths_2)
item = ListItem(List=window_widths_2, Index="0", Wrap=True)  # -> flatten(Item)
item_2 = ListItem(List=window_widths_2, Index="1", Wrap=True)  # -> flatten(Item)
lng = ListLength(List=viewer)
series = Series(Start=0, Step=1, Count=lng)
int = Integer(series)
pshift = ShiftPaths(Data=int, Offset=-1)
sort = SortList(Keys=item, ValuesA=item_2, ValuesB=viewer, ValuesC=pshift)  # -> Keys, ValuesA, ValuesB, ValuesC
cset = CreateSet(List=sort.Keys)  # -> graft(Set), Map
mindex = MemberIndex(Set=sort.Keys, Member=cset.Set)  # -> Index, Count
pshift_2 = ShiftPaths(Data=mindex.Index, Offset=-1)
item_3 = ListItem(List=sort.Keys, Index=pshift_2, Wrap=True)
item_4 = ListItem(List=sort.ValuesA, Index=pshift_2, Wrap=True)
item_5 = ListItem(List=sort.ValuesB, Index=pshift_2, Wrap=True)
item_6 = ListItem(List=sort.ValuesC, Index=pshift_2, Wrap=True)
sort_2 = SortList(Keys=item_4, ValuesA=item_3, ValuesB=item_5, ValuesC=item_6)  # -> Keys, ValuesA, ValuesB, ValuesC
cset_2 = CreateSet(List=sort_2.Keys)  # -> Set, Map
mindex_2 = MemberIndex(Set=sort_2.Keys, Member=cset_2.Set)  # -> Index, Count
partition = PartitionList(List=sort_2.ValuesB, Size=mindex_2.Count)
partition_2 = PartitionList(List=sort_2.ValuesC, Size=mindex_2.Count)
partition_3 = PartitionList(List=sort_2.Keys, Size=mindex_2.Count)
partition_4 = PartitionList(List=sort_2.ValuesA, Size=mindex_2.Count)

# ---- group: ONE OF EACH WINDOW TYPE
item_7 = ListItem(List=partition, Index=0, Wrap=True)
item_8 = ListItem(List=partition_2, Index=0, Wrap=True)  # -> flatten(Item)
item_9 = ListItem(List=partition_3, Index=0, Wrap=True)
item_10 = ListItem(List=partition_4, Index=0, Wrap=True)
int_2 = Integer(mindex_2.Count)
int_3 = Integer(graft(int_2))
viewer_2 = ParamViewer(int_2)
viewer_3 = ParamViewer(int_3)

# ---- group: GRID DATA BRANCHES
txt = Text(viewer_3)

txt_2 = Text(viewer_2)

# ---- group: WINDOW TYPE QTY
int_4 = Integer(int_2)

# ---- group: BREP DATA BRANCHES
txt_3 = Text(item_7)

# ---- group: DE-SORTED INDICES
int_5 = Integer(item_8)

# ----
vent_width = Integer(item_9)
window_width = Integer(item_10)
sort_3 = SortList(Keys=int_5, ValuesA=txt)  # -> Keys, ValuesA
windows_meshes = ClusterInput()
window_walls = ClusterInput()
approx_window_center_pt = ClusterInput()
approx_window_center_pt_2 = XZPlane(APPROXWINDOWCENTERPT=approx_window_center_pt)
schedule_location = ClusterInput()

# ---- group: BREP DATA BRANCHES
branch_w_type = Text(flatten(txt_3))

# ---- group: DE-SORTED GRID DATA BRANCHES
branch_grid = Text(flatten(sort_3.ValuesA))

# ----
windows_meshes_2 = Mesh(windows_meshes)
window_walls_2 = Brep(window_walls)

# ---- group: GRID DATA BRANCHES
txt_4 = Text(txt)

txt_5 = Text(txt_2)

# ---- group: DATA BRANCHES
txt_6 = Text(txt_3)

# ----
schedule_location_2 = Point(schedule_location)

pshift_3 = ShiftPaths(Data=txt_6, Offset=-1)
lng_2 = ListLength(List=pshift_3)  # -> flatten(Length)
bnd = Bounds(Numbers=lng_2)
schedule_location_3 = Point(schedule_location_2)
xy = XYPlane(Origin=schedule_location_3)
neg = Negative(Value="4000")
lng_3 = ListLength(List=txt_5)
dedomain = DeconstructDomain(Domain=bnd)  # -> Start, End
recgrid = Rectangular(Plane=xy, SizeX=neg, SizeY="4000", ExtentX=lng_3, ExtentY=dedomain.End)  # -> Cells, Points
lng_4 = ListLength(List=pshift_3)
split = SplitList(List=recgrid.Cells, Index=lng_4)  # -> ListA, ListB
crv = Curve(graft(split.ListA))
crv_2 = Curve(crv)
viewer_4 = ParamViewer(crv_2)
replace = ReplacePaths(Data=crv_2, Search=viewer_4, Replace=txt_4)
pcen = PolygonCenter(Polyline=replace)  # -> CenterV, CenterE, CenterA
pt = Point(pcen.CenterV)
vec2pt = Vector2Pt(PointA=schedule_location_3, PointB=pt, Unitize=False)  # -> Vector, Length
move = Move(Geometry=xy, Motion=vec2pt.Vector)  # -> Geometry, Transform

branch = TreeBranch(Tree=windows_meshes_2, Path=branch_w_type, MaintainPaths=True)
viewer_5 = ParamViewer(branch)
replace_2 = ReplacePaths(Data=branch, Search=viewer_5, Replace=branch_grid)
window_type_qty = Integer(graft(int_4))
schedule_planes = Plane(move.Geometry)

branch_2 = TreeBranch(Tree=window_walls_2, Path=branch_w_type, MaintainPaths=True)
branch_3 = TreeBranch(Tree=approx_window_center_pt_2, Path=branch_w_type, MaintainPaths=True)
viewer_6 = ParamViewer(branch_3)
viewer_7 = ParamViewer(branch_2)
replace_3 = ReplacePaths(Data=branch_2, Search=viewer_7, Replace=branch_grid)
replace_4 = ReplacePaths(Data=branch_3, Search=viewer_6, Replace=branch_grid)
orient = Orient(Geometry=replace_3, Source=replace_4, Target=schedule_planes)  # -> Geometry, Transform

orient_2 = Orient(Geometry=replace_2, Source=replace_4, Target=schedule_planes)  # -> Geometry, Transform
re_oriented_windows_meshes = Mesh(orient_2.Geometry)
re_oriented_window_walls = Brep(orient.Geometry)

# ---- group: GRID CELLS
schedule_cells = Curve(crv)

# ----
re_oriented_windows_meshes_2 = ClusterOutput(re_oriented_windows_meshes)
re_oriented_window_walls_2 = ClusterOutput(re_oriented_window_walls)
window_type_qty_2 = ClusterOutput(window_type_qty)
schedule_planes_2 = ClusterOutput(schedule_planes)
schedule_cells_2 = ClusterOutput(schedule_cells)
vent_width_2 = ClusterOutput(vent_width)
window_width_2 = ClusterOutput(window_width)

# ==== cluster Cluster_40
facade_perimeters = ClusterInput()
pln = ClusterInput()
facade_perimeters_2 = Curve(facade_perimeters)
pln_2 = Plane(pln)

# ---- group: FACADE PATHS
i = Index(0)
i_2 = Index(1)
i_3 = Index(2)
i_4 = Index(3)

# ----
item = ListItem(List=facade_perimeters_2, Index=i, Wrap=True)
item_2 = ListItem(List=pln_2, Index=i, Wrap=True)
item_3 = ListItem(List=facade_perimeters_2, Index=i_2, Wrap=True)
item_4 = ListItem(List=pln_2, Index=i_2, Wrap=True)
item_5 = ListItem(List=facade_perimeters_2, Index=i_4, Wrap=True)
item_6 = ListItem(List=pln_2, Index=i_4, Wrap=True)
item_7 = ListItem(List=facade_perimeters_2, Index=i_3, Wrap=True)
item_8 = ListItem(List=pln_2, Index=i_3, Wrap=True)
xz = XZPlane(Origin=Point(0, 0, 0))
panels_inner_wythe = ClusterInput()
orient = Orient(Geometry=item, Source=item_2, Target=xz)  # -> Geometry, Transform
orient_2 = Orient(Geometry=item_3, Source=item_4, Target=xz)  # -> Geometry, Transform
orient_3 = Orient(Geometry=item_5, Source=item_6, Target=xz)  # -> Geometry, Transform
panels_inner_wythe_2 = Curve(panels_inner_wythe)
orient_4 = Orient(Geometry=item_7, Source=item_8, Target=xz)  # -> Geometry, Transform
cluster = Cluster_39(inner_wythe=panels_inner_wythe_2, facade_perim=orient.Geometry, re_oriented_pl=xz)  # -> corner_left_2, corner_right_2, typ_glazing_2
cluster_2 = Cluster_39(inner_wythe=panels_inner_wythe_2, facade_perim=orient_2.Geometry, re_oriented_pl=xz)  # -> corner_left_2, corner_right_2, typ_glazing_2
cluster_3 = Cluster_39(inner_wythe=panels_inner_wythe_2, facade_perim=orient_3.Geometry, re_oriented_pl=xz)  # -> corner_left_2, corner_right_2, typ_glazing_2
cluster_4 = Cluster_39(inner_wythe=panels_inner_wythe_2, facade_perim=orient_4.Geometry, re_oriented_pl=xz)  # -> corner_left_2, corner_right_2, typ_glazing_2
crv = Curve(cluster.corner_left_2)
crv_2 = Curve(cluster.corner_right_2)
crv_3 = Curve(cluster.typ_glazing_2)
crv_4 = Curve(cluster_2.corner_left_2)
crv_5 = Curve(cluster_2.corner_right_2)
crv_6 = Curve(cluster_2.typ_glazing_2)
crv_7 = Curve(cluster_4.corner_left_2)
crv_8 = Curve(cluster_4.corner_right_2)
crv_9 = Curve(cluster_4.typ_glazing_2)
crv_10 = Curve(cluster_3.corner_left_2)
crv_11 = Curve(cluster_3.corner_right_2)
crv_12 = Curve(cluster_3.typ_glazing_2)
path_mapper = PathMapper(crv, source="{A;B}", target="{0;A;B}")
path_mapper_2 = PathMapper(crv_2, source="{A;B}", target="{0;A;B}")
path_mapper_3 = PathMapper(crv_3, source="{A;B}", target="{0;A;B}")
path_mapper_4 = PathMapper(crv_4, source="{A;B}", target="{1;A;B}")
path_mapper_5 = PathMapper(crv_5, source="{A;B}", target="{1;A;B}")
path_mapper_6 = PathMapper(crv_6, source="{A;B}", target="{1;A;B}")
path_mapper_7 = PathMapper(crv_7, source="{A;B}", target="{2;A;B}")
path_mapper_8 = PathMapper(crv_8, source="{A;B}", target="{2;A;B}")
path_mapper_9 = PathMapper(crv_9, source="{A;B}", target="{2;A;B}")
path_mapper_10 = PathMapper(crv_10, source="{A;B}", target="{3;A;B}")
path_mapper_11 = PathMapper(crv_11, source="{A;B}", target="{3;A;B}")
path_mapper_12 = PathMapper(crv_12, source="{A;B}", target="{3;A;B}")

# ---- group: LEFT CORNER
merge = Merge(Data1=path_mapper, Data2=path_mapper_4, Data3=path_mapper_7, Data4=path_mapper_10)

# ---- group: RIGHT CORNER
merge_2 = Merge(Data1=path_mapper_2, Data2=path_mapper_5, Data3=path_mapper_8, Data4=path_mapper_11)

# ----
merge_3 = Merge(Data1=path_mapper_3, Data2=path_mapper_6, Data3=path_mapper_9, Data4=path_mapper_12)
split = SplitTree(Data=merge, Masks=flatten("{0;*}"))  # -> Positive, Negative
split_2 = SplitTree(Data=merge_2, Masks=flatten("{3;*}"))  # -> Positive, Negative
split_3 = SplitTree(Data=merge, Masks=flatten("{2;*}"))  # -> Positive, Negative
split_4 = SplitTree(Data=merge_2, Masks=flatten("{1;*}"))  # -> Positive, Negative
crv_13 = Curve(merge_3)
merge_4 = Merge(Data1=split.Positive, Data2=crv_13, Data3=split_2.Positive)
merge_5 = Merge(Data1=split_3.Positive, Data2=split_4.Positive)
path_mapper_13 = PathMapper(merge_4, source="{A;B;C}", target="{A;B + 1;C}")
path_mapper_14 = PathMapper(merge_5, source="{A;B;C}", target="{A;B + 1;C}")
window_curves = Curve(path_mapper_13)
corner_window_curves = Curve(path_mapper_14)
window_curves_2 = ClusterOutput(window_curves)
corner_window_curves_2 = ClusterOutput(corner_window_curves)

# ==== cluster Cluster_42
world_xz = ClusterInput()
windows_breps = ClusterInput()
windows_meshes = ClusterInput()
window_pts = ClusterInput()
re_oriented_planes = ClusterInput()
world_xz_2 = Plane(world_xz)
windows_breps_2 = Brep(windows_breps)
windows_meshes_2 = Mesh(windows_meshes)
window_pts_2 = Point(window_pts)
pshift = ShiftPaths(Data=window_pts_2, Offset=-2)
re_oriented_planes_2 = Plane(re_oriented_planes)
viewer = ParamViewer(pshift)
dpath = DeconstructPath(Branch=viewer)  # -> flatten(Indices)

# ---- group: FACADE PATHS
i = Index(0)
i_2 = Index(2)
i_3 = Index(3)
i_4 = Index(1)

# ----
paths_as_int = Integer(dpath)
merge = Merge(Data1=i, Data2=i_4, Data3=i_2, Data4=i_3)
cluster = Cluster_41(
    xz=world_xz_2,
    window_walls=windows_breps_2,
    window_wall_meshes=windows_meshes_2,
    all_window_pts=window_pts_2,
    all_paths_as_int=merge,
    facade_index=i,
    all_facade_planes=re_oriented_planes_2)  # -> window_walls_4, window_wall_meshes_4, window_pts_2, window_planes_2
cluster_2 = Cluster_41(
    xz=world_xz_2,
    window_walls=windows_breps_2,
    window_wall_meshes=windows_meshes_2,
    all_window_pts=window_pts_2,
    all_paths_as_int=merge,
    facade_index=i_4,
    all_facade_planes=re_oriented_planes_2)  # -> window_walls_4, window_wall_meshes_4, window_pts_2, window_planes_2
cluster_3 = Cluster_41(
    xz=world_xz_2,
    window_walls=windows_breps_2,
    window_wall_meshes=windows_meshes_2,
    all_window_pts=window_pts_2,
    all_paths_as_int=merge,
    facade_index=i_2,
    all_facade_planes=re_oriented_planes_2)  # -> window_walls_4, window_wall_meshes_4, window_pts_2, window_planes_2
cluster_4 = Cluster_41(
    xz=world_xz_2,
    window_walls=windows_breps_2,
    window_wall_meshes=windows_meshes_2,
    all_window_pts=window_pts_2,
    all_paths_as_int=merge,
    facade_index=i_3,
    all_facade_planes=re_oriented_planes_2)  # -> window_walls_4, window_wall_meshes_4, window_pts_2, window_planes_2
merge_2 = Merge(
    Data1=cluster.window_walls_4,
    Data2=cluster_2.window_walls_4,
    Data3=cluster_3.window_walls_4,
    Data4=cluster_4.window_walls_4)
merge_3 = Merge(
    Data1=cluster.window_wall_meshes_4,
    Data2=cluster_2.window_wall_meshes_4,
    Data3=cluster_3.window_wall_meshes_4,
    Data4=cluster_4.window_wall_meshes_4)
merge_4 = Merge(Data1=cluster.window_pts_2, Data2=cluster_2.window_pts_2, Data3=cluster_3.window_pts_2, Data4=cluster_4.window_pts_2)
merge_5 = Merge(
    Data1=cluster.window_planes_2,
    Data2=cluster_2.window_planes_2,
    Data3=cluster_3.window_planes_2,
    Data4=cluster_4.window_planes_2)
windows_breps_3 = Brep(merge_2)
window_pts_3 = Point(merge_4)
window_planes = Plane(merge_5)
windows_meshes_3 = Mesh(merge_3)
windows_breps_4 = ClusterOutput(windows_breps_3)
windows_meshes_4 = ClusterOutput(windows_meshes_3)
window_pts_4 = ClusterOutput(window_pts_3)
window_planes_2 = ClusterOutput(window_planes)

# ==== cluster Cluster_34
C = ClusterInput()
V = ClusterInput()
C_2 = Curve(C)
V_2 = Vector(V)
move = Move(Geometry=C_2, Motion=V_2)  # -> Geometry, Transform
mesh = MeshBrep(
    Brep=C_2,
    Settings={GridMaxCount=0, GridMinCount=16, JaggedSeams=False, MaxEdgeLength=0, MinEdgeLength=0.0001, MinTolerance=0, Refine=True, RefineAngle=0, RelativeTolerance=0.65, SimplePlanes=True, Tolerance=0})
mesh_2 = MeshBrep(
    Brep=move.Geometry,
    Settings={GridMaxCount=0, GridMinCount=16, JaggedSeams=False, MaxEdgeLength=0, MinEdgeLength=0.0001, MinTolerance=0, Refine=True, RefineAngle=0, RelativeTolerance=0.65, SimplePlanes=True, Tolerance=0})
explode = Explode(Curve=C_2, Recursive=True)  # -> Segments, Vertices
explode_2 = Explode(Curve=move.Geometry, Recursive=True)  # -> Segments, Vertices
cull_i = CullIndex(List=reverse(explode.Vertices), Indices=0, Wrap=True)  # -> reverse(List)
cull_i_2 = CullIndex(List=reverse(explode_2.Vertices), Indices=0, Wrap=True)  # -> reverse(List)
pshift = ShiftPaths(Data=cull_i, Offset=-2)
pshift_2 = ShiftPaths(Data=cull_i_2, Offset=-2)
shift = ShiftList(List=pshift, Shift=1, Wrap=True)
shift_2 = ShiftList(List=pshift_2, Shift=1, Wrap=True)
pshift_3 = ShiftPaths(Data=shift, Offset=-1)
pshift_4 = ShiftPaths(Data=shift_2, Offset=-1)
merge = Merge(Data1=graft(pshift), Data2=graft(pshift_3), Data3=graft(pshift_4), Data4=graft(pshift_2))
conmesh = ConstructMesh(Vertices=merge, Faces={A=0, B=1, C=2, D=3})
pshift_5 = ShiftPaths(Data=conmesh, Offset=-1)
merge_2 = Merge(Data1=mesh, Data2=mesh_2, Data3=pshift_5)
mjoin = MeshJoin(Meshes=merge_2)
M = ClusterOutput(mjoin)

# ==== cluster Cluster_35
R = ClusterInput()
V = ClusterInput()
plane_sign = ClusterInput()
plane_sign_2 = Integer(plane_sign)
vlen = VectorLength(Vector=V)
multiplication = Multiplication(A=vlen, B=plane_sign_2)
boxrec = BoxRectangle(Rectangle=R, Height=multiplication)
mbox = MeshBox(Base=boxrec, XCount=1, YCount=1, ZCount=1)
M = ClusterOutput(mbox)

# ==== cluster Cluster_36
C = ClusterInput()
C_2 = Curve(C)
explode = Explode(Curve=C_2, Recursive=True)  # -> Segments, Vertices
planar = Planar(Curve=C_2)  # -> Planar, Plane, Deviation
item = ListItem(List=explode.Vertices, Index=0, Wrap=True)
item_2 = ListItem(List=explode.Vertices, Index=2, Wrap=True)
item_3 = ListItem(List=explode.Vertices, Index=3, Wrap=True)
item_4 = ListItem(List=explode.Vertices, Index=5, Wrap=True)
rec_2pt = Rectangle2Pt(Plane=planar.Plane, PointA=item, PointB=item_2, Radius=0)  # -> Rectangle, Length
rec_2pt_2 = Rectangle2Pt(Plane=planar.Plane, PointA=item_3, PointB=item_4, Radius=0)  # -> Rectangle, Length
r1 = ClusterOutput(rec_2pt.Rectangle)
r2 = ClusterOutput(rec_2pt_2.Rectangle)

# ==== cluster Cluster_39
inner_wythe = ClusterInput()
facade_perim = ClusterInput()
re_oriented_pl = ClusterInput()
inner_wythe_2 = Curve(inner_wythe)
facade_perim_2 = Curve(facade_perim)
re_oriented_pl_2 = Plane(re_oriented_pl)
crv = Curve(inner_wythe_2)
deplane = DeconstructPlane(Plane=re_oriented_pl_2)  # -> Origin, XAxis, YAxis, ZAxis

explode = Explode(Curve=inner_wythe_2, Recursive=True)  # -> Segments, Vertices
cullpt = CullDuplicates(Points=explode.Vertices, Tolerance=0.1, CullMode=3)  # -> Points, Indices, Valence
incurve = PointInCurve(Point=cullpt.Points, Curve=facade_perim_2)  # -> Relationship, Point
avr = Average(Input=incurve.Relationship)
equals = Equality(FirstNumber=avr, SecondNumber=2)  # -> Equality, Inequality
crv_2 = Curve(inner_wythe_2)
pshift = ShiftPaths(Data=equals.Equality, Offset=-2)
viewer = ParamViewer(crv_2)
inside_facade = Boolean(pshift)
cull = CullPattern(List=viewer, CullPattern=flatten(inside_facade))
cull_2 = CullPattern(List=crv_2, CullPattern=inside_facade)

branch = TreeBranch(Tree=crv, Path=cull, MaintainPaths=True)

pshift_2 = ShiftPaths(Data=inside_facade, Offset=-1)
lng = ListLength(List=pshift_2)  # -> flatten(Length)
partition = PartitionList(List=viewer, Size=lng)
flip = FlipMatrix(Data=partition)
flip_2 = FlipMatrix(Data=pshift_2)
cull_3 = CullPattern(List=flip, CullPattern=flip_2)
item = ListItem(List=reverse(cull_3), Index=0, Wrap=True)
item_2 = ListItem(List=cull_3, Index=0, Wrap=True)

explode_2 = Explode(Curve=branch, Recursive=True)  # -> Segments, Vertices
cull_i = CullIndex(List=explode_2.Vertices, Indices=4, Wrap=True)
pshift_3 = ShiftPaths(Data=cull_i, Offset=-2)
relitem = RelativeItem(Tree=pshift_3, Offset="{1;0}", WrapPaths=False, WrapItems=False)  # -> ItemA, ItemB

branch_2 = TreeBranch(Tree=cull_2, Path=flatten(item_2), MaintainPaths=True)
branch_3 = TreeBranch(Tree=cull_2, Path=flatten(item), MaintainPaths=True)
path_mapper = PathMapper(branch_2, source="{A;B}", target="{B}")
path_mapper_2 = PathMapper(branch_3, source="{A;B}", target="{B}")

item_3 = ListItem(List=relitem.ItemA, Index=3, Wrap=True)
item_4 = ListItem(List=relitem.ItemA, Index=2, Wrap=True)
item_5 = ListItem(List=relitem.ItemB, Index=1, Wrap=True)
item_6 = ListItem(List=relitem.ItemB, Index=0, Wrap=True)
viewer_2 = ParamViewer(branch_2)
viewer_3 = ParamViewer(branch_3)
merge = Merge(Data1=item_3, Data2=item_4, Data3=item_5, Data4=item_6)
pline = PolyLine(Vertices=merge, Closed=True)
path = DataPath(viewer_2)
path_2 = DataPath(viewer_3)
dpath = DeconstructPath(Branch=path)
dpath_2 = DeconstructPath(Branch=path_2)
item_7 = ListItem(List=dpath, Index=1, Wrap=True)  # -> flatten(Item)
item_8 = ListItem(List=dpath_2, Index=1, Wrap=True)  # -> flatten(Item)
sort = SortList(Keys=item_7, ValuesA=path)  # -> Keys, ValuesA
sort_2 = SortList(Keys=item_8, ValuesA=path_2)  # -> Keys, ValuesA
typ_glazing = Curve(pline)
typ_glazing_2 = ClusterOutput(typ_glazing)

explode_3 = Explode(Curve=path_mapper, Recursive=True)  # -> Segments, Vertices
item_9 = ListItem(List=explode_3.Vertices, Index=0, Wrap=True)
item_10 = ListItem(List=explode_3.Vertices, Index=1, Wrap=True)
xy = XYPlane(Origin=item_9)
xy_2 = XYPlane(Origin=item_10)
pcx = CurvePlane(Curve=facade_perim_2, Plane=xy)  # -> Points, ParamsC, ParamsP
pcx_2 = CurvePlane(Curve=facade_perim_2, Plane=xy_2)  # -> Points, ParamsC, ParamsP
pshift_4 = ShiftPaths(Data=pcx.Points, Offset=-1)
pshift_5 = ShiftPaths(Data=pcx_2.Points, Offset=-1)
devec = DeconstructVector(Vector=deplane.XAxis)  # -> XComponent, YComponent, ZComponent
addition = Addition(A=devec.XComponent, B=devec.YComponent)
neg = Negative(Value=addition)

explode_4 = Explode(Curve=path_mapper_2, Recursive=True)  # -> Segments, Vertices
item_11 = ListItem(List=explode_4.Vertices, Index=3, Wrap=True)
item_12 = ListItem(List=explode_4.Vertices, Index=2, Wrap=True)
xy_3 = XYPlane(Origin=item_11)
xy_4 = XYPlane(Origin=item_12)
pcx_3 = CurvePlane(Curve=facade_perim_2, Plane=xy_3)  # -> Points, ParamsC, ParamsP
pcx_4 = CurvePlane(Curve=facade_perim_2, Plane=xy_4)  # -> Points, ParamsC, ParamsP
pshift_6 = ShiftPaths(Data=pcx_3.Points, Offset=-1)
pshift_7 = ShiftPaths(Data=pcx_4.Points, Offset=-1)
vec2pt = Vector2Pt(PointA=item_11, PointB=pshift_6, Unitize=False)  # -> unitize(Vector), Length
vec2pt_2 = Vector2Pt(PointA=item_12, PointB=pshift_7, Unitize=False)  # -> unitize(Vector), Length
devec_2 = DeconstructVector(Vector=vec2pt.Vector)  # -> XComponent, YComponent, ZComponent
devec_3 = DeconstructVector(Vector=deplane.XAxis)  # -> XComponent, YComponent, ZComponent
devec_4 = DeconstructVector(Vector=vec2pt_2.Vector)  # -> XComponent, YComponent, ZComponent
addition_2 = Addition(A=devec_2.XComponent, B=devec_2.YComponent, C=devec_2.ZComponent)
addition_3 = Addition(A=devec_3.XComponent, B=devec_3.YComponent)
addition_4 = Addition(A=devec_4.XComponent, B=devec_4.YComponent, C=devec_4.ZComponent)
similar = Similarity(FirstNumber=addition_2, SecondNumber=addition_3, Threshold=10)  # -> Similarity, AbsoluteDifference
similar_2 = Similarity(FirstNumber=addition_4, SecondNumber=addition_3, Threshold=10)  # -> Similarity, AbsoluteDifference
cull_4 = CullPattern(List=pshift_6, CullPattern=similar.Similarity)
cull_5 = CullPattern(List=pshift_7, CullPattern=similar_2.Similarity)
pdecon = Deconstruct(Point=cull_4)  # -> XComponent, YComponent, ZComponent
pdecon_2 = Deconstruct(Point=cull_5)  # -> XComponent, YComponent, ZComponent
pt = ConstructPoint(XCoordinate=pdecon.XComponent, YCoordinate=pdecon.YComponent, ZCoordinate=pdecon_2.ZComponent)

vec2pt_3 = Vector2Pt(PointA=item_11, PointB=pshift_4, Unitize=False)  # -> unitize(Vector), Length
vec2pt_4 = Vector2Pt(PointA=item_12, PointB=pshift_5, Unitize=False)  # -> unitize(Vector), Length
devec_5 = DeconstructVector(Vector=vec2pt_3.Vector)  # -> XComponent, YComponent, ZComponent
devec_6 = DeconstructVector(Vector=vec2pt_4.Vector)  # -> XComponent, YComponent, ZComponent
addition_5 = Addition(A=devec_5.XComponent, B=devec_5.YComponent, C=devec_5.ZComponent)
addition_6 = Addition(A=devec_6.XComponent, B=devec_6.YComponent, C=devec_6.ZComponent)
similar_3 = Similarity(FirstNumber=addition_5, SecondNumber=neg, Threshold=10)  # -> Similarity, AbsoluteDifference
similar_4 = Similarity(FirstNumber=addition_6, SecondNumber=neg, Threshold=10)  # -> Similarity, AbsoluteDifference
cull_6 = CullPattern(List=pshift_4, CullPattern=similar_3.Similarity)
cull_7 = CullPattern(List=pshift_5, CullPattern=similar_4.Similarity)
pdecon_3 = Deconstruct(Point=cull_6)  # -> XComponent, YComponent, ZComponent
pdecon_4 = Deconstruct(Point=cull_7)  # -> XComponent, YComponent, ZComponent
pt_2 = ConstructPoint(XCoordinate=pdecon_3.XComponent, YCoordinate=pdecon_3.YComponent, ZCoordinate=pdecon_4.ZComponent)
merge_2 = Merge(Data1=cull_6, Data2=pt_2, Data3=item_10, Data4=item_9)
pline_2 = PolyLine(Vertices=merge_2, Closed=True)

merge_3 = Merge(Data1=item_11, Data2=item_12, Data3=pt, Data4=cull_4)

pline_3 = PolyLine(Vertices=merge_3, Closed=True)

viewer_4 = ParamViewer(pline_2)
viewer_5 = ParamViewer(pline_3)
replace = ReplacePaths(Data=pline_2, Search=viewer_4, Replace=sort.ValuesA)
replace_2 = ReplacePaths(Data=pline_3, Search=viewer_5, Replace=sort_2.ValuesA)
path_mapper_3 = PathMapper(replace, source="{A;B}", target="{A - 1;B}")
corner_left = Curve(path_mapper_3)
corner_right = Curve(replace_2)
corner_left_2 = ClusterOutput(corner_left)
corner_right_2 = ClusterOutput(corner_right)

# ==== cluster Cluster_41
window_walls = ClusterInput()
window_wall_meshes = ClusterInput()
all_window_pts = ClusterInput()
all_paths_as_int = ClusterInput()
facade_index = ClusterInput()
all_facade_planes = ClusterInput()
window_walls_2 = Brep(window_walls)
window_wall_meshes_2 = Mesh(window_wall_meshes)
all_window_pts_2 = Point(all_window_pts)
all_paths_as_int_2 = Integer(all_paths_as_int)
facade_index_2 = Integer(facade_index)
all_facade_planes_2 = Plane(all_facade_planes)
item = ListItem(List=all_paths_as_int_2, Index=facade_index_2, Wrap=False)
item_2 = ListItem(List=all_facade_planes_2, Index=facade_index_2, Wrap=False)
expression = Expression(x=item, Expression="Format(\"{{{0};*}}\", x)")
xz = ClusterInput()
split = SplitTree(Data=all_window_pts_2, Masks=flatten(expression))  # -> Positive, Negative
split_2 = SplitTree(Data=window_walls_2, Masks=flatten(expression))  # -> Positive, Negative
split_3 = SplitTree(Data=window_wall_meshes_2, Masks=flatten(expression))  # -> Positive, Negative
xz_2 = Plane(xz)
orient = Orient(Geometry=split.Positive, Source=xz_2, Target=item_2)  # -> Geometry, Transform
orient_2 = Orient(Geometry=split_2.Positive, Source=xz_2, Target=item_2)  # -> Geometry, Transform
orient_3 = Orient(Geometry=split_3.Positive, Source=xz_2, Target=item_2)  # -> Geometry, Transform
avr = Average(Input=orient.Geometry)
pl_origin = PlaneOrigin(Base=item_2, Origin=avr)
window_walls_3 = Brep(orient_2.Geometry)
window_wall_meshes_3 = Mesh(orient_3.Geometry)
window_pts = Point(orient.Geometry)
window_planes = Plane(pl_origin)
window_walls_4 = ClusterOutput(window_walls_3)
window_wall_meshes_4 = ClusterOutput(window_wall_meshes_3)
window_pts_2 = ClusterOutput(window_pts)
window_planes_2 = ClusterOutput(window_planes)
